# Grasshopper definition Estructura.ghx (Grasshopper 1.0.8)
# plug-ins: Pufferfish

_02_0_pata = ValueList({"Pata Conica": "40", "Pata Cilindrica": "10", "Es de Colgar": "0"}, selected="Pata Conica")

# ---- group: Dimensiones Generales
# Estructura
rh_in_01_0_ancho = Slider(1800, range=300..2440)
rh_in_01_1_profundidad = Slider(300, range=200..600)
rh_in_01_2_altura = Slider(1800, range=200..2440)
subtraction = Subtraction(A=rh_in_01_2_altura, B=_02_0_pata)
unit_z = UnitZ(Factor=_02_0_pata)
domain_box = DomainBox(Base=PlaneXY(0, 0, 0), X=rh_in_01_0_ancho, Y=rh_in_01_1_profundidad, Z=subtraction)
move = Move(Geometry=domain_box, Motion=unit_z)  # -> Geometry, Transform
area = Area(Geometry=move.Geometry)  # -> Area, Centroid
yz_plane = YZPlane(Origin=area.Centroid)

# ----
# Tablero Inferior
deconstruct_brep = DeconstructBrep(Brep=move.Geometry)  # -> Faces, Edges, Vertices
unit_z_2 = UnitZ(Factor="15")
list_item = ListItem(List=deconstruct_brep.Vertices, Index="0", Wrap=True)
list_item_2 = ListItem(List=deconstruct_brep.Vertices, Index="2", Wrap=True)
move_2 = Move(Geometry=list_item, Motion=unit_z_2)  # -> Geometry, Transform
eliminar_tablero_inferior = ValueList({"No": "0", "Si": "1"}, selected="No")
box_2pt = Box2Pt(PointA=move_2.Geometry, PointB=list_item_2, Plane=PlaneXY(0, 0, 0))
stream_filter = StreamFilter(Gate=eliminar_tablero_inferior, Stream0=box_2pt)
area_2 = Area(Geometry=stream_filter)  # -> Area, Centroid
yz_plane_2 = YZPlane(Origin=area_2.Centroid)
xz_plane = XZPlane(Origin=area_2.Centroid)
deconstruct_brep_2 = DeconstructBrep(Brep=box_2pt)  # -> Faces, Edges, Vertices

expression = Expression(x=_02_0_pata, Expression="if (x=\"40\",0,if(x=\"10\",1,if(x=\"0\",2,\"\")))")
expression_2 = Expression(x=eliminar_tablero_inferior, Expression="if(x=\"1\",-15,\"\")")
panel = Panel(expression_2)
panel_2 = Panel(expression)

vector_2pt = Vector2Pt(Unitize=False)  # -> Vector, Length
move_3 = Move(Motion=vector_2pt.Vector)  # -> Geometry, Transform

panel_3 = Panel("name")
panel_4 = Panel("Tornillo_123")
panel_5 = Panel("4")  # disabled
panel_6 = Panel("2")  # disabled
panel_7 = Panel("4")  # disabled
panel_8 = Panel("2")  # disabled
distancia_minima_al_borde = Panel("20")  # disabled
paso_maquinas = Panel("32")  # disabled
distancia_minima_al_borde_2 = Panel("20")  # disabled
paso_maquinas_2 = Panel("32")  # disabled
negative = Negative(Value=paso_maquinas)  # disabled
unit_y = UnitY(Factor=negative)  # disabled
panel_9 = Panel("22")  # disabled
unit_z_3 = UnitZ(Factor=panel_9)  # disabled
panel_10 = Panel("-15")  # disabled
panel_11 = Panel("3")  # disabled
panel_12 = Panel("-15")  # disabled
panel_13 = Panel("3")  # disabled
panel_14 = Panel("20")  # disabled
panel_15 = Panel("1.5")  # disabled
panel_16 = Panel("1.5")  # disabled
panel_17 = Panel("20")  # disabled
panel_18 = Panel("4")  # disabled
panel_19 = Panel("-32")  # disabled
panel_20 = Panel("2")  # disabled
panel_21 = Panel("-4")  # disabled
unit_x = UnitX(Factor=panel_21)  # disabled
relay = Relay()  # disabled
panel_22 = Panel("6")  # disabled
panel_23 = Panel("11.5")  # disabled
panel_24 = Panel("1")  # disabled
panel_25 = Panel("180")  # disabled
relay_2 = Relay()  # disabled

_04_2_sujecion_inferior = ValueList({"Tuerca tornillo tarugo": 0, "Tornillo tarugo": 1}, selected="Tuerca tornillo tarugo")
_04_4_altura = Slider(100, range=100..2200)

# ---- group: Lateral Izquierdo / Inferior
rh_in_03_13_sujecion_inferior_herraje_ex = ValueList({"tarugo": 0, "minifix de Presion": 1, "Minifix Roscado": 2, "Tornillo Largo": 3, "Tornillo PT": 4, "Tuerca": 5}, selected="tarugo")  # "RH_IN:03.13 Sujecion Inferior Herraje Externo"
rh_in_03_14_posicion = ValueList({"0", "1", "2", "3", "4", "5", "6", "7", "8", "9", "10"}, selected="0")
rh_in_03_15_simetria = ValueList({"no": 0, "si": 1}, selected="si")
rh_in_03_16_sujecion_inferior_herraje_in = ValueList({"tarugo": 0, "minifix de Presion": 1, "Minifix Roscado": 2, "Tornillo Largo": 3, "Tornillo PT": 4, "Tuerca": 5, "N/A": 6}, selected="tarugo")  # "RH_IN:03.16 Sujecion Inferior Herraje Interno"
rh_in_03_17_posicion = ValueList({"0", "1", "2", "3", "4", "5", "6", "7", "8", "9", "10"}, selected="1")
rh_in_03_18_simetria = ValueList({"no": 0, "si": 1}, selected="si")
rh_in_03_19_cambiar_lado = ValueList({"0", "180": "1"}, selected="0")

# ---- group: Lateral Izquierdo / Superior
rh_in_03_6_sujecion_superior_externo = ValueList({"tarugo": 0, "minifix de Presion": 1, "Minifix Roscado": 2, "Tornillo Largo": 3, "Tornillo PT": 4, "Tuerca": 5}, selected="minifix de Presion")
rh_in_03_7_posicion = ValueList({"0", "1", "2", "3", "4", "5", "6", "7", "8", "9", "10"}, selected="0")
rh_in_03_8_simetria = ValueList({"no": 0, "si": 1}, selected="si")
rh_in_03_9_sujecion_superior_interno = ValueList({"tarugo": 0, "minifix de Presion": 1, "Minifix Roscado": 2, "Tornillo Largo": 3, "Tornillo PT": 4, "Tuerca": 5, "N/A": 6}, selected="tarugo")
rh_in_03_10_posicion = ValueList({"0", "1", "2", "3", "4", "5", "6", "7", "8", "9", "10"}, selected="1")
rh_in_03_11_simetria = ValueList({"no": 0, "si": 1}, selected="si")
rh_in_03_12_cambiar_lado = ValueList({"0", "180": "1"}, selected="180")

# ---- group: Divisiones
# Multiplocador de Verticales
panel_26 = Panel("6")
rh_in_02_0_divisiones = ValueList({"0": "1", "1": "2", "2": "3", "3": "4"}, selected="3")

# ----
# Definicion para Patas
_02_2_desfase = Slider(1, range=0..60)
unit_x_2 = UnitX(Factor=_02_2_desfase)
list_item_3 = ListItem(List=deconstruct_brep_2.Vertices, Index="4", Wrap=True)
list_item_4 = ListItem(List=deconstruct_brep_2.Vertices, Index="0", Wrap=True)
move_4 = Move(Geometry=list_item_3, Motion=unit_x_2)  # -> Geometry, Transform
unit_x_3 = UnitX(Factor="32")
move_5 = Move(Geometry=list_item_4, Motion=unit_x_3)  # -> Geometry, Transform
unit_y_2 = UnitY(Factor="32")
move_6 = Move(Geometry=move_5.Geometry, Motion=unit_y_2)  # -> Geometry, Transform
unit_z_4 = UnitZ(Factor="-15")
panel_27 = Panel("Pata Conica")
panel_28 = Panel("Pata Cilindrica")

# ----
# Pata Conica
brep = Brep(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)
mesh_brep = MeshBrep(
    Brep=brep,
    Settings={GridMaxCount=0, GridMinCount=16, JaggedSeams=False, MaxEdgeLength=0, MinEdgeLength=0.0001, MinTolerance=0, Refine=True, RefineAngle=0, RelativeTolerance=0.65, SimplePlanes=True, Tolerance=0})
point = Point(Point(0, -500, 40))
vector_2pt_2 = Vector2Pt(PointA=point, PointB=move_6.Geometry, Unitize=False)  # -> Vector, Length
move_7 = Move(Geometry=[mesh_brep, brep], Motion=vector_2pt_2.Vector)  # -> Geometry, Transform

# ----
# Pata Cilindrica
brep_2 = Brep(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)
point_2 = Point(Point(0, -600, 10))
mesh_brep_2 = MeshBrep(
    Brep=brep_2,
    Settings={GridMaxCount=0, GridMinCount=16, JaggedSeams=False, MaxEdgeLength=0, MinEdgeLength=0.0001, MinTolerance=0, Refine=True, RefineAngle=0, RelativeTolerance=0.65, SimplePlanes=True, Tolerance=0})
vector_2pt_3 = Vector2Pt(PointA=point_2, PointB=move_6.Geometry, Unitize=False)  # -> Vector, Length
move_8 = Move(Geometry=[brep_2, mesh_brep_2], Motion=vector_2pt_3.Vector)  # -> Geometry, Transform

mirror = Mirror(Geometry=move_7.Geometry, Plane=yz_plane_2)  # -> Geometry, Transform

# ---- group: Division Media Izquierda
unit_y_3 = UnitY(Factor="32")

# ---- group: Division Izquierda
_07_0_sujecion_superior = ValueList({"Tornillo tarugo": 0, "minifix": 1}, selected="minifix")
_07_1_cambiar_lado_minifix = ValueList({"0", "180": "1"}, selected="0")
_07_2_sujecion_inferior = ValueList({"Tuerca tornillo tarugo": 0, "Tornillo tarugo": 1}, selected="Tuerca tornillo tarugo")
_07_3_cambiar_lado_tuerca = ValueList({"0", "180": "1"}, selected="0")
_07_4_altura = Slider(100, range=100..2200)

unit_z_5 = UnitZ(Factor=_07_4_altura)
expression_3 = Expression(x=_07_4_altura, Expression="if(x=100,0,if(x>100,1,\"\"))")

# ---- group: Division Derecha
_08_0_sujecion_superior = ValueList({"Tornillo tarugo": 0, "minifix": 1}, selected="minifix")
_08_1_cambiar_lado_minifix = ValueList({"0", "180": "1"}, selected="180")
_08_2_sujecion_inferior = ValueList({"Tuerca tornillo tarugo": 0, "Tornillo tarugo": 1}, selected="Tuerca tornillo tarugo")
_08_3_cambiar_lado_tuerca = ValueList({"0", "180": "1"}, selected="180")
_08_4_altura = Slider(100, range=100..2200)

unit_z_6 = UnitZ(Factor=_08_4_altura)
expression_4 = Expression(x=_08_4_altura, Expression="if(x=100,0,if(x>100,1,\"\"))")

# ---- group: Division Central
_06_0_sujecion_superior = ValueList({"Tornillo tarugo": 0, "minifix": 1}, selected="minifix")
_06_1_cambiar_lado_minifix = ValueList({"0", "180": "1"}, selected="0")
_06_2_sujecion_inferior = ValueList({"Tuerca tornillo tarugo": 0, "Tornillo tarugo": 1}, selected="Tuerca tornillo tarugo")
_06_3_cambiar_lado_tuerca = ValueList({"0", "180": "1"}, selected="0")
_06_4_altura = Slider(100, range=100..2200)

unit_z_7 = UnitZ(Factor=_06_4_altura)
expression_5 = Expression(x=_06_4_altura, Expression="if(x=100,0,if(x>100,1,\"\"))")

# ---- group: Lateral Derecho
_05_1_cambiar_lado_minifix = ValueList({"0", "180": "1"}, selected="180")
_05_0_sujecion_superior = ValueList({"Tornillo tarugo": 0, "minifix": 1}, selected="minifix")
_05_2_sujecion_inferior = ValueList({"Tuerca tornillo tarugo": 0, "Tornillo tarugo": 1}, selected="Tuerca tornillo tarugo")
_05_4_altura = Slider(100, range=100..2200)
_05_3_cambiar_lado_tuerca = ValueList({"0", "180": "1"}, selected="180")

unit_z_8 = UnitZ(Factor=_05_4_altura)
expression_6 = Expression(x=_05_4_altura, Expression="if(x=100,0,if(x>100,1,\"\"))")

# ---- group: Division Media
_1_4_altura = Slider(100, range=100..2200)
_1_0_sujecion_superior = ValueList({"Tornillo tarugo": 0, "minifix": 1}, selected="minifix")
_1_1_cambiar_lado_minifix = ValueList({"0", "180": "1"}, selected="180")
_1_2_sujecion_inferior = ValueList({"Tuerca tornillo tarugo": 0, "Tornillo tarugo": 1}, selected="Tuerca tornillo tarugo")
_1_3_cambiar_lado_tuerca = ValueList({"0", "180": "1"}, selected="180")

unit_z_9 = UnitZ(Factor=_1_4_altura)
expression_7 = Expression(x=_1_4_altura, Expression="if(x=100,0,if(x>100,1,\"\"))")

# ---- group: Division Media Derecha
_2_4_altura = Slider(100, range=100..2200)
_2_0_sujecion_superior = ValueList({"Tornillo tarugo": 0, "minifix": 1}, selected="minifix")
_2_1_cambiar_lado_minifix = ValueList({"0", "180": "1"}, selected="180")
_2_2_sujecion_inferior = ValueList({"Tuerca tornillo tarugo": 0, "Tornillo tarugo": 1}, selected="Tuerca tornillo tarugo")
_2_3_cambiar_lado_tuerca = ValueList({"0", "180": "1"}, selected="180")

expression_8 = Expression(x=_2_4_altura, Expression="if(x=100,0,if(x>100,1,\"\"))")
unit_z_10 = UnitZ(Factor=_2_4_altura)

# ---- group: Division Media Izquierda
_09_0_sujecion_superior = ValueList({"Tornillo tarugo": 0, "minifix": 1}, selected="minifix")
_09_1_cambiar_lado_minifix = ValueList({"0", "180": "1"}, selected="0")
_09_2_sujecion_inferior = ValueList({"Tuerca tornillo tarugo": 0, "Tornillo tarugo": 1}, selected="Tuerca tornillo tarugo")
_09_3_cambiar_lado_tuerca = ValueList({"0", "180": "1"}, selected="0")
_09_4_altura = Slider(100, range=100..2200)

unit_z_11 = UnitZ(Factor=_09_4_altura)
expression_9 = Expression(x=_09_4_altura, Expression="if(x=100,0,if(x>100,1,\"\"))")

# ----
mirror_2 = Mirror(Geometry=move_7.Geometry, Plane=xz_plane)  # -> Geometry, Transform
mirror_3 = Mirror(Geometry=move_8.Geometry, Plane=xz_plane)  # -> Geometry, Transform
mirror_4 = Mirror(Geometry=[mirror_3.Geometry, move_8.Geometry], Plane=yz_plane_2)  # -> Geometry, Transform
mirror_5 = Mirror(Geometry=[move_7.Geometry, mirror_2.Geometry], Plane=yz_plane_2)  # -> Geometry, Transform

panel_32 = Panel("Tarugo")
panel_34 = Panel("Caja_Minifix")
panel_36 = Panel("Perno")
panel_40 = Panel("Tuerca_Plastica")

# ----
# Aqui se definen cuales son los herrajes superiores e inferiores
stream_filter_2 = StreamFilter(UnionSuperior=0)

# ----
# Tablero Superior
panel_41 = Panel("6")
unit_z_12 = UnitZ(Factor="-15")
list_item_5 = ListItem(List=deconstruct_brep.Vertices, Index="4", Wrap=True)
list_item_6 = ListItem(List=deconstruct_brep.Vertices, Index=panel_41, Wrap=True)
move_9 = Move(Geometry=list_item_5, Motion=unit_z_12)  # -> Geometry, Transform
box_2pt_2 = Box2Pt(PointA=move_9.Geometry, PointB=list_item_6, Plane=PlaneXY(0, 0, 0))
deconstruct_brep_3 = DeconstructBrep(Brep=box_2pt_2)  # -> Faces, Edges, Vertices
addition = Addition(A=_02_2_desfase, B="15")
list_item_7 = ListItem(List=deconstruct_brep_3.Vertices, Index="3", Wrap=True)
unit_x_4 = UnitX(Factor=addition)
move_10 = Move(Geometry=list_item_7, Motion=unit_x_4)  # -> Geometry, Transform

# ---- group: Costado Izquierdo
box_2pt_3 = Box2Pt(PointA=move_4.Geometry, PointB=move_10.Geometry, Plane=PlaneXY(0, 0, 0))
deconstruct_brep_4 = DeconstructBrep(Brep=box_2pt_3)  # -> Faces, Edges, Vertices
unit_z_13 = UnitZ(Factor=_04_4_altura)
expression_10 = Expression(x=_04_4_altura, Expression="if(x=100,0,if(x>100,1,\"\"))")
list_item_8 = ListItem(List=deconstruct_brep_4.Vertices, Index="2", Wrap=True)
move_11 = Move(Geometry=list_item_8, Motion=unit_z_13)  # -> Geometry, Transform
box_2pt_4 = Box2Pt(PointA=move_4.Geometry, PointB=move_11.Geometry, Plane=PlaneXY(0, 0, 0))
stream_filter_3 = StreamFilter(Gate=expression_10, Stream0=box_2pt_3, Stream1=box_2pt_4)

# ---- group: Lateral Derecho (continued)
mirror_6 = Mirror(Geometry=box_2pt_3, Plane=yz_plane)  # -> Geometry, Transform
deconstruct_brep_5 = DeconstructBrep(Brep=mirror_6.Geometry)  # -> Faces, Edges, Vertices
list_item_9 = ListItem(List=deconstruct_brep_5.Vertices, Index="5", Wrap=True)
list_item_10 = ListItem(List=deconstruct_brep_5.Vertices, Index="7", Wrap=True)
list_item_11 = ListItem(List=deconstruct_brep_5.Vertices, Index="3", Wrap=True)
box_2pt_5 = Box2Pt(PointA=list_item_9, PointB=list_item_11, Plane=PlaneXY(0, 0, 0))
move_12 = Move(Geometry=list_item_10, Motion=unit_z_8)  # -> Geometry, Transform
box_2pt_6 = Box2Pt(PointA=list_item_9, PointB=move_12.Geometry, Plane=PlaneXY(0, 0, 0))
stream_filter_4 = StreamFilter(Gate=expression_6, Stream0=box_2pt_5, Stream1=box_2pt_6)

# ---- group: Divisiones (continued)
deconstruct_brep_6 = DeconstructBrep(Brep=mirror_6.Geometry)  # -> Faces, Edges, Vertices
deconstruct_brep_7 = DeconstructBrep(Brep=box_2pt_3)  # -> Faces, Edges, Vertices
list_item_12 = ListItem(List=deconstruct_brep_7.Edges, Index="2", Wrap=True)
list_item_13 = ListItem(List=deconstruct_brep_6.Edges, Index=panel_26, Wrap=True)
curve_middle = CurveMiddle(Curve=list_item_12)
curve_middle_2 = CurveMiddle(Curve=list_item_13)
distance = Distance(PointA=curve_middle, PointB=curve_middle_2)
division = Division(A=distance, B=rh_in_02_0_divisiones)
unit_x_5 = UnitX(Factor=division)
stream_gate = StreamGate(Segmentos=unit_x_5, Gate=rh_in_02_0_divisiones)  # -> Target0, Target1, Target2, Target3, Target4

# ---- group: Division Media Izquierda (continued)
move_13 = Move(Geometry=box_2pt_3, Motion=stream_gate.Target4)  # -> Geometry, Transform
deconstruct_brep_8 = DeconstructBrep(Brep=move_13.Geometry)  # -> Faces, Edges, Vertices
list_item_14 = ListItem(List=deconstruct_brep_8.Vertices, Index="1", Wrap=True)
list_item_15 = ListItem(List=deconstruct_brep_8.Vertices, Index="5", Wrap=True)
list_item_16 = ListItem(List=deconstruct_brep_8.Vertices, Index="3", Wrap=True)
list_item_17 = ListItem(List=deconstruct_brep_8.Faces, Index="4", Wrap=True)
list_item_18 = ListItem(List=deconstruct_brep_8.Edges, Index="0", Wrap=True)
area_3 = Area(Geometry=list_item_17)  # -> Area, Centroid
curve_middle_3 = CurveMiddle(Curve=list_item_18)
move_14 = Move(Geometry=list_item_14, Motion=unit_z_11)  # -> Geometry, Transform
box_2pt_7 = Box2Pt(PointA=list_item_15, PointB=list_item_16, Plane=PlaneXY(0, 0, 0))
move_15 = Move(Geometry=curve_middle_3, Motion=unit_y_3)  # -> Geometry, Transform
box_2pt_8 = Box2Pt(PointA=list_item_16, PointB=move_14.Geometry, Plane=PlaneXY(0, 0, 0))
stream_filter_5 = StreamFilter(Gate=expression_9, Stream0=box_2pt_7, Stream1=box_2pt_8)

# ---- group: Division Media (continued)
unit_x_6 = UnitX(Factor=division)
move_16 = Move(Geometry=move_13.Geometry, Motion=unit_x_6)  # -> Geometry, Transform
deconstruct_brep_9 = DeconstructBrep(Brep=move_16.Geometry)  # -> Faces, Edges, Vertices
list_item_19 = ListItem(List=deconstruct_brep_9.Vertices, Index="1", Wrap=True)
list_item_20 = ListItem(List=deconstruct_brep_9.Vertices, Index="5", Wrap=True)
list_item_21 = ListItem(List=deconstruct_brep_9.Edges, Index="0", Wrap=True)
list_item_22 = ListItem(List=deconstruct_brep_9.Vertices, Index="3", Wrap=True)
curve_middle_4 = CurveMiddle(Curve=list_item_21)
box_2pt_9 = Box2Pt(PointA=list_item_20, PointB=list_item_22, Plane=PlaneXY(0, 0, 0))
move_17 = Move(Geometry=list_item_19, Motion=unit_z_9)  # -> Geometry, Transform
box_2pt_10 = Box2Pt(PointA=list_item_22, PointB=move_17.Geometry, Plane=PlaneXY(0, 0, 0))
stream_filter_6 = StreamFilter(Gate=expression_7, Stream0=move_16.Geometry, Stream1=box_2pt_10)

# ---- group: Division Media Derecha (continued)
mirror_7 = Mirror(Geometry=move_13.Geometry, Plane=yz_plane)  # -> Geometry, Transform
deconstruct_brep_10 = DeconstructBrep(Brep=mirror_7.Geometry)  # -> Faces, Edges, Vertices
list_item_23 = ListItem(List=deconstruct_brep_10.Vertices, Index="4", Wrap=True)
list_item_24 = ListItem(List=deconstruct_brep_10.Vertices, Index="0", Wrap=True)
list_item_25 = ListItem(List=deconstruct_brep_10.Vertices, Index="6", Wrap=True)
move_18 = Move(Geometry=list_item_23, Motion=unit_z_10)  # -> Geometry, Transform
box_2pt_11 = Box2Pt(PointA=list_item_24, PointB=list_item_25, Plane=PlaneXY(0, 0, 0))
box_2pt_12 = Box2Pt(PointA=list_item_25, PointB=move_18.Geometry, Plane=PlaneXY(0, 0, 0))
stream_filter_7 = StreamFilter(Gate=expression_8, Stream0=box_2pt_11, Stream1=box_2pt_12)

# ---- group: Division Izquierda (continued)
move_19 = Move(Geometry=box_2pt_3, Motion=stream_gate.Target3)  # -> Geometry, Transform
deconstruct_brep_11 = DeconstructBrep(Brep=move_19.Geometry)  # -> Faces, Edges, Vertices
list_item_26 = ListItem(List=deconstruct_brep_11.Vertices, Index="0", Wrap=True)
list_item_27 = ListItem(List=deconstruct_brep_11.Vertices, Index="2", Wrap=True)
list_item_28 = ListItem(List=deconstruct_brep_11.Edges, Index="0", Wrap=True)
curve_middle_5 = CurveMiddle(Curve=list_item_28)
move_20 = Move(Geometry=list_item_27, Motion=unit_z_5)  # -> Geometry, Transform
list_item_29 = ListItem(List=deconstruct_brep_11.Faces, Index="4", Wrap=True)
area_4 = Area(Geometry=list_item_29)  # -> Area, Centroid
box_2pt_13 = Box2Pt(PointA=list_item_26, PointB=move_20.Geometry, Plane=PlaneXY(0, 0, 0))
stream_filter_8 = StreamFilter(Gate=expression_3, Stream0=move_19.Geometry, Stream1=box_2pt_13)

# ---- group: Division Derecha (continued)
mirror_8 = Mirror(Geometry=move_19.Geometry, Plane=yz_plane)  # -> Geometry, Transform
deconstruct_brep_12 = DeconstructBrep(Brep=mirror_8.Geometry)  # -> Faces, Edges, Vertices
list_item_30 = ListItem(List=deconstruct_brep_12.Vertices, Index="5", Wrap=True)
list_item_31 = ListItem(List=deconstruct_brep_12.Vertices, Index="7", Wrap=True)
list_item_32 = ListItem(List=deconstruct_brep_12.Vertices, Index="3", Wrap=True)
move_21 = Move(Geometry=list_item_31, Motion=unit_z_6)  # -> Geometry, Transform
box_2pt_14 = Box2Pt(PointA=list_item_30, PointB=list_item_32, Plane=PlaneXY(0, 0, 0))
box_2pt_15 = Box2Pt(PointA=list_item_30, PointB=move_21.Geometry, Plane=PlaneXY(0, 0, 0))
stream_filter_9 = StreamFilter(Gate=expression_4, Stream0=box_2pt_14, Stream1=box_2pt_15)

# ---- group: Division Central (continued)
move_22 = Move(Geometry=box_2pt_3, Motion=stream_gate.Target2)  # -> Geometry, Transform
deconstruct_brep_13 = DeconstructBrep(Brep=move_22.Geometry)  # -> Faces, Edges, Vertices
list_item_33 = ListItem(List=deconstruct_brep_13.Vertices, Index="0", Wrap=True)
list_item_34 = ListItem(List=deconstruct_brep_13.Vertices, Index="2", Wrap=True)
list_item_35 = ListItem(List=deconstruct_brep_13.Edges, Index="0", Wrap=True)
list_item_36 = ListItem(List=deconstruct_brep_13.Faces, Index="4", Wrap=True)
move_23 = Move(Geometry=list_item_34, Motion=unit_z_7)  # -> Geometry, Transform
curve_middle_6 = CurveMiddle(Curve=list_item_35)
area_5 = Area(Geometry=list_item_36)  # -> Area, Centroid
box_2pt_16 = Box2Pt(PointA=list_item_33, PointB=move_23.Geometry, Plane=PlaneXY(0, 0, 0))
stream_filter_10 = StreamFilter(Gate=expression_5, Stream0=move_22.Geometry, Stream1=box_2pt_16)

# ---- group: Division Derecha (continued)
cluster = Cluster_4(
    pieza=stream_filter_9,
    relay_3=_08_0_sujecion_superior,
    herrajes_inferiores=_08_2_sujecion_inferior,
    relay_2=_08_1_cambiar_lado_minifix,
    relay=_08_3_cambiar_lado_tuerca,
    union_superior=_08_0_sujecion_superior,
    union_inferior=_08_2_sujecion_inferior)  # -> drywall_superior, tarugo, caja, perno, drywall_inferior_2, tarugo_inferior_2, tuerca, s_1, s_0
maquinados = SolidUnion(Breps=[cluster.s_1, cluster.s_0])

solid_difference = SolidDifference(BrepsA=stream_filter_9, Perforados=flatten(maquinados))

# ---- group: Division Izquierda (continued)
cluster_2 = Cluster_3(
    pieza=stream_filter_8,
    relay_3=_07_0_sujecion_superior,
    herrajes_inferiores=_07_2_sujecion_inferior,
    relay_2=_07_1_cambiar_lado_minifix,
    relay=_07_3_cambiar_lado_tuerca,
    union_superior=_07_0_sujecion_superior,
    union_inferior=_07_2_sujecion_inferior)  # -> drywall_superior, s_1_2, s_1_3, s_1_4, drywall_inferior, geometry, s_0_2, s_1, s_0
maquinados_2 = SolidUnion(Breps=[cluster_2.s_1, cluster_2.s_0])

solid_difference_2 = SolidDifference(BrepsA=stream_filter_8, Perforados=flatten(maquinados_2))

# ---- group: Lateral Derecho (continued)
cluster_3 = Cluster(
    relay=_05_0_sujecion_superior,
    pieza=stream_filter_4,
    herrajes_inferiores=_05_2_sujecion_inferior,
    relay_3=_05_1_cambiar_lado_minifix,
    relay_2=_05_3_cambiar_lado_tuerca,
    union_superior=_05_0_sujecion_superior,
    union_inferior=_05_2_sujecion_inferior)  # -> drywall_superior, s_1_2, s_1_3, s_1_4, drywall_inferior, geometry, s_0_2, s_1, s_0
maquinados_3 = SolidUnion(Breps=[cluster_3.s_1, cluster_3.s_0])

solid_difference_3 = SolidDifference(BrepsA=stream_filter_4, Perforados=flatten(maquinados_3))

# ---- group: Division Media (continued)
cluster_4 = Cluster_6(
    pieza=stream_filter_6,
    relay_3=_1_0_sujecion_superior,
    herrajes_inferiores=_1_2_sujecion_inferior,
    relay_2=_1_1_cambiar_lado_minifix,
    relay=_1_3_cambiar_lado_tuerca,
    union_superior=_1_0_sujecion_superior,
    union_inferior=_1_2_sujecion_inferior)  # -> drywall_superior, tarugo, caja, perno, drywall_inferior_2, tarugo_inferior_2, tuerca, s_1, s_0
maquinados_4 = SolidUnion(Breps=[cluster_4.s_1, cluster_4.s_0])

solid_difference_4 = SolidDifference(BrepsA=stream_filter_6, Perforados=flatten(maquinados_4))

# ---- group: Division Central (continued)
cluster_5 = Cluster_2(
    pieza=stream_filter_10,
    relay_3=_06_0_sujecion_superior,
    herrajes_inferiores=_06_2_sujecion_inferior,
    relay_2=_06_1_cambiar_lado_minifix,
    relay=_06_3_cambiar_lado_tuerca,
    union_superior=_06_0_sujecion_superior,
    union_inferior=_06_2_sujecion_inferior)  # -> drywall_superior, s_1_2, s_1_3, s_1_4, drywall_inferior, geometry, s_0_2, s_1, s_0
maquinados_5 = SolidUnion(Breps=[cluster_5.s_1, cluster_5.s_0])

solid_difference_5 = SolidDifference(BrepsA=stream_filter_10, Perforados=flatten(maquinados_5))

# ---- group: Division Media Derecha (continued)
cluster_6 = Cluster_7(
    pieza=stream_filter_7,
    relay_3=_2_0_sujecion_superior,
    herrajes_inferiores=_2_2_sujecion_inferior,
    relay_2=_2_1_cambiar_lado_minifix,
    relay=_2_3_cambiar_lado_tuerca,
    union_superior=_2_0_sujecion_superior,
    union_inferior=_2_2_sujecion_inferior)  # -> drywall_superior, tarugo, caja, perno, drywall_inferior_2, tarugo_inferior_2, tuerca, s_1, s_0
maquinados_6 = SolidUnion(Breps=[cluster_6.s_1, cluster_6.s_0])

solid_difference_6 = SolidDifference(BrepsA=stream_filter_7, Perforados=flatten(maquinados_6))

# ---- group: Division Media Izquierda (continued)
cluster_7 = Cluster_5(
    pieza=stream_filter_5,
    relay_3=_09_0_sujecion_superior,
    herrajes_inferiores=_09_2_sujecion_inferior,
    relay_2=_09_1_cambiar_lado_minifix,
    relay=_09_3_cambiar_lado_tuerca,
    union_superior=_09_0_sujecion_superior,
    union_inferior=_09_2_sujecion_inferior)  # -> drywall_superior, s_1_2, s_1_3, s_1_4, drywall_inferior, geometry, s_0_2, s_1, s_0
maquinados_7 = SolidUnion(Breps=[cluster_7.s_1, cluster_7.s_0])

solid_difference_7 = SolidDifference(BrepsA=stream_filter_5, Perforados=flatten(maquinados_7))

# ----
tornillo_123 = Geometry([cluster_4.drywall_superior, cluster_6.drywall_inferior_2, cluster_3.drywall_superior, cluster_5.drywall_superior, cluster_3.drywall_inferior, cluster_5.drywall_inferior, cluster_2.drywall_inferior, cluster_2.drywall_superior, cluster.drywall_superior, cluster_6.drywall_superior, cluster_7.drywall_superior, cluster.drywall_inferior_2, cluster_7.drywall_inferior, cluster_4.drywall_inferior_2])
tuerca_plastica = Geometry([cluster_3.s_0_2, cluster_5.s_0_2, cluster_2.s_0_2, cluster.tuerca, cluster_7.s_0_2, cluster_4.tuerca, cluster_6.tuerca])
caja_minifix = Geometry([cluster_3.s_1_3, cluster_5.s_1_3, cluster_2.s_1_3, cluster.caja, cluster_7.s_1_3, cluster_4.caja, cluster_6.caja])
tarugo = Geometry([cluster_3.s_1_2, cluster_3.geometry, cluster_4.tarugo, cluster_5.geometry, cluster_2.s_1_2, cluster.tarugo_inferior_2, cluster_7.geometry, cluster_6.tarugo_inferior_2, cluster_7.s_1_2, cluster_5.s_1_2, cluster_2.geometry, cluster.tarugo, cluster_4.tarugo_inferior_2, cluster_6.tarugo])
perno = Geometry([cluster_3.s_1_4, cluster_5.s_1_4, cluster_2.s_1_4, cluster.perno, cluster_7.s_1_4, cluster_4.perno, cluster_6.perno])

tornillo_123_2 = Geometry([cluster.drywall_inferior_2, cluster_3.drywall_superior, cluster_3.drywall_inferior, cluster_5.drywall_superior, cluster_5.drywall_inferior, cluster_2.drywall_superior, cluster_2.drywall_inferior, cluster.drywall_superior, cluster_7.drywall_inferior, cluster_7.drywall_superior, cluster_4.drywall_inferior_2, cluster_4.drywall_superior, cluster_6.drywall_inferior_2, cluster_6.drywall_superior])
deconstruct_brep_14 = DeconstructBrep(Pieza=stream_filter_3)  # -> Faces, Edges, Vertices; disabled
list_item_37 = ListItem(List=deconstruct_brep_14.Edges, Index=panel_6, Wrap=True)  # disabled
list_item_38 = ListItem(List=deconstruct_brep_14.Faces, Index=panel_5, Wrap=True)  # disabled
area_6 = Area(Geometry=list_item_38)  # -> Area, Centroid; disabled
curve_middle_7 = CurveMiddle(Curve=list_item_37)  # disabled
deconstruct_brep_15 = DeconstructBrep(Pieza=stream_filter_3)  # -> Faces, Edges, Vertices; disabled
line = Line(StartPoint=area_6.Centroid, EndPoint=curve_middle_7)  # disabled
xz_plane_2 = XZPlane(Origin=area_6.Centroid)  # disabled
list_item_39 = ListItem(List=deconstruct_brep_15.Edges, Index=panel_8, Wrap=True)  # disabled
list_item_40 = ListItem(List=deconstruct_brep_15.Faces, Index=panel_7, Wrap=True)  # disabled
length = Length(Curve=line)  # disabled
area_7 = Area(Geometry=list_item_40)  # -> Area, Centroid; disabled
curve_middle_8 = CurveMiddle(Curve=list_item_39)  # disabled
panel_42 = Panel(length)  # disabled
line_2 = Line(StartPoint=area_7.Centroid, EndPoint=curve_middle_8)  # disabled
xz_plane_3 = XZPlane(Origin=area_7.Centroid)  # disabled
length_2 = Length(Curve=line_2)  # disabled
panel_43 = Panel(length_2)  # disabled
subtraction_2 = Subtraction(A=panel_42, B=distancia_minima_al_borde)  # disabled
division_2 = Division(A=subtraction_2, B=paso_maquinas)  # disabled
panel_44 = Panel(division_2)  # disabled
subtraction_3 = Subtraction(A=panel_43, B=distancia_minima_al_borde_2)  # disabled
round = Round(Number=panel_44)  # -> Nearest, Floor, Ceiling; disabled
division_3 = Division(A=subtraction_3, B=paso_maquinas_2)  # disabled
panel_45 = Panel(round.Floor)  # disabled
panel_46 = Panel(division_3)  # disabled
multiplication = Multiplication(A=panel_45, B=paso_maquinas)  # disabled
round_2 = Round(Number=panel_46)  # -> Nearest, Floor, Ceiling; disabled
unit_y_4 = UnitY(Factor=multiplication)  # disabled
panel_47 = Panel(round_2.Floor)  # disabled
move_24 = Move(Geometry=area_6.Centroid, Motion=unit_y_4)  # -> Geometry, Transform; disabled
multiplication_2 = Multiplication(A=panel_47, B=paso_maquinas_2)  # disabled
unit_y_5 = UnitY(Factor=multiplication_2)  # disabled
move_25 = Move(Geometry=area_7.Centroid, Motion=unit_y_5)  # -> Geometry, Transform; disabled
xy_plane = XYPlane(Origin=move_25.Geometry)  # disabled
move_26 = Move(Geometry=move_24.Geometry, Motion=unit_y)  # -> Geometry, Transform; disabled
xy_plane_2 = XYPlane(Origin=move_24.Geometry)  # disabled
cylinder = Cylinder(Base=xy_plane, Radius=panel_11, Length=panel_10)  # disabled
cylinder_2 = Cylinder(Base=xy_plane_2, Radius=panel_13, Length=panel_12)  # disabled
move_27 = Move(Geometry=move_26.Geometry, Motion=unit_z_3)  # -> Geometry, Transform; disabled
cylinder_3 = Cylinder(Base=xy_plane, Radius=panel_15, Length=panel_14)  # disabled
xy_plane_3 = XYPlane(Origin=move_27.Geometry)  # disabled
cap_holes = CapHoles(Brep=cylinder)  # disabled
cylinder_4 = Cylinder(Base=xy_plane_2, Radius=panel_16, Length=panel_17)  # disabled
cap_holes_2 = CapHoles(Brep=cylinder_2)  # disabled
cap_holes_3 = CapHoles(Brep=cylinder_3)  # disabled
cylinder_5 = Cylinder(Base=xy_plane_3, Radius=panel_18, Length=panel_19)  # disabled
cap_holes_4 = CapHoles(Brep=cylinder_4)  # disabled
solid_union = SolidUnion(Breps=[cap_holes, cap_holes_3])  # disabled
cap_holes_5 = CapHoles(Brep=cylinder_5)  # disabled
deconstruct_brep_16 = DeconstructBrep(Brep=cap_holes_3)  # -> Faces, Edges, Vertices; disabled
solid_union_2 = SolidUnion(Breps=cap_holes_5)  # disabled
list_item_41 = ListItem(List=deconstruct_brep_16.Faces, Index=panel_20, Wrap=True)  # disabled
area_8 = Area(Geometry=list_item_41)  # -> Area, Centroid; disabled
move_28 = Move(Geometry=area_8.Centroid, Motion=unit_x)  # -> Geometry, Transform; disabled
solid_union_3 = SolidUnion(Breps=[cap_holes_2, cap_holes_4])  # disabled
yz_plane_3 = YZPlane(Origin=move_28.Geometry)  # disabled
cylinder_6 = Cylinder(Base=yz_plane_3, Radius=panel_22, Length=panel_23)  # disabled
solid_union_4 = SolidUnion(Breps=[solid_union_3, solid_union_2])  # disabled
cap_holes_6 = CapHoles(Brep=cylinder_6)  # disabled
deconstruct_brep_17 = DeconstructBrep(Brep=cap_holes_6)  # -> Faces, Edges, Vertices; disabled
solid_union_5 = SolidUnion(Breps=[cap_holes_6, cap_holes, cap_holes_3])  # disabled
mirror_9 = Mirror(Geometry=solid_union_4, Plane=xz_plane_2)  # -> Geometry, Transform; disabled
list_item_42 = ListItem(List=deconstruct_brep_17.Faces, Index=panel_24, Wrap=True)  # disabled
rotate_3d = Rotate3D(Geometry=solid_union_5, Angle=degrees(panel_25), Center=move_25.Geometry, Axis=Vector(0, 0, 1))  # -> Geometry, Transform; disabled
area_9 = Area(Geometry=list_item_42)  # -> Area, Centroid; disabled
solid_union_6 = SolidUnion(Breps=[mirror_9.Geometry, solid_union_4])  # disabled
stream_filter_11 = StreamFilter(GirarTuercaPlastica=relay_2, Stream0=solid_union_5, Stream1=rotate_3d.Geometry)  # disabled
solid_union_7 = SolidUnion(Breps=[relay, stream_filter_11])  # disabled
mirror_10 = Mirror(Geometry=solid_union_7, Plane=xz_plane_3)  # -> Geometry, Transform; disabled
solid_union_8 = SolidUnion(Breps=[mirror_10.Geometry, solid_union_7])  # disabled

stream_filter_12 = StreamFilter(UnionInferior=_04_2_sujecion_inferior, Stream0=solid_union_8, Stream1=solid_union_6)

# ----
# Posicionador Borde Superior
deconstruct_brep_18 = DeconstructBrep(Pieza=stream_filter_3)  # -> Faces, Edges, Vertices
list_item_43 = ListItem(List=deconstruct_brep_18.Edges, Index="18", Wrap=True)
list_item_44 = ListItem(List=deconstruct_brep_18.Faces, Index="5", Wrap=True)
curve_middle_9 = CurveMiddle(Curve=list_item_43)
area_10 = Area(Geometry=list_item_44)  # -> Area, Centroid
line_3 = Line(StartPoint=area_10.Centroid, EndPoint=curve_middle_9)
length_3 = Length(Curve=line_3)
panel_48 = Panel(length_3)
distancia_minima_al_borde_3 = Panel("20")
subtraction_4 = Subtraction(A=panel_48, B=distancia_minima_al_borde_3)
paso_maquinas_3 = Panel("32")
division_4 = Division(A=subtraction_4, B=paso_maquinas_3)
panel_49 = Panel(division_4)
round_3 = Round(Number=panel_49)  # -> Nearest, Floor, Ceiling
panel_50 = Panel(round_3.Floor)
subtraction_5 = Subtraction(A=panel_50, B=rh_in_03_10_posicion)
subtraction_6 = Subtraction(A=panel_50, B=rh_in_03_7_posicion)
multiplication_3 = Multiplication(A=subtraction_6, B=paso_maquinas_3)
multiplication_4 = Multiplication(A=subtraction_5, B=paso_maquinas_3)
unit_y_6 = UnitY(Factor=multiplication_3)
unit_y_7 = UnitY(Factor=multiplication_4)
move_29 = Move(Geometry=area_10.Centroid, Posicion=unit_y_6)  # -> Geometry, Transform
move_30 = Move(Geometry=area_10.Centroid, Posicion=unit_y_7)  # -> Geometry, Transform

# ----
# Posicionador Borde Inferior
deconstruct_brep_19 = DeconstructBrep(Pieza=stream_filter_3)  # -> Faces, Edges, Vertices
list_item_45 = ListItem(List=deconstruct_brep_19.Edges, Index="2", Wrap=True)
list_item_46 = ListItem(List=deconstruct_brep_19.Faces, Index="4", Wrap=True)
curve_middle_10 = CurveMiddle(Curve=list_item_45)
area_11 = Area(Geometry=list_item_46)  # -> Area, Centroid
line_4 = Line(StartPoint=area_11.Centroid, EndPoint=curve_middle_10)
length_4 = Length(Curve=line_4)
panel_51 = Panel(length_4)
distancia_minima_al_borde_4 = Panel("20")
subtraction_7 = Subtraction(A=panel_51, B=distancia_minima_al_borde_4)
paso_maquinas_4 = Panel("32")
division_5 = Division(A=subtraction_7, B=paso_maquinas_4)
panel_52 = Panel(division_5)
round_4 = Round(Number=panel_52)  # -> Nearest, Floor, Ceiling
panel_53 = Panel(round_4.Floor)
subtraction_8 = Subtraction(A=panel_53, B=rh_in_03_17_posicion)
subtraction_9 = Subtraction(A=panel_53, B=rh_in_03_14_posicion)
multiplication_5 = Multiplication(A=subtraction_9, B=paso_maquinas_4)
multiplication_6 = Multiplication(A=subtraction_8, B=paso_maquinas_4)
unit_y_8 = UnitY(Factor=multiplication_5)
unit_y_9 = UnitY(Factor=multiplication_6)
move_31 = Move(Punto0Externos=area_11.Centroid, Posicion=unit_y_8)  # -> Geometry, Transform
move_32 = Move(Punto0Internos=area_11.Centroid, Posicion=unit_y_9)  # -> Geometry, Transform

cluster_8 = Cluster_9(
    sujecion_inferior_herraje=rh_in_03_13_sujecion_inferior_herraje_ex,
    cambiar_lado=rh_in_03_19_cambiar_lado,
    punto_0_internos=move_31.Geometry)  # -> punto_0_internos_2, punto_tuerca, mecanizados
cluster_9 = Cluster_9(
    sujecion_inferior_herraje=rh_in_03_16_sujecion_inferior_herraje_in,
    cambiar_lado=rh_in_03_19_cambiar_lado,
    punto_0_internos=move_32.Geometry)  # -> punto_0_internos_2, punto_tuerca, mecanizados
cluster_10 = Cluster_10(
    sujecion_inferior_herraje=rh_in_03_6_sujecion_superior_externo,
    cambiar_lado=rh_in_03_12_cambiar_lado,
    punto_0_internos=move_29.Geometry)  # -> punto_0_externos, punto_tuerca, mecanizados
cluster_11 = Cluster_12(
    sujecion_inferior_herraje=rh_in_03_9_sujecion_superior_interno,
    cambiar_lado=rh_in_03_12_cambiar_lado,
    punto_0_internos=move_30.Geometry)  # -> punto_0_internos_2, punto_tuerca, mecanizados
cluster_12 = Cluster_13(
    sujecion_herrajes=rh_in_03_9_sujecion_superior_interno,
    simetria=rh_in_03_8_simetria,
    cambiar_lado=rh_in_03_12_cambiar_lado,
    mecanizados=cluster_11.mecanizados,
    punto_simetria=area_10.Centroid,
    punto_0=cluster_11.punto_0_internos_2,
    punto_tuerca=cluster_11.punto_tuerca)  # -> mecanizados_2, tarugo, caja_minifix, minifix_de_presion, minifix_roscado, tornillo_largo, tornillo_pt, tuerca
cluster_13 = Cluster_11(
    sujecion_herrajes=rh_in_03_6_sujecion_superior_externo,
    simetria=rh_in_03_8_simetria,
    cambiar_lado=rh_in_03_12_cambiar_lado,
    mecanizados=cluster_10.mecanizados,
    punto_simetria=area_10.Centroid,
    punto_0=cluster_10.punto_0_externos,
    punto_tuerca=cluster_10.punto_tuerca)  # -> mecanizados_2, tarugo, caja_minifix, minifix_de_presion, minifix_roscado, tornillo_largo, tornillo_pt, tuerca

solid_difference_8 = SolidDifference(
    BrepsA=box_2pt_2,
    Perforados=flatten([maquinados_3, maquinados_5, maquinados_2, maquinados, maquinados_7, maquinados_4, maquinados_6, cluster_13.mecanizados_2, cluster_12.mecanizados_2]))

cluster_14 = Cluster_8(
    sujecion_herrajes=rh_in_03_13_sujecion_inferior_herraje_ex,
    simetria=rh_in_03_15_simetria,
    cambiar_lado=rh_in_03_19_cambiar_lado,
    mecanizados=cluster_8.mecanizados,
    punto_simetria=area_11.Centroid,
    punto_0=cluster_8.punto_0_internos_2,
    punto_tuerca=cluster_8.punto_tuerca)  # -> mecanizados_2, tarugo, caja_minifix, minifix_de_presion, minifix_roscado, tornillo_largo, tornillo_pt, tuerca
cluster_15 = Cluster_8(
    sujecion_herrajes=rh_in_03_16_sujecion_inferior_herraje_in,
    simetria=rh_in_03_18_simetria,
    cambiar_lado=rh_in_03_19_cambiar_lado,
    mecanizados=cluster_9.mecanizados,
    punto_simetria=area_11.Centroid,
    punto_0=cluster_9.punto_0_internos_2,
    punto_tuerca=cluster_9.punto_tuerca)  # -> mecanizados_2, tarugo, caja_minifix, minifix_de_presion, minifix_roscado, tornillo_largo, tornillo_pt, tuerca

# ---- group: Costado Izquierdo (continued)
solid_difference_9 = SolidDifference(
    BrepsA=stream_filter_3,
    BrepsB=flatten([cluster_15.mecanizados_2, cluster_14.mecanizados_2, cluster_12.mecanizados_2, cluster_13.mecanizados_2]))

# ----
solid_difference_10 = SolidDifference(
    BrepsA=stream_filter,
    Perforados=flatten([maquinados_3, maquinados_5, maquinados_2, maquinados, maquinados_7, maquinados_4, maquinados_6, cluster_15.mecanizados_2, cluster_14.mecanizados_2]))

rh_out_minifix_de_presion = Geometry([cluster_15.minifix_de_presion, cluster_14.minifix_de_presion, cluster_13.minifix_de_presion, cluster_12.minifix_de_presion])
rh_out_minifix_roscado = Geometry([cluster_15.minifix_roscado, cluster_14.minifix_roscado, cluster_13.minifix_roscado, cluster_12.minifix_roscado])
rh_out_caja_minifix = Geometry([cluster_15.caja_minifix, cluster_14.caja_minifix, cluster_13.caja_minifix, cluster_12.caja_minifix])
rh_out_tornillo_largo = Geometry([cluster_15.tornillo_largo, cluster_14.tornillo_largo, cluster_13.tornillo_largo, cluster_12.tornillo_largo])
rh_out_tarugo = Geometry([cluster_14.tarugo, cluster_15.tarugo, cluster_13.tarugo, cluster_12.tarugo])
rh_out_tornillo_pt = Geometry([cluster_15.tornillo_pt, cluster_14.tornillo_pt, cluster_13.tornillo_pt, cluster_12.tornillo_pt])
rh_out_tuerca = Geometry([cluster_15.tuerca, cluster_14.tuerca, cluster_13.tuerca, cluster_12.tuerca])

line_5 = Line(StartPoint=move_6.Geometry, EndPoint=curve_middle_4)
line_6 = Line(StartPoint=move_6.Geometry, EndPoint=curve_middle_6)
line_7 = Line(StartPoint=curve_middle_5, EndPoint=move_6.Geometry)
deconstruct_vector = DeconstructVector(Vector=line_5)  # -> XComponent, YComponent, ZComponent
deconstruct_vector_2 = DeconstructVector(Vector=line_6)  # -> XComponent, YComponent, ZComponent
deconstruct_vector_3 = DeconstructVector(Vector=line_7)  # -> XComponent, YComponent, ZComponent
unit_x_7 = UnitX(Factor=deconstruct_vector.XComponent)
unit_x_8 = UnitX(Factor=deconstruct_vector_2.XComponent)
unit_x_9 = UnitX(Factor=deconstruct_vector_3.XComponent)
negative_2 = Negative(Value=unit_x_9)
move_33 = Move(Geometry=area_3.Centroid, Motion=unit_z_4)  # -> Geometry, Transform
stream_filter_13 = StreamFilter(Centroide=rh_in_02_0_divisiones, Stream4=move_33.Geometry)
stream_filter_14 = StreamFilter(Centroide=rh_in_02_0_divisiones, Stream4=move_33.Geometry)
move_34 = Move(Geometry=move_8.Geometry, Motion=unit_x_7)  # -> Geometry, Transform
move_35 = Move(Geometry=move_7.Geometry, Motion=unit_x_7)  # -> Geometry, Transform
vector_2pt_4 = Vector2Pt(PointA=move_6.Geometry, PointB=stream_filter_14, Unitize=False)  # -> Vector, Length
move_36 = Move(Geometry=move_8.Geometry, Motion=unit_x_8)  # -> Geometry, Transform
move_37 = Move(Geometry=move_7.Geometry, Motion=unit_x_8)  # -> Geometry, Transform
move_38 = Move(Geometry=move_7.Geometry, Motion=vector_2pt_4.Vector)  # -> Geometry, Transform
move_39 = Move(Geometry=move_7.Geometry, Motion=negative_2)  # -> Geometry, Transform
move_40 = Move(Geometry=move_8.Geometry, Motion=negative_2)  # -> Geometry, Transform
mirror_11 = Mirror(Geometry=move_34.Geometry, Plane=xz_plane)  # -> Geometry, Transform
mirror_12 = Mirror(Geometry=move_35.Geometry, Plane=xz_plane)  # -> Geometry, Transform
move_41 = Move(Geometry=mirror_3.Geometry, Motion=unit_x_8)  # -> Geometry, Transform
mirror_13 = Mirror(Geometry=move_38.Geometry, Plane=yz_plane_2)  # -> Geometry, Transform
move_42 = Move(Geometry=mirror_3.Geometry, Motion=negative_2)  # -> Geometry, Transform
move_43 = Move(Geometry=mirror_2.Geometry, Motion=unit_x_8)  # -> Geometry, Transform
move_44 = Move(Geometry=mirror_2.Geometry, Motion=negative_2)  # -> Geometry, Transform
mirror_14 = Mirror(Geometry=[move_42.Geometry, move_40.Geometry], Plane=yz_plane_2)  # -> Geometry, Transform
mirror_15 = Mirror(Geometry=[move_44.Geometry, move_39.Geometry], Plane=yz_plane_2)  # -> Geometry, Transform
stream_filter_15 = StreamFilter(
    Gate=expression,
    Stream0=[mirror_5.Geometry, mirror_2.Geometry, mirror_12.Geometry, mirror_13.Geometry, move_39.Geometry, move_44.Geometry, mirror_15.Geometry, move_43.Geometry, move_7.Geometry, move_35.Geometry, move_37.Geometry, move_38.Geometry, mirror.Geometry])
pata_conica = Geometry(stream_filter_15)

vector_2pt_5 = Vector2Pt(PointA=move_6.Geometry, PointB=stream_filter_13, Unitize=False)  # -> Vector, Length
move_45 = Move(Geometry=move_8.Geometry, Motion=vector_2pt_5.Vector)  # -> Geometry, Transform

mirror_16 = Mirror(Geometry=move_45.Geometry, Plane=yz_plane_2)  # -> Geometry, Transform
stream_filter_16 = StreamFilter(
    Gate=expression,
    Stream1=[mirror_3.Geometry, mirror_4.Geometry, mirror_11.Geometry, mirror_16.Geometry, move_42.Geometry, mirror_14.Geometry, move_36.Geometry, move_41.Geometry, move_8.Geometry, move_34.Geometry, move_40.Geometry, move_45.Geometry])
pata_cilindrica = Geometry(stream_filter_16)

# ---- group: Tablero Superior
rh_in_02_1_lado_balance = ValueList({"Cara A", "Cara B", "D/D"}, selected="Cara B")
rh_in_02_2_canto_frontal = ValueList({"Canto": 0, "MDP": 1}, selected="MDP")
rh_in_02_3_canto_trasero = ValueList({"Canto": 0, "MDP": 1}, selected="MDP")
rh_in_02_4canto_izquierdo_arriba = ValueList({"Canto": 0, "MDP": 1}, selected="MDP")
rh_in_02_5_canto_derecho_abajo = ValueList({"Canto": 0, "MDP": 1}, selected="MDP")
segmentacion = ValueList({"Triángulos": 0, "Quads y triángulos (mixto)": 1, "Sólo quads si es posible": 2}, selected="Sólo quads si es posible")
rh_in_02_0_mapeado = ValueList({"Longitudinal": 0, "Atravesada": 1}, selected="Longitudinal")

# Materializer 3.4
python_3_script = Python3Script(
    Brep_In=solid_difference_8,
    Balance_Mode=rh_in_02_1_lado_balance,
    Canto_1=rh_in_02_2_canto_frontal,
    Canto_2=rh_in_02_3_canto_trasero,
    Canto_3=rh_in_02_4canto_izquierdo_arriba,
    Canto_4=rh_in_02_5_canto_derecho_abajo)  # -> Out, NURBS_Color, NURBS_Balance, NURBS_MDP; inputs Brep_In: Brep, Balance_Mode: String, Canto_1: String, Canto_2: String, Canto_3: String, Canto_4: String
# ---------- python_3_script: Python ----------
"""
=============================================================================
PROYECTO:      3dBimFab
COMPONENTE:    3dBimFab - Desglosador DfMA de Pieza Real NURBS (Materializer)
VERSIÓN:       3.4 DfMA Inteligencia Total (Simetría Dual + Cierre de Ranuras)
AUTOR:         Mario Mojica & Gamma (3dBimFab Digital Manufacturing Engine)
DESCRIPCIÓN:   Clasifica geométricamente las caras de piezas NURBS / Breps en:
               - Caras Principales (A = Exterior / B = Interior) con auto-detección
                 de simetría (por centroide relativo Xmid y por presencia de ranura).
               - Cantos Perimetrales (1 a 4) planos o chaflanes a 45°.
               - Mecanizados y Ranuras (SIEMPRE a MDP, sin descartar ninguna cara).
               - 100% compatible con Item Access o List Access en Grasshopper.
=============================================================================
"""

import Rhino

def parse_balance(val):
    s = str(val).lower().strip().replace('"', '').replace("'", "")
    if s in ["6", "d/d", "dyd", "doble", "ninguno", "ambas"] or "d/d" in s or "dyd" in s:
        return "DD"
    if s in ["5", "cara a", "a"] or (s.startswith("a") and len(s) <= 6):
        return "A"
    if s in ["4", "cara b", "b"] or (s.startswith("b") and len(s) <= 6):
        return "B"
    if "ambos" in s:
        return "AMBOS"
    return "B"

def parse_canto(val):
    s = str(val).lower().strip().replace('"', '').replace("'", "")
    if s in ["0", "0.0", "canto", "true", "si", "sí", "con canto"] or ("canto" in s and "sin" not in s):
        return True # Madera / Color
    if s in ["1", "1.0", "mdp", "false", "no", "sin canto"] or "mdp" in s or "sin" in s:
        return False # Crudo / MDP
    return True

def clasificar_brep_individual(brep_in, balance_mode="Cara B", c1="Canto", c2="Canto", c3="Canto", c4="Canto", is_left=None):
    if brep_in is None:
        return [], [], [], "Aviso: Brep nulo"

    bbox = brep_in.GetBoundingBox(True)
    x0, x1 = bbox.Min.X, bbox.Max.X
    y0, y1 = bbox.Min.Y, bbox.Max.Y
    z0, z1 = bbox.Min.Z, bbox.Max.Z

    sx = max(0.1, x1 - x0)
    sy = max(0.1, y1 - y0)
    sz = max(0.1, z1 - z0)
    min_dim = min(sx, sy, sz)

    # Tolerancia geométrica adaptativa (invariante a escala metros/milímetros)
    tol = max(0.0002, min_dim * 0.15)
    zona_bisel = min_dim * 2.2

    # Detección anatómica de simetría si is_left no vino definido externamente
    if is_left is None and min_dim == sx:
        count_x0 = 0
        count_x1 = 0
        for i in range(brep_in.Faces.Count):
            f = brep_in.Faces[i]
            if f.IsPlanar():
                u = (f.Domain(0).T0 + f.Domain(0).T1) * 0.5
                v = (f.Domain(1).T0 + f.Domain(1).T1) * 0.5
                pt = f.PointAt(u, v)
                n = f.NormalAt(u, v)
                n.Unitize()
                if n.X < -0.85 and abs(pt.X - x0) < tol:
                    count_x0 += 1
                elif n.X > 0.85 and abs(pt.X - x1) < tol:
                    count_x1 += 1
        
        # En un lateral de cajón, el lado interior tiene al menos 2 caras por la ranura (arriba y abajo)
        # mientras que el lado exterior es 1 sola cara continua.
        if count_x1 > count_x0:
            # Más caras en +X (ranura interior hacia +X) -> Lateral Izquierdo
            is_left = True
        elif count_x0 > count_x1:
            # Más caras en -X (ranura interior hacia -X) -> Lateral Derecho
            is_left = False
        else:
            xc = (x0 + x1) * 0.5
            is_left = (xc < 0)

    faces_A = []
    faces_B = []
    faces_cantos = {1: [], 2: [], 3: [], 4: []}
    faces_mecanizados = []

    for i in range(brep_in.Faces.Count):
        f = brep_in.Faces[i]
        nurbs_face = f.DuplicateFace(False)

        if not f.IsPlanar():
            faces_mecanizados.append(nurbs_face)
            continue

        u = (f.Domain(0).T0 + f.Domain(0).T1) * 0.5
        v = (f.Domain(1).T0 + f.Domain(1).T1) * 0.5
        pt = f.PointAt(u, v)
        n = f.NormalAt(u, v)
        n.Unitize()

        # -----------------------------------------------------------------
        # CASO 1: Tablero Horizontal (Cubiertas / Entrepaños / Fondos cajón - Espesor en Z)
        # -----------------------------------------------------------------
        if min_dim == sz:
            tipo_str = "Horizontal (Cubierta/Entrepaño/Fondo)"
            if n.Z > 0.85 and abs(pt.Z - z1) < tol:
                faces_A.append(nurbs_face)
            elif n.Z < -0.85 and abs(pt.Z - z0) < tol:
                faces_B.append(nurbs_face)
            # Canto 1: Frontal (-Y)
            elif (n.Y < -0.85 and abs(pt.Y - y0) < tol) or (-0.85 < n.Y < -0.30 and (pt.Y - y0) < zona_bisel and abs(pt.Z - ((z0+z1)*0.5)) < (sz * 0.6)):
                faces_cantos[1].append(nurbs_face)
            # Canto 2: Trasero (+Y)
            elif (n.Y > 0.85 and abs(pt.Y - y1) < tol) or (0.30 < n.Y < 0.85 and (y1 - pt.Y) < zona_bisel and abs(pt.Z - ((z0+z1)*0.5)) < (sz * 0.6)):
                faces_cantos[2].append(nurbs_face)
            # Canto 3: Izquierdo (-X)
            elif (n.X < -0.85 and abs(pt.X - x0) < tol) or (-0.85 < n.X < -0.30 and (pt.X - x0) < zona_bisel and abs(pt.Z - ((z0+z1)*0.5)) < (sz * 0.6)):
                faces_cantos[3].append(nurbs_face)
            # Canto 4: Derecho (+X)
            elif (n.X > 0.85 and abs(pt.X - x1) < tol) or (0.30 < n.X < 0.85 and (x1 - pt.X) < zona_bisel and abs(pt.Z - ((z0+z1)*0.5)) < (sz * 0.6)):
                faces_cantos[4].append(nurbs_face)
            else:
                faces_mecanizados.append(nurbs_face)

        # -----------------------------------------------------------------
        # CASO 2: Tablero Vertical Lateral (Costados / Laterales Cajón - Espesor en X)
        # -----------------------------------------------------------------
        elif min_dim == sx:
            tipo_str = "Vertical Lateral (Costado/Lateral Cajón {})".format("IZQ" if is_left else "DER")
            
            # Detectar caras límites exteriores en x0 (-X) y x1 (+X)
            # En un lateral con ranura, la cara interior está dividida por la ranura (>= 2 caras)
            # y la cara exterior es una sola cara continua (1 cara).
            faces_x0 = []
            faces_x1 = []
            
            # Cantos y mecanizados se van clasificando
            for f_idx in range(brep_in.Faces.Count):
                f_cur = brep_in.Faces[f_idx]
                n_face = f_cur.DuplicateFace(False)
                if not f_cur.IsPlanar():
                    faces_mecanizados.append(n_face)
                    continue
                u = (f_cur.Domain(0).T0 + f_cur.Domain(0).T1) * 0.5
                v = (f_cur.Domain(1).T0 + f_cur.Domain(1).T1) * 0.5
                pt = f_cur.PointAt(u, v)
                n = f_cur.NormalAt(u, v)
                n.Unitize()
                
                if n.X < -0.85 and abs(pt.X - x0) < tol:
                    faces_x0.append(n_face)
                elif n.X > 0.85 and abs(pt.X - x1) < tol:
                    faces_x1.append(n_face)
                elif (n.Y < -0.85 and abs(pt.Y - y0) < tol) or (-0.85 < n.Y < -0.30 and (pt.Y - y0) < zona_bisel and abs(pt.X - ((x0+x1)*0.5)) < (sx * 0.6)):
                    faces_cantos[1].append(n_face)
                elif (n.Y > 0.85 and abs(pt.Y - y1) < tol) or (0.30 < n.Y < 0.85 and (y1 - pt.Y) < zona_bisel and abs(pt.X - ((x0+x1)*0.5)) < (sx * 0.6)):
                    faces_cantos[2].append(n_face)
                elif (n.Z > 0.85 and abs(pt.Z - z1) < tol) or (0.30 < n.Z < 0.85 and (z1 - pt.Z) < zona_bisel and abs(pt.X - ((x0+x1)*0.5)) < (sx * 0.6)):
                    faces_cantos[3].append(n_face)
                elif (n.Z < -0.85 and abs(pt.Z - z0) < tol) or (-0.85 < n.Z < -0.30 and (pt.Z - z0) < zona_bisel and abs(pt.X - ((x0+x1)*0.5)) < (sx * 0.6)):
                    faces_cantos[4].append(n_face)
                else:
                    faces_mecanizados.append(n_face)
            
            # Asignación DfMA infalible:
            # Cara B = Siempre Interior (con ranura)
            # Cara A = Siempre Exterior (lisa continua)
            if len(faces_x1) > len(faces_x0):
                # Interior está en +X (Lateral Izquierdo)
                faces_A.extend(faces_x0)
                faces_B.extend(faces_x1)
            elif len(faces_x0) > len(faces_x1):
                # Interior está en -X (Lateral Derecho)
                faces_A.extend(faces_x1)
                faces_B.extend(faces_x0)
            else:
                # Si son iguales (sin ranura), usar is_left
                if is_left:
                    faces_A.extend(faces_x0)
                    faces_B.extend(faces_x1)
                else:
                    faces_A.extend(faces_x1)
                    faces_B.extend(faces_x0)
            
            # Saltamos el bucle individual ya que procesamos todas las caras de este Brep
            break

        # -----------------------------------------------------------------
        # CASO 3: Tablero Vertical Frontal (Frentes / Traseras Cajón / Puertas / Zócalos - Espesor en Y)
        # -----------------------------------------------------------------
        else:
            tipo_str = "Vertical Frontal (Frente/Trasera/Puerta)"
            if n.Y < -0.85 and abs(pt.Y - y0) < tol:
                faces_A.append(nurbs_face)
            elif n.Y > 0.85 and abs(pt.Y - y1) < tol:
                faces_B.append(nurbs_face)
            # Canto 1: Superior (+Z)
            elif (n.Z > 0.85 and abs(pt.Z - z1) < tol) or (0.30 < n.Z < 0.85 and (z1 - pt.Z) < zona_bisel and abs(pt.Y - ((y0+y1)*0.5)) < (sy * 0.6)):
                faces_cantos[1].append(nurbs_face)
            # Canto 2: Inferior (-Z)
            elif (n.Z < -0.85 and abs(pt.Z - z0) < tol) or (-0.85 < n.Z < -0.30 and (pt.Z - z0) < zona_bisel and abs(pt.Y - ((y0+y1)*0.5)) < (sy * 0.6)):
                faces_cantos[2].append(nurbs_face)
            # Canto 3: Izquierdo (-X)
            elif (n.X < -0.85 and abs(pt.X - x0) < tol) or (-0.85 < n.X < -0.30 and (pt.X - x0) < zona_bisel and abs(pt.Y - ((y0+y1)*0.5)) < (sy * 0.6)):
                faces_cantos[3].append(nurbs_face)
            # Canto 4: Derecho (+X)
            elif (n.X > 0.85 and abs(pt.X - x1) < tol) or (0.30 < n.X < 0.85 and (x1 - pt.X) < zona_bisel and abs(pt.Y - ((y0+y1)*0.5)) < (sy * 0.6)):
                faces_cantos[4].append(nurbs_face)
            else:
                faces_mecanizados.append(nurbs_face)

    # 3. Asignación de Caras Principales según Balance
    modo_b = parse_balance(balance_mode)
    nurbs_color = []
    nurbs_balance = []
    nurbs_mdp = []

    if modo_b == "DD":
        nurbs_color.extend(faces_A)
        nurbs_color.extend(faces_B)
        diag_bal = "D/D (Doble Cara Madera)"
    elif modo_b == "A":
        nurbs_balance.extend(faces_A)
        nurbs_color.extend(faces_B)
        diag_bal = "Balance en Cara A (Exterior)"
    elif modo_b == "B":
        nurbs_color.extend(faces_A)
        nurbs_balance.extend(faces_B)
        diag_bal = "Balance en Cara B (Interior)"
    else:
        nurbs_balance.extend(faces_A)
        nurbs_balance.extend(faces_B)
        diag_bal = "Ambas Caras Balance"

    # 4. Asignación de Cantos
    cantos_in = {
        1: parse_canto(c1),
        2: parse_canto(c2),
        3: parse_canto(c3),
        4: parse_canto(c4)
    }

    for num_canto, tiene_canto in cantos_in.items():
        if tiene_canto:
            nurbs_color.extend(faces_cantos[num_canto])
        else:
            nurbs_mdp.extend(faces_cantos[num_canto])

    # 5. Mecanizados y barrenos siempre van a MDP
    nurbs_mdp.extend(faces_mecanizados)

    diag = "{0} | {1} | Caras: {2} (A={3}, B={4}, Cantos={5}, Mec={6})".format(
        tipo_str, diag_bal, brep_in.Faces.Count,
        len(faces_A), len(faces_B), sum(len(v) for v in faces_cantos.values()), len(faces_mecanizados)
    )

    return nurbs_color, nurbs_balance, nurbs_mdp, diag

def ejecutar_materializer_dfma(brep_input, b_mode, c1, c2, c3, c4):
    if brep_input is None:
        return [], [], [], "Brep nulo"

    if hasattr(brep_input, "__iter__") and not hasattr(brep_input, "Faces"):
        breps = [b for b in brep_input if b is not None]
    else:
        breps = [brep_input]

    if not breps:
        return [], [], [], "Lista de Breps vacía"

    is_left_flags = [None] * len(breps)
    if len(breps) > 1:
        bboxes = []
        for b in breps:
            bb = b.GetBoundingBox(True)
            bboxes.append({
                "xc": (bb.Min.X + bb.Max.X) * 0.5,
                "yc": (bb.Min.Y + bb.Max.Y) * 0.5,
                "zc": (bb.Min.Z + bb.Max.Z) * 0.5,
                "sx": bb.Max.X - bb.Min.X,
                "sy": bb.Max.Y - bb.Min.Y,
                "sz": bb.Max.Z - bb.Min.Z
            })

        # Calcular X_min y X_max global del grupo de laterales (funciona en metros y milímetros)
        xs = [info["xc"] for info in bboxes if min(info["sx"], info["sy"], info["sz"]) == info["sx"]]
        if len(xs) >= 2 and (max(xs) - min(xs)) > 0.05:
            mid_x_global = (min(xs) + max(xs)) * 0.5
            for i, info in enumerate(bboxes):
                if min(info["sx"], info["sy"], info["sz"]) == info["sx"]:
                    is_left_flags[i] = (info["xc"] < mid_x_global)

    all_col = []
    all_bal = []
    all_mdp = []
    diag_lines = []

    for idx, b in enumerate(breps):
        flag = is_left_flags[idx]
        col, bal, mdp, diag = clasificar_brep_individual(b, b_mode, c1, c2, c3, c4, is_left=flag)
        all_col.extend(col)
        all_bal.extend(bal)
        all_mdp.extend(mdp)
        diag_lines.append("P{0}: {1}".format(idx+1, diag))

    res_diag = " | ".join(diag_lines) if len(diag_lines) <= 3 else "{0} piezas procesadas DfMA. {1}".format(len(breps), diag_lines[0])
    return all_col, all_bal, all_mdp, res_diag

# =============================================================================
# EJECUCIÓN GRASSHOPPER
# =============================================================================
_b_mode = Balance_Mode if 'Balance_Mode' in locals() and Balance_Mode is not None else "Cara B"
_c1 = Canto_1 if 'Canto_1' in locals() and Canto_1 is not None else "Canto"
_c2 = Canto_2 if 'Canto_2' in locals() and Canto_2 is not None else "Canto"
_c3 = Canto_3 if 'Canto_3' in locals() and Canto_3 is not None else "Canto"
_c4 = Canto_4 if 'Canto_4' in locals() and Canto_4 is not None else "Canto"

NURBS_Color, NURBS_Balance, NURBS_MDP, Out = ejecutar_materializer_dfma(
    Brep_In, _b_mode, _c1, _c2, _c3, _c4
)

out = Out
a = Out
Info_Pieza = Out
print(Out)
# ---------- end python_3_script ----------

diagnostico = Panel(python_3_script.Out)
mesh_brep_3 = MeshBrep(
    Brep=python_3_script.NURBS_Color,
    Settings={GridMaxCount=0, GridMinCount=16, JaggedSeams=False, MaxEdgeLength=0, MinEdgeLength=0.0001, MinTolerance=0, Refine=True, RefineAngle=0, RelativeTolerance=0.65, SimplePlanes=True, Tolerance=0})
mesh_brep_4 = MeshBrep(
    Brep=python_3_script.NURBS_Balance,
    Settings={GridMaxCount=0, GridMinCount=16, JaggedSeams=False, MaxEdgeLength=0, MinEdgeLength=0.0001, MinTolerance=0, Refine=True, RefineAngle=0, RelativeTolerance=0.65, SimplePlanes=True, Tolerance=0})
mesh_brep_5 = MeshBrep(
    Brep=python_3_script.NURBS_MDP,
    Settings={GridMaxCount=0, GridMinCount=16, JaggedSeams=False, MaxEdgeLength=0, MinEdgeLength=0.0001, MinTolerance=0, Refine=True, RefineAngle=0, RelativeTolerance=0.65, SimplePlanes=True, Tolerance=0})
mesh_join = MeshJoin(Meshes=flatten(mesh_brep_3))
mesh_join_2 = MeshJoin(Meshes=flatten(mesh_brep_4))
mesh_join_3 = MeshJoin(Meshes=flatten(mesh_brep_5))
reduce_mesh = ReduceMesh(Mesh=mesh_join_3, FaceCount=20, Accuracy=1, FaceType=segmentacion, Distort=Toggle(False), Normalize=Toggle(True))  # -> Reduced, CountDifference
panel_54 = Panel(reduce_mesh.CountDifference)
python_3_script_2 = Python3Script(M=reduce_mesh.Reduced, B=rh_in_02_0_mapeado)  # -> a; inputs M: Mesh, B: list of Int32
# ---------- python_3_script_2: Python ----------
"""
=============================================================================
PROYECTO:      3dBimFab
COMPONENTE:    3dBimFab - Box Mapping UV Métrico Cohesivo (600mm)
VERSIÓN:       v3.8 - DfMA Anatómico Granular & Cantos Siempre Longitudinales
AUTOR:         Mario Mojica & Gamma (3dBimFab Digital Manufacturing Engine)
DESCRIPCIÓN:   Mapeado métrico de 600 mm para piezas de taller y sólidos DWG:
               - La imagen tiene su veta de izquierda a derecha (Eje U).
               - Descompone mallas unidas (SplitDisjointPieces) para medir
                 las dimensiones físicas reales de cada pieza individual.
               - En Laterales de Cajón (sy > sz): veta corre a lo largo del cajón (Y).
               - En Costados de Mueble (sz >= sy): veta corre en altura vertical (Z).
               - En Cubiertas y Frentes: veta corre longitudinal a lo largo de X.
               - Cantos perimetrales: SIEMPRE longitudinales a su propio filo.
=============================================================================
"""

import Rhino

def extraer_valor_b(val):
    if val is None:
        return False
    while isinstance(val, (list, tuple)) and len(val) > 0:
        val = val[0]
    if hasattr(val, "Value"):
        val = val.Value
    
    s = str(val).lower().strip().replace('"', '').replace("'", "")
    return "atravesad" in s or s in ["1", "1.0", "true", "si", "sí", "3", "5"]

def _mapear_mesh_simple(mesh_in, modo_veta, escala_caja_mm=600.0):
    if mesh_in is None:
        return mesh_in

    mesh = mesh_in.DuplicateMesh() if hasattr(mesh_in, "DuplicateMesh") else mesh_in
    mesh.Normals.ComputeNormals()
    mesh.TextureCoordinates.Clear()

    bbox = mesh.GetBoundingBox(True)
    sx = max(0.001, bbox.Max.X - bbox.Min.X)
    sy = max(0.001, bbox.Max.Y - bbox.Min.Y)
    sz = max(0.001, bbox.Max.Z - bbox.Min.Z)

    min_dim = min(sx, sy, sz)
    es_atravesada = extraer_valor_b(modo_veta)
    escala = float(escala_caja_mm)

    for idx in range(mesh.Vertices.Count):
        v = mesh.Vertices[idx]
        n = mesh.Normals[idx] if idx < mesh.Normals.Count else Rhino.Geometry.Vector3f(0, 0, 1)

        lx = v.X - bbox.Min.X
        ly = v.Y - bbox.Min.Y
        lz = v.Z - bbox.Min.Z

        nx, ny, nz = abs(n.X), abs(n.Y), abs(n.Z)

        # -------------------------------------------------------------
        # CASO 1: Tablero Horizontal (Cubiertas, Entrepaños - Espesor en Z)
        # -------------------------------------------------------------
        if min_dim == sz:
            if nz >= nx and nz >= ny:
                # Cara principal (plano XY)
                u = ly / escala if es_atravesada else lx / escala
                v_coord = lx / escala if es_atravesada else ly / escala
            elif ny >= nx and ny >= nz:
                # Cantos frontal y trasero (en Y): veta longitudinal al filo (en X)
                u = lx / escala
                v_coord = lz / escala
            else:
                # Cantos laterales (en X): veta longitudinal al filo (en Y)
                u = ly / escala
                v_coord = lz / escala

        # -------------------------------------------------------------
        # CASO 2: Tablero Vertical Lateral (Costados / Laterales Cajón - Espesor en X)
        # -------------------------------------------------------------
        elif min_dim == sx:
            if nx >= ny and nx >= nz:
                # Cara principal (plano YZ)
                if sz >= sy:
                    # Costado de Mueble (alto en Z): Longitudinal corre en Z
                    u = ly / escala if es_atravesada else lz / escala
                    v_coord = lz / escala if es_atravesada else ly / escala
                else:
                    # Lateral de Cajón (largo en Y): Longitudinal corre a lo largo del cajón (Y)
                    u = lz / escala if es_atravesada else ly / escala
                    v_coord = ly / escala if es_atravesada else lz / escala
            elif nz >= nx and nz >= ny:
                # Cantos superior e inferior (en Z): veta siempre longitudinal al filo (en Y)
                u = ly / escala
                v_coord = lx / escala
            else:
                # Cantos frontal y trasero (en Y): veta siempre longitudinal al filo (en Z)
                u = lz / escala
                v_coord = lx / escala

        # -------------------------------------------------------------
        # CASO 3: Tablero Vertical Frontal (Frentes, Zócalos - Espesor en Y)
        # -------------------------------------------------------------
        else:
            if ny >= nx and ny >= nz:
                # Cara principal (plano XZ): Longitudinal corre horizontal en X
                u = lz / escala if es_atravesada else lx / escala
                v_coord = lx / escala if es_atravesada else lz / escala
            elif nz >= nx and nz >= ny:
                # Cantos superior e inferior (en Z): veta longitudinal al filo (en X)
                u = lx / escala
                v_coord = ly / escala
            else:
                # Cantos laterales (en X): veta longitudinal al filo (en Z)
                u = lz / escala
                v_coord = ly / escala

        mesh.TextureCoordinates.Add(float(u), float(v_coord))

    return mesh

def aplicar_box_mapping_profesional(mesh_in, modo_veta=0, escala_caja_mm=600.0):
    if mesh_in is None or not isinstance(mesh_in, Rhino.Geometry.Mesh):
        return mesh_in

    if hasattr(mesh_in, "SplitDisjointPieces"):
        piezas = mesh_in.SplitDisjointPieces()
    else:
        piezas = [mesh_in]

    if len(piezas) > 1:
        mesh_out = Rhino.Geometry.Mesh()
        for p in piezas:
            p_mapped = _mapear_mesh_simple(p, modo_veta, escala_caja_mm)
            mesh_out.Append(p_mapped)
        return mesh_out
    else:
        return _mapear_mesh_simple(mesh_in, modo_veta, escala_caja_mm)

# =============================================================================
# INYECCIÓN Y EJECUCIÓN (Compatible con List Access en B)
# =============================================================================
val_b = B if 'B' in locals() and B is not None else 0

if isinstance(M, list):
    a = [aplicar_box_mapping_profesional(item, val_b, 600.0) for item in M if item is not None]
else:
    a = aplicar_box_mapping_profesional(M, val_b, 600.0)
# ---------- end python_3_script_2 ----------
python_3_script_3 = Python3Script(M=mesh_join_2, B=rh_in_02_0_mapeado)  # -> a; inputs M: Mesh, B: list of Int32; same code as python_3_script_2
rh_out_mdp_tablero_superior = Geometry(python_3_script_2)
rh_out_tablero_superior_b = Geometry(python_3_script_3)

# ----
# Box Mapping 3.8
python_3_script_4 = Python3Script(M=mesh_join, B=rh_in_02_0_mapeado)  # -> a; inputs M: Mesh, B: list of Int32; same code as python_3_script_2

# ---- group: Tablero Superior (continued)
rh_out_tablero_superior = Geometry(python_3_script_4)

# ---- group: Tablero Inferior
rh_in_03_1_lado_balance = ValueList({"Cara A", "Cara B", "D/D"}, selected="Cara B")
rh_in_03_2_canto_frontal = ValueList({"Canto": 0, "MDP": 1}, selected="Canto")
rh_in_03_3_canto_trasero = ValueList({"Canto": 0, "MDP": 1}, selected="MDP")
rh_in_03_4canto_izquierdo_arriba = ValueList({"Canto": 0, "MDP": 1}, selected="Canto")
rh_in_03_5_canto_derecho_abajo = ValueList({"Canto": 0, "MDP": 1}, selected="Canto")
segmentacion_2 = ValueList({"Triángulos": 0, "Quads y triángulos (mixto)": 1, "Sólo quads si es posible": 2}, selected="Sólo quads si es posible")
rh_in_03_0_mapeado = ValueList({"Longitudinal": 0, "Atravesada": 1}, selected="Longitudinal")

# Materializer 3.4
python_3_script_5 = Python3Script(
    Brep_In=solid_difference_10,
    Balance_Mode=rh_in_03_1_lado_balance,
    Canto_1=rh_in_03_2_canto_frontal,
    Canto_2=rh_in_03_3_canto_trasero,
    Canto_3=rh_in_03_4canto_izquierdo_arriba,
    Canto_4=rh_in_03_5_canto_derecho_abajo)  # -> Out, NURBS_Color, NURBS_Balance, NURBS_MDP; inputs Brep_In: Brep, Balance_Mode: String, Canto_1: String, Canto_2: String, Canto_3: String, Canto_4: String; same code as python_3_script

diagnostico_2 = Panel(python_3_script_5.Out)
mesh_brep_6 = MeshBrep(
    Brep=python_3_script_5.NURBS_Color,
    Settings={GridMaxCount=0, GridMinCount=16, JaggedSeams=False, MaxEdgeLength=0, MinEdgeLength=0.0001, MinTolerance=0, Refine=True, RefineAngle=0, RelativeTolerance=0.65, SimplePlanes=True, Tolerance=0})
mesh_brep_7 = MeshBrep(
    Brep=python_3_script_5.NURBS_Balance,
    Settings={GridMaxCount=0, GridMinCount=16, JaggedSeams=False, MaxEdgeLength=0, MinEdgeLength=0.0001, MinTolerance=0, Refine=True, RefineAngle=0, RelativeTolerance=0.65, SimplePlanes=True, Tolerance=0})
mesh_brep_8 = MeshBrep(
    Brep=python_3_script_5.NURBS_MDP,
    Settings={GridMaxCount=0, GridMinCount=16, JaggedSeams=False, MaxEdgeLength=0, MinEdgeLength=0.0001, MinTolerance=0, Refine=True, RefineAngle=0, RelativeTolerance=0.65, SimplePlanes=True, Tolerance=0})
mesh_join_4 = MeshJoin(Meshes=flatten(mesh_brep_6))
mesh_join_5 = MeshJoin(Meshes=flatten(mesh_brep_7))
mesh_join_6 = MeshJoin(Meshes=flatten(mesh_brep_8))
reduce_mesh_2 = ReduceMesh(Mesh=mesh_join_6, FaceCount=20, Accuracy=1, FaceType=segmentacion_2, Distort=Toggle(False), Normalize=Toggle(True))  # -> Reduced, CountDifference
panel_55 = Panel(reduce_mesh_2.CountDifference)
python_3_script_6 = Python3Script(M=reduce_mesh_2.Reduced, B=rh_in_03_0_mapeado)  # -> a; inputs M: Mesh, B: list of Int32; same code as python_3_script_2
python_3_script_7 = Python3Script(M=mesh_join_5, B=rh_in_03_0_mapeado)  # -> a; inputs M: Mesh, B: list of Int32; same code as python_3_script_2
rh_out_mdp_tablero_inferior = Geometry(python_3_script_6)
rh_out_tablero_inferior_b = Geometry(python_3_script_7)

# Box Mapping 3.8
python_3_script_8 = Python3Script(M=mesh_join_4, B=rh_in_03_0_mapeado)  # -> a; inputs M: Mesh, B: list of Int32; same code as python_3_script_2

rh_out_tablero_inferior = Geometry(python_3_script_8)

# ==== cluster Cluster
pieza = ClusterInput()
relay = ClusterInput()
# Maquinado Minifix + Tornillo Drywall *Superior
deconstruct_brep = DeconstructBrep(Pieza=pieza)  # -> Faces, Edges, Vertices
# Maquinado Tuerca + Tornillo Drywall + Tarugo *Inferior
deconstruct_brep_2 = DeconstructBrep(Pieza=pieza)  # -> Faces, Edges, Vertices
# Maquinado Tarugos + Tornillo Drywall *Superior
deconstruct_brep_3 = DeconstructBrep(Pieza=pieza)  # -> Faces, Edges, Vertices
# Maquinado Tornillo Drywall + Tarugo *Inferior
deconstruct_brep_4 = DeconstructBrep(Pieza=pieza)  # -> Faces, Edges, Vertices
list_item = ListItem(List=deconstruct_brep.Edges, Index="18", Wrap=True)
list_item_2 = ListItem(List=deconstruct_brep_2.Edges, Index="2", Wrap=True)
list_item_3 = ListItem(List=deconstruct_brep.Faces, Index="5", Wrap=True)
list_item_4 = ListItem(List=deconstruct_brep_2.Faces, Index="4", Wrap=True)
list_item_5 = ListItem(List=deconstruct_brep_3.Edges, Index="18", Wrap=True)
list_item_6 = ListItem(List=deconstruct_brep_3.Faces, Index="5", Wrap=True)
list_item_7 = ListItem(List=deconstruct_brep_4.Edges, Index="2", Wrap=True)
list_item_8 = ListItem(List=deconstruct_brep_4.Faces, Index="4", Wrap=True)
area = Area(Geometry=list_item_3)  # -> Area, Centroid
area_2 = Area(Geometry=list_item_4)  # -> Area, Centroid
curve_middle = CurveMiddle(Curve=list_item)
curve_middle_2 = CurveMiddle(Curve=list_item_2)
area_3 = Area(Geometry=list_item_6)  # -> Area, Centroid
curve_middle_3 = CurveMiddle(Curve=list_item_5)
area_4 = Area(Geometry=list_item_8)  # -> Area, Centroid
curve_middle_4 = CurveMiddle(Curve=list_item_7)
line = Line(StartPoint=area.Centroid, EndPoint=curve_middle)
line_2 = Line(StartPoint=area_2.Centroid, EndPoint=curve_middle_2)
xz_plane = XZPlane(Origin=area.Centroid)
xz_plane_2 = XZPlane(Origin=area_2.Centroid)
line_3 = Line(StartPoint=area_3.Centroid, EndPoint=curve_middle_3)
xz_plane_3 = XZPlane(Origin=area_3.Centroid)
line_4 = Line(StartPoint=area_4.Centroid, EndPoint=curve_middle_4)
xz_plane_4 = XZPlane(Origin=area_4.Centroid)
length = Length(Curve=line)
length_2 = Length(Curve=line_2)
length_3 = Length(Curve=line_3)
length_4 = Length(Curve=line_4)
panel = Panel(length)
panel_2 = Panel(length_2)
panel_3 = Panel(length_3)
panel_4 = Panel(length_4)
distancia_minima_al_borde = Panel("20")
distancia_minima_al_borde_2 = Panel("20")
distancia_minima_al_borde_3 = Panel("20")
distancia_minima_al_borde_4 = Panel("20")
paso_maquinas = Panel("32")
paso_maquinas_2 = Panel("32")
subtraction = Subtraction(A=panel, B=distancia_minima_al_borde)
subtraction_2 = Subtraction(A=panel_2, B=distancia_minima_al_borde_2)
paso_maquinas_3 = Panel("32")
subtraction_3 = Subtraction(A=panel_3, B=distancia_minima_al_borde_3)
paso_maquinas_4 = Panel("32")
subtraction_4 = Subtraction(A=panel_4, B=distancia_minima_al_borde_4)
division = Division(A=subtraction, B=paso_maquinas)
division_2 = Division(A=subtraction_2, B=paso_maquinas_2)
division_3 = Division(A=subtraction_3, B=paso_maquinas_3)
division_4 = Division(A=subtraction_4, B=paso_maquinas_4)
panel_5 = Panel(division)
panel_6 = Panel(division_2)
panel_7 = Panel(division_3)
panel_8 = Panel(division_4)
round = Round(Number=panel_5)  # -> Nearest, Floor, Ceiling
round_2 = Round(Number=panel_6)  # -> Nearest, Floor, Ceiling
round_3 = Round(Number=panel_7)  # -> Nearest, Floor, Ceiling
round_4 = Round(Number=panel_8)  # -> Nearest, Floor, Ceiling
panel_9 = Panel(round.Floor)
panel_10 = Panel(round_2.Floor)
panel_11 = Panel(round_3.Floor)
panel_12 = Panel(round_4.Floor)
multiplication = Multiplication(A=panel_9, B=paso_maquinas)
multiplication_2 = Multiplication(A=panel_10, B=paso_maquinas_2)
multiplication_3 = Multiplication(A=panel_11, B=paso_maquinas_3)
multiplication_4 = Multiplication(A=panel_12, B=paso_maquinas_4)
unit_y = UnitY(Factor=multiplication)
unit_y_2 = UnitY(Factor=multiplication_2)
unit_y_3 = UnitY(Factor=multiplication_3)
unit_y_4 = UnitY(Factor=multiplication_4)
negative = Negative(Value=paso_maquinas_2)
negative_2 = Negative(Value=paso_maquinas_3)
move = Move(Geometry=area.Centroid, Motion=unit_y)  # -> Geometry, Transform
negative_3 = Negative(Value=paso_maquinas_4)
move_2 = Move(Geometry=area_2.Centroid, Motion=unit_y_2)  # -> Geometry, Transform
move_3 = Move(Geometry=area_3.Centroid, Motion=unit_y_3)  # -> Geometry, Transform
move_4 = Move(Geometry=area_4.Centroid, Motion=unit_y_4)  # -> Geometry, Transform
unit_y_5 = UnitY(Factor=negative)
unit_y_6 = UnitY(Factor=negative_2)
unit_y_7 = UnitY(Factor=negative_3)
xy_plane = XYPlane(Origin=move.Geometry)
move_5 = Move(Geometry=move_2.Geometry, Motion=unit_y_5)  # -> Geometry, Transform
xy_plane_2 = XYPlane(Origin=move_2.Geometry)
move_6 = Move(Geometry=move_3.Geometry, Motion=unit_y_6)  # -> Geometry, Transform
xy_plane_3 = XYPlane(Origin=move_3.Geometry)
xy_plane_4 = XYPlane(Origin=move.Geometry)
move_7 = Move(Geometry=move_4.Geometry, Motion=unit_y_7)  # -> Geometry, Transform
unit_z = UnitZ(Factor="22")
xy_plane_5 = XYPlane(Origin=move_4.Geometry)
cylinder = Cylinder(Base=xy_plane, Radius="2.5", Length="10")
unit_z_2 = UnitZ(Factor="22")
cylinder_2 = Cylinder(Base=xy_plane_2, Radius="3", Length="-15")
move_8 = Move(Geometry=move_5.Geometry, Motion=unit_z)  # -> Geometry, Transform
cylinder_3 = Cylinder(Base=xy_plane_3, Radius="3", Length="15")
xy_plane_6 = XYPlane(Origin=move.Geometry)
cap_holes = CapHoles(Brep=cylinder)
unit_z_3 = UnitZ(Factor="10")
cylinder_4 = Cylinder(Base=xy_plane_5, Radius="3", Length="-15")
move_9 = Move(Geometry=move_7.Geometry, Motion=unit_z_2)  # -> Geometry, Transform
cylinder_5 = Cylinder(Base=xy_plane_6, Radius="3.5", Length="-22")
move_10 = Move(Geometry=move_6.Geometry, Motion=unit_z_3)  # -> Geometry, Transform
xy_plane_7 = XYPlane(Origin=move_8.Geometry)
cylinder_6 = Cylinder(Base=xy_plane_2, Radius="1.5", Length="20")
cylinder_7 = Cylinder(Base=xy_plane_3, Radius="1.5", Length="-20")
cap_holes_2 = CapHoles(Brep=cylinder_2)
xy_plane_8 = XYPlane(Origin=move_9.Geometry)
cap_holes_3 = CapHoles(Brep=cylinder_3)
cylinder_8 = Cylinder(Base=xy_plane_5, Radius="1.5", Length="20")
cap_holes_4 = CapHoles(Brep=cylinder_5)
cap_holes_5 = CapHoles(Brep=cylinder_4)
xy_plane_9 = XYPlane(Origin=move_10.Geometry)
cylinder_9 = Cylinder(Base=xy_plane_7, Radius="4", Length="-32")
cap_holes_6 = CapHoles(Brep=cylinder_6)
deconstruct_brep_5 = DeconstructBrep(Brep=cap_holes_3)  # -> Faces, Edges, Vertices
cap_holes_7 = CapHoles(Brep=cylinder_7)
cylinder_10 = Cylinder(Base=xy_plane_8, Radius="4", Length="-32")
deconstruct_brep_6 = DeconstructBrep(Brep=cap_holes_4)  # -> Faces, Edges, Vertices
cap_holes_8 = CapHoles(Brep=cylinder_8)
solid_union = SolidUnion(Breps=[cap_holes_2, cap_holes_6])
cylinder_11 = Cylinder(Base=xy_plane_9, Radius="4", Length="-32")
cap_holes_9 = CapHoles(Brep=cylinder_9)
solid_union_2 = SolidUnion(Breps=[cap_holes_3, cap_holes_7])
cap_holes_10 = CapHoles(Brep=cylinder_10)
list_item_9 = ListItem(List=deconstruct_brep_5.Faces, Index="2", Wrap=True)
list_item_10 = ListItem(List=deconstruct_brep_6.Faces, Index="4", Wrap=True)
deconstruct_brep_7 = DeconstructBrep(Brep=cap_holes_9)  # -> Faces, Edges, Vertices
deconstruct_brep_8 = DeconstructBrep(Brep=cap_holes_2)  # -> Faces, Edges, Vertices
cap_holes_11 = CapHoles(Brep=cylinder_11)
deconstruct_brep_9 = DeconstructBrep(Brep=cap_holes_6)  # -> Faces, Edges, Vertices
solid_union_3 = SolidUnion(Breps=cap_holes_9)
deconstruct_brep_10 = DeconstructBrep(Brep=cap_holes_10)  # -> Faces, Edges, Vertices
deconstruct_brep_11 = DeconstructBrep(Brep=cap_holes_5)  # -> Faces, Edges, Vertices
area_5 = Area(Geometry=list_item_9)  # -> Area, Centroid
area_6 = Area(Geometry=list_item_10)  # -> Area, Centroid
solid_union_4 = SolidUnion(Breps=cap_holes_10)
solid_union_5 = SolidUnion(Breps=[solid_union_2, cap_holes_11])
unit_z_4 = UnitZ(Factor="-2")
list_item_11 = ListItem(List=deconstruct_brep_7.Faces, Index="1", Wrap=True)
list_item_12 = ListItem(List=deconstruct_brep_8.Faces, Index="1", Wrap=True)
list_item_13 = ListItem(List=deconstruct_brep_10.Faces, Index="1", Wrap=True)
list_item_14 = ListItem(List=deconstruct_brep_9.Faces, Index="2", Wrap=True)
deconstruct_brep_12 = DeconstructBrep(Brep=cap_holes_11)  # -> Faces, Edges, Vertices
list_item_15 = ListItem(List=deconstruct_brep_11.Faces, Index="1", Wrap=True)
move_11 = Move(Geometry=area_6.Centroid, Motion=unit_z_4)  # -> Geometry, Transform
mirror = Mirror(Geometry=solid_union_5, Plane=xz_plane_3)  # -> Geometry, Transform
area_7 = Area(Geometry=list_item_11)  # -> Area, Centroid
area_8 = Area(Geometry=list_item_14)  # -> Area, Centroid
area_9 = Area(Geometry=list_item_12)  # -> Area, Centroid
unit_x = UnitX(Factor="-4")
unit_x_2 = UnitX(Factor="-4")
area_10 = Area(Geometry=list_item_13)  # -> Area, Centroid
area_11 = Area(Geometry=list_item_15)  # -> Area, Centroid
relay_2 = ClusterInput()
relay_3 = ClusterInput()
list_item_16 = ListItem(List=deconstruct_brep_12.Faces, Index="2", Wrap=True)
move_12 = Move(Geometry=move_11.Geometry, Motion=unit_x_2)  # -> Geometry, Transform
solid_union_6 = SolidUnion(Breps=[mirror.Geometry, solid_union_5])
area_12 = Area(Geometry=list_item_16)  # -> Area, Centroid
move_13 = Move(Geometry=area_8.Centroid, Motion=unit_x)  # -> Geometry, Transform
solid_union_7 = SolidUnion(Breps=[cap_holes_5, cap_holes_8])
yz_plane = YZPlane(Origin=move_12.Geometry)
yz_plane_2 = YZPlane(Origin=move_13.Geometry)
cylinder_12 = Cylinder(Base=yz_plane, Radius="7.5", Length="12")
cylinder_13 = Cylinder(Base=yz_plane_2, Radius="6", Length="11.5")
cap_holes_12 = CapHoles(Brep=cylinder_12)
solid_union_8 = SolidUnion(Breps=[solid_union_7, solid_union_4])
solid_union_9 = SolidUnion(Breps=[cap_holes_12, cap_holes_4, cap_holes])
cap_holes_13 = CapHoles(Brep=cylinder_13)
deconstruct_brep_13 = DeconstructBrep(Brep=cap_holes_13)  # -> Faces, Edges, Vertices
rotate_3d = Rotate3D(Geometry=solid_union_9, Angle=degrees("180"), Center=xy_plane_6, Axis=Vector(0, 0, 1))  # -> Geometry, Transform
solid_union_10 = SolidUnion(Breps=[cap_holes_13, cap_holes_2, cap_holes_6])
list_item_17 = ListItem(List=deconstruct_brep_13.Faces, Index="1", Wrap=True)
mirror_2 = Mirror(Geometry=solid_union_8, Plane=xz_plane_4)  # -> Geometry, Transform
rotate_3d_2 = Rotate3D(Geometry=solid_union_10, Angle=degrees("180"), Center=move_2.Geometry, Axis=Vector(0, 0, 1))  # -> Geometry, Transform
stream_filter = StreamFilter(GirarMaquinadoPerno=relay_3, Stream0=solid_union_9, Stream1=rotate_3d.Geometry)
area_13 = Area(Geometry=list_item_17)  # -> Area, Centroid
stream_filter_2 = StreamFilter(GirarTuercaPlastica=relay_2, Stream0=solid_union_10, Stream1=rotate_3d_2.Geometry)
solid_union_11 = SolidUnion(Breps=[mirror_2.Geometry, solid_union_8])
mirror_3 = Mirror(Geometry=stream_filter, Plane=xz_plane)  # -> Geometry, Transform
solid_union_12 = SolidUnion(Breps=[stream_filter, mirror_3.Geometry])
solid_union_13 = SolidUnion(Breps=[solid_union_3, stream_filter_2])
mirror_4 = Mirror(Geometry=solid_union_13, Plane=xz_plane_2)  # -> Geometry, Transform
solid_union_14 = SolidUnion(Breps=[mirror_4.Geometry, solid_union_13])
list_length = ListLength(List=[pieza, "0"])  # -> flatten(Length)
panel_13 = Panel(list_length)
dispatch = Dispatch(List=panel_13, DispatchPattern=[True, False])  # -> ListA, ListB
panel_14 = Panel(dispatch.ListB)
panel_15 = Panel(dispatch.ListA)
addition = Addition(A=panel_15, B=panel_14)
union_superior = ClusterInput()
union_inferior = ClusterInput()
panel_16 = Panel(addition)
expression = Expression(x=panel_16, Expression="if(x=\"1\",0,1)")
# Aqui se definen cuales son los herrajes superiores e inferiores
stream_filter_3 = StreamFilter(UnionSuperior=union_superior, Stream0=solid_union_6, Stream1=solid_union_12)
stream_filter_4 = StreamFilter(UnionInferior=union_inferior, Stream0=solid_union_14, Stream1=solid_union_11)
s_0 = ClusterOutput(stream_filter_4)
s_1 = ClusterOutput(stream_filter_3)
panel_17 = Panel(expression)

mesh = Mesh(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)
point = Point(Point(-380.6006041, 587.7908738, 256.8805061))

point_2 = Point(Point(-134.1035289, 107.5129007, 256.9310845))
mesh_2 = Mesh(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)
point_3 = Point(Point(-134.1035289, 107.5129007, 270.9310845))

mesh_3 = Mesh(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)
point_4 = Point(Point(-97.39304191, 111.3185558, 290.5782605))
mesh_4 = Mesh(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)

mesh_5 = Mesh(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)
point_5 = Point(Point(-135.4591294, 432, 101.6471077))

stream_filter_5 = StreamFilter(Gate=panel_17, Stream1=mesh_2)
stream_filter_6 = StreamFilter(Gate=panel_17, Stream1=mesh_5)
stream_filter_7 = StreamFilter(Gate=panel_17, Stream1=mesh_3)
stream_filter_8 = StreamFilter(Gate=panel_17, Stream1=mesh_4)
stream_filter_9 = StreamFilter(Gate=panel_17, Stream1=mesh)
stream_filter_10 = StreamFilter(Gate=panel_17, Stream1=mesh_2)
stream_filter_11 = StreamFilter(Gate=panel_17, Stream1=mesh)
vector_2pt = Vector2Pt(PointA=point_5, PointB=area_13.Centroid, Unitize=False)  # -> Vector, Length
unit_y_8 = UnitY(Factor=1)
vector_2pt_2 = Vector2Pt(PointA=point_2, PointB=move_5.Geometry, Unitize=False)  # -> Vector, Length
vector_2pt_3 = Vector2Pt(PointA=point, PointB=area_5.Centroid, Unitize=False)  # -> Vector, Length
vector_2pt_4 = Vector2Pt(PointA=point_3, PointB=move_6.Geometry, Unitize=False)  # -> Vector, Length
vector_2pt_5 = Vector2Pt(PointA=point_4, PointB=move.Geometry, Unitize=False)  # -> Vector, Length
move_14 = Move(Geometry=stream_filter_6, Motion=vector_2pt.Vector)  # -> Geometry, Transform
vector_2pt_6 = Vector2Pt(PointA=point_4, PointB=move.Geometry, Unitize=False)  # -> Vector, Length
rotate_3d_3 = Rotate3D(Geometry=stream_filter_11, Angle=degrees("180"), Center=point, Axis=unit_y_8)  # -> Geometry, Transform
move_15 = Move(Geometry=stream_filter_5, Motion=vector_2pt_2.Vector)  # -> Geometry, Transform
move_16 = Move(Geometry=stream_filter_8, Motion=vector_2pt_5.Vector)  # -> Geometry, Transform
move_17 = Move(Geometry=stream_filter_10, Motion=vector_2pt_4.Vector)  # -> Geometry, Transform
move_18 = Move(Geometry=stream_filter_9, Motion=vector_2pt_3.Vector)  # -> Geometry, Transform
move_19 = Move(Geometry=stream_filter_7, Motion=vector_2pt_6.Vector)  # -> Geometry, Transform
vector_2pt_7 = Vector2Pt(PointA=point, PointB=area_9.Centroid, Unitize=False)  # -> Vector, Length
geometry = ClusterOutput(move_15.Geometry)
mirror_5 = Mirror(Geometry=move_15.Geometry, Plane=xz_plane_3)  # -> TarugoInferior, Transform
rotate_3d_4 = Rotate3D(Geometry=move_14.Geometry, Angle=degrees("180"), Center=xy_plane_2, Axis=Vector(0, 0, 1))  # -> Geometry, Transform
move_20 = Move(Geometry=rotate_3d_3.Geometry, Motion=vector_2pt_7.Vector)  # -> Geometry, Transform
mirror_6 = Mirror(Geometry=move_18.Geometry, Plane=xz_plane_3)  # -> Geometry, Transform
rotate_3d_5 = Rotate3D(Geometry=move_19.Geometry, Angle=degrees("180"), Center=xy_plane_4, Axis=Vector(0, 0, 1))  # -> Geometry, Transform
mirror_7 = Mirror(Geometry=move_17.Geometry, Plane=xz_plane_3)  # -> Geometry, Transform
stream_filter_12 = StreamFilter(GirarTuercaPlastica=relay_2, Stream0=move_14.Geometry, Stream1=rotate_3d_4.Geometry)
mirror_8 = Mirror(Geometry=move_20.Geometry, Plane=xz_plane_3)  # -> DrywallInferior, Transform
stream_filter_13 = StreamFilter(GirarPerno=relay_3, Stream0=move_19.Geometry, Stream1=rotate_3d_5.Geometry)
herrajes_inferiores = ClusterInput()
mirror_9 = Mirror(Geometry=stream_filter_12, Plane=xz_plane_2)  # -> Geometry, Transform
drywall_inferior = ClusterOutput(mirror_8.DrywallInferior)
mirror_10 = Mirror(Geometry=move_16.Geometry, Plane=xz_plane)  # -> Geometry, Transform
mirror_11 = Mirror(Geometry=stream_filter_13, Plane=xz_plane)  # -> Geometry, Transform
stream_filter_14 = StreamFilter(HerrajesInferiores=herrajes_inferiores, Stream0=[stream_filter_12, mirror_9.Geometry])
s_0_2 = ClusterOutput(stream_filter_14)
stream_filter_15 = StreamFilter(Tarugo=relay, Stream0=[mirror_7.Geometry, move_17.Geometry])
stream_filter_16 = StreamFilter(Drywall=relay, Stream0=[mirror_6.Geometry, move_18.Geometry])
stream_filter_17 = StreamFilter(Perno=relay, Stream1=[mirror_10.Geometry, move_16.Geometry])
stream_filter_18 = StreamFilter(Gate=relay, Stream1=[mirror_11.Geometry, stream_filter_13])
s_1_2 = ClusterOutput(stream_filter_15)
s_1_3 = ClusterOutput(stream_filter_18)
s_1_4 = ClusterOutput(stream_filter_17)
drywall_superior = ClusterOutput(stream_filter_16)

# ==== cluster Cluster_2
pieza = ClusterInput()
# Maquinado Minifix + Tornillo Drywall *Superior
deconstruct_brep = DeconstructBrep(Pieza=pieza)  # -> Faces, Edges, Vertices
# Maquinado Tuerca + Tornillo Drywall + Tarugo *Inferior
deconstruct_brep_2 = DeconstructBrep(Pieza=pieza)  # -> Faces, Edges, Vertices
# Maquinado Tarugos + Tornillo Drywall *Superior
deconstruct_brep_3 = DeconstructBrep(Pieza=pieza)  # -> Faces, Edges, Vertices
# Maquinado Tornillo Drywall + Tarugo *Inferior
deconstruct_brep_4 = DeconstructBrep(Pieza=pieza)  # -> Faces, Edges, Vertices
list_item = ListItem(List=deconstruct_brep.Edges, Index="18", Wrap=True)
list_item_2 = ListItem(List=deconstruct_brep_2.Edges, Index="2", Wrap=True)
list_item_3 = ListItem(List=deconstruct_brep.Faces, Index="5", Wrap=True)
list_item_4 = ListItem(List=deconstruct_brep_2.Faces, Index="4", Wrap=True)
list_item_5 = ListItem(List=deconstruct_brep_3.Edges, Index="18", Wrap=True)
list_item_6 = ListItem(List=deconstruct_brep_3.Faces, Index="5", Wrap=True)
list_item_7 = ListItem(List=deconstruct_brep_4.Edges, Index="2", Wrap=True)
list_item_8 = ListItem(List=deconstruct_brep_4.Faces, Index="4", Wrap=True)
area = Area(Geometry=list_item_3)  # -> Area, Centroid
area_2 = Area(Geometry=list_item_4)  # -> Area, Centroid
curve_middle = CurveMiddle(Curve=list_item)
curve_middle_2 = CurveMiddle(Curve=list_item_2)
area_3 = Area(Geometry=list_item_6)  # -> Area, Centroid
curve_middle_3 = CurveMiddle(Curve=list_item_5)
area_4 = Area(Geometry=list_item_8)  # -> Area, Centroid
curve_middle_4 = CurveMiddle(Curve=list_item_7)
line = Line(StartPoint=area.Centroid, EndPoint=curve_middle)
line_2 = Line(StartPoint=area_2.Centroid, EndPoint=curve_middle_2)
xz_plane = XZPlane(Origin=area.Centroid)
xz_plane_2 = XZPlane(Origin=area_2.Centroid)
line_3 = Line(StartPoint=area_3.Centroid, EndPoint=curve_middle_3)
xz_plane_3 = XZPlane(Origin=area_3.Centroid)
line_4 = Line(StartPoint=area_4.Centroid, EndPoint=curve_middle_4)
xz_plane_4 = XZPlane(Origin=area_4.Centroid)
length = Length(Curve=line)
length_2 = Length(Curve=line_2)
length_3 = Length(Curve=line_3)
length_4 = Length(Curve=line_4)
panel = Panel(length)
panel_2 = Panel(length_2)
panel_3 = Panel(length_3)
panel_4 = Panel(length_4)
distancia_minima_al_borde = Panel("20")
distancia_minima_al_borde_2 = Panel("20")
distancia_minima_al_borde_3 = Panel("20")
distancia_minima_al_borde_4 = Panel("20")
paso_maquinas = Panel("32")
paso_maquinas_2 = Panel("32")
subtraction = Subtraction(A=panel, B=distancia_minima_al_borde)
subtraction_2 = Subtraction(A=panel_2, B=distancia_minima_al_borde_2)
paso_maquinas_3 = Panel("32")
subtraction_3 = Subtraction(A=panel_3, B=distancia_minima_al_borde_3)
paso_maquinas_4 = Panel("32")
subtraction_4 = Subtraction(A=panel_4, B=distancia_minima_al_borde_4)
division = Division(A=subtraction, B=paso_maquinas)
division_2 = Division(A=subtraction_2, B=paso_maquinas_2)
division_3 = Division(A=subtraction_3, B=paso_maquinas_3)
division_4 = Division(A=subtraction_4, B=paso_maquinas_4)
panel_5 = Panel(division)
panel_6 = Panel(division_2)
panel_7 = Panel(division_3)
panel_8 = Panel(division_4)
round = Round(Number=panel_5)  # -> Nearest, Floor, Ceiling
round_2 = Round(Number=panel_6)  # -> Nearest, Floor, Ceiling
round_3 = Round(Number=panel_7)  # -> Nearest, Floor, Ceiling
round_4 = Round(Number=panel_8)  # -> Nearest, Floor, Ceiling
panel_9 = Panel(round.Floor)
panel_10 = Panel(round_2.Floor)
panel_11 = Panel(round_3.Floor)
panel_12 = Panel(round_4.Floor)
multiplication = Multiplication(A=panel_9, B=paso_maquinas)
multiplication_2 = Multiplication(A=panel_10, B=paso_maquinas_2)
multiplication_3 = Multiplication(A=panel_11, B=paso_maquinas_3)
multiplication_4 = Multiplication(A=panel_12, B=paso_maquinas_4)
unit_y = UnitY(Factor=multiplication)
unit_y_2 = UnitY(Factor=multiplication_2)
unit_y_3 = UnitY(Factor=multiplication_3)
unit_y_4 = UnitY(Factor=multiplication_4)
negative = Negative(Value=paso_maquinas_2)
negative_2 = Negative(Value=paso_maquinas_3)
move = Move(Geometry=area.Centroid, Motion=unit_y)  # -> Geometry, Transform
negative_3 = Negative(Value=paso_maquinas_4)
move_2 = Move(Geometry=area_2.Centroid, Motion=unit_y_2)  # -> Geometry, Transform
move_3 = Move(Geometry=area_3.Centroid, Motion=unit_y_3)  # -> Geometry, Transform
move_4 = Move(Geometry=area_4.Centroid, Motion=unit_y_4)  # -> Geometry, Transform
unit_y_5 = UnitY(Factor=negative)
unit_y_6 = UnitY(Factor=negative_2)
unit_y_7 = UnitY(Factor=negative_3)
xy_plane = XYPlane(Origin=move.Geometry)
move_5 = Move(Geometry=move_2.Geometry, Motion=unit_y_5)  # -> Geometry, Transform
xy_plane_2 = XYPlane(Origin=move_2.Geometry)
move_6 = Move(Geometry=move_3.Geometry, Motion=unit_y_6)  # -> Geometry, Transform
xy_plane_3 = XYPlane(Origin=move_3.Geometry)
xy_plane_4 = XYPlane(Origin=move.Geometry)
move_7 = Move(Geometry=move_4.Geometry, Motion=unit_y_7)  # -> Geometry, Transform
unit_z = UnitZ(Factor="22")
xy_plane_5 = XYPlane(Origin=move_4.Geometry)
cylinder = Cylinder(Base=xy_plane, Radius="2.5", Length="10")
unit_z_2 = UnitZ(Factor="22")
cylinder_2 = Cylinder(Base=xy_plane_2, Radius="3", Length="-15")
cap_holes = CapHoles(Brep=cylinder)
move_8 = Move(Geometry=move_5.Geometry, Motion=unit_z)  # -> Geometry, Transform
cylinder_3 = Cylinder(Base=xy_plane_3, Radius="3", Length="15")
xy_plane_6 = XYPlane(Origin=move.Geometry)
unit_z_3 = UnitZ(Factor="10")
cylinder_4 = Cylinder(Base=xy_plane_5, Radius="3", Length="-15")
move_9 = Move(Geometry=move_7.Geometry, Motion=unit_z_2)  # -> Geometry, Transform
cylinder_5 = Cylinder(Base=xy_plane_6, Radius="3.5", Length="-22")
move_10 = Move(Geometry=move_6.Geometry, Motion=unit_z_3)  # -> Geometry, Transform
xy_plane_7 = XYPlane(Origin=move_8.Geometry)
cylinder_6 = Cylinder(Base=xy_plane_2, Radius="1.5", Length="20")
cylinder_7 = Cylinder(Base=xy_plane_3, Radius="1.5", Length="-20")
cap_holes_2 = CapHoles(Brep=cylinder_2)
xy_plane_8 = XYPlane(Origin=move_9.Geometry)
cap_holes_3 = CapHoles(Brep=cylinder_3)
cylinder_8 = Cylinder(Base=xy_plane_5, Radius="1.5", Length="20")
cap_holes_4 = CapHoles(Brep=cylinder_5)
cap_holes_5 = CapHoles(Brep=cylinder_4)
xy_plane_9 = XYPlane(Origin=move_10.Geometry)
cylinder_9 = Cylinder(Base=xy_plane_7, Radius="4", Length="-32")
cap_holes_6 = CapHoles(Brep=cylinder_6)
deconstruct_brep_5 = DeconstructBrep(Brep=cap_holes_3)  # -> Faces, Edges, Vertices
cap_holes_7 = CapHoles(Brep=cylinder_7)
cylinder_10 = Cylinder(Base=xy_plane_8, Radius="4", Length="-32")
deconstruct_brep_6 = DeconstructBrep(Brep=cap_holes_4)  # -> Faces, Edges, Vertices
cap_holes_8 = CapHoles(Brep=cylinder_8)
solid_union = SolidUnion(Breps=[cap_holes_2, cap_holes_6])
cylinder_11 = Cylinder(Base=xy_plane_9, Radius="4", Length="-32")
cap_holes_9 = CapHoles(Brep=cylinder_9)
solid_union_2 = SolidUnion(Breps=[cap_holes_3, cap_holes_7])
cap_holes_10 = CapHoles(Brep=cylinder_10)
list_item_9 = ListItem(List=deconstruct_brep_5.Faces, Index="2", Wrap=True)
list_item_10 = ListItem(List=deconstruct_brep_6.Faces, Index="4", Wrap=True)
deconstruct_brep_7 = DeconstructBrep(Brep=cap_holes_9)  # -> Faces, Edges, Vertices
deconstruct_brep_8 = DeconstructBrep(Brep=cap_holes_2)  # -> Faces, Edges, Vertices
cap_holes_11 = CapHoles(Brep=cylinder_11)
deconstruct_brep_9 = DeconstructBrep(Brep=cap_holes_6)  # -> Faces, Edges, Vertices
solid_union_3 = SolidUnion(Breps=cap_holes_9)
deconstruct_brep_10 = DeconstructBrep(Brep=cap_holes_10)  # -> Faces, Edges, Vertices
deconstruct_brep_11 = DeconstructBrep(Brep=cap_holes_5)  # -> Faces, Edges, Vertices
area_5 = Area(Geometry=list_item_9)  # -> Area, Centroid
area_6 = Area(Geometry=list_item_10)  # -> Area, Centroid
solid_union_4 = SolidUnion(Breps=cap_holes_10)
solid_union_5 = SolidUnion(Breps=[solid_union_2, cap_holes_11])
unit_z_4 = UnitZ(Factor="-2")
list_item_11 = ListItem(List=deconstruct_brep_7.Faces, Index="1", Wrap=True)
list_item_12 = ListItem(List=deconstruct_brep_8.Faces, Index="1", Wrap=True)
list_item_13 = ListItem(List=deconstruct_brep_10.Faces, Index="1", Wrap=True)
list_item_14 = ListItem(List=deconstruct_brep_9.Faces, Index="2", Wrap=True)
deconstruct_brep_12 = DeconstructBrep(Brep=cap_holes_11)  # -> Faces, Edges, Vertices
list_item_15 = ListItem(List=deconstruct_brep_11.Faces, Index="1", Wrap=True)
move_11 = Move(Geometry=area_6.Centroid, Motion=unit_z_4)  # -> Geometry, Transform
mirror = Mirror(Geometry=solid_union_5, Plane=xz_plane_3)  # -> Geometry, Transform
area_7 = Area(Geometry=list_item_11)  # -> Area, Centroid
area_8 = Area(Geometry=list_item_14)  # -> Area, Centroid
area_9 = Area(Geometry=list_item_12)  # -> Area, Centroid
unit_x = UnitX(Factor="-4")
unit_x_2 = UnitX(Factor="-4")
area_10 = Area(Geometry=list_item_13)  # -> Area, Centroid
area_11 = Area(Geometry=list_item_15)  # -> Area, Centroid
relay = ClusterInput()
relay_2 = ClusterInput()
list_item_16 = ListItem(List=deconstruct_brep_12.Faces, Index="2", Wrap=True)
move_12 = Move(Geometry=move_11.Geometry, Motion=unit_x_2)  # -> Geometry, Transform
solid_union_6 = SolidUnion(Breps=[mirror.Geometry, solid_union_5])
area_12 = Area(Geometry=list_item_16)  # -> Area, Centroid
move_13 = Move(Geometry=area_8.Centroid, Motion=unit_x)  # -> Geometry, Transform
solid_union_7 = SolidUnion(Breps=[cap_holes_5, cap_holes_8])
yz_plane = YZPlane(Origin=move_12.Geometry)
yz_plane_2 = YZPlane(Origin=move_13.Geometry)
cylinder_12 = Cylinder(Base=yz_plane, Radius="7.5", Length="12")
cylinder_13 = Cylinder(Base=yz_plane_2, Radius="6", Length="11.5")
cap_holes_12 = CapHoles(Brep=cylinder_12)
solid_union_8 = SolidUnion(Breps=[solid_union_7, solid_union_4])
solid_union_9 = SolidUnion(Breps=[cap_holes_12, cap_holes_4, cap_holes])
cap_holes_13 = CapHoles(Brep=cylinder_13)
deconstruct_brep_13 = DeconstructBrep(Brep=cap_holes_13)  # -> Faces, Edges, Vertices
rotate_3d = Rotate3D(Geometry=solid_union_9, Angle=degrees("180"), Center=xy_plane_6, Axis=Vector(0, 0, 1))  # -> Geometry, Transform
solid_union_10 = SolidUnion(Breps=[cap_holes_13, cap_holes_2, cap_holes_6])
list_item_17 = ListItem(List=deconstruct_brep_13.Faces, Index="1", Wrap=True)
mirror_2 = Mirror(Geometry=solid_union_8, Plane=xz_plane_4)  # -> Geometry, Transform
rotate_3d_2 = Rotate3D(Geometry=solid_union_10, Angle=degrees("180"), Center=move_2.Geometry, Axis=Vector(0, 0, 1))  # -> Geometry, Transform
stream_filter = StreamFilter(GirarMaquinadoPerno=relay_2, Stream0=solid_union_9, Stream1=rotate_3d.Geometry)
area_13 = Area(Geometry=list_item_17)  # -> Area, Centroid
stream_filter_2 = StreamFilter(GirarTuercaPlastica=relay, Stream0=solid_union_10, Stream1=rotate_3d_2.Geometry)
solid_union_11 = SolidUnion(Breps=[mirror_2.Geometry, solid_union_8])
mirror_3 = Mirror(Geometry=stream_filter, Plane=xz_plane)  # -> Geometry, Transform
solid_union_12 = SolidUnion(Breps=[stream_filter, mirror_3.Geometry])
solid_union_13 = SolidUnion(Breps=[solid_union_3, stream_filter_2])
mirror_4 = Mirror(Geometry=solid_union_13, Plane=xz_plane_2)  # -> Geometry, Transform
solid_union_14 = SolidUnion(Breps=[mirror_4.Geometry, solid_union_13])
list_length = ListLength(List=[pieza, "0"])  # -> flatten(Length)
panel_13 = Panel(list_length)
dispatch = Dispatch(List=panel_13, DispatchPattern=[True, False])  # -> ListA, ListB
panel_14 = Panel(dispatch.ListB)
panel_15 = Panel(dispatch.ListA)
addition = Addition(A=panel_15, B=panel_14)
panel_16 = Panel(addition)
union_superior = ClusterInput()
union_inferior = ClusterInput()
expression = Expression(x=panel_16, Expression="if(x=\"1\",0,1)")
# Aqui se definen cuales son los herrajes superiores e inferiores
stream_filter_3 = StreamFilter(UnionSuperior=union_superior, Stream0=solid_union_6, Stream1=solid_union_12)
stream_filter_4 = StreamFilter(UnionInferior=union_inferior, Stream0=solid_union_14, Stream1=solid_union_11)
s_0 = ClusterOutput(stream_filter_4)
s_1 = ClusterOutput(stream_filter_3)
panel_17 = Panel(expression)

mesh = Mesh(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)
point = Point(Point(-380.6006041, 587.7908738, 256.8805061))

point_2 = Point(Point(-134.1035289, 107.5129007, 256.9310845))
mesh_2 = Mesh(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)
point_3 = Point(Point(-134.1035289, 107.5129007, 270.9310845))

mesh_3 = Mesh(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)
point_4 = Point(Point(-97.39304191, 111.3185558, 290.5782605))
mesh_4 = Mesh(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)

mesh_5 = Mesh(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)
point_5 = Point(Point(-135.4591294, 432, 101.6471077))

stream_filter_5 = StreamFilter(Gate=panel_17, Stream1=mesh_2)
stream_filter_6 = StreamFilter(Gate=panel_17, Stream1=mesh_5)
stream_filter_7 = StreamFilter(Gate=panel_17, Stream1=mesh_3)
stream_filter_8 = StreamFilter(Gate=panel_17, Stream1=mesh_4)
stream_filter_9 = StreamFilter(Gate=panel_17, Stream1=mesh)
stream_filter_10 = StreamFilter(Gate=panel_17, Stream1=mesh_2)
vector_2pt = Vector2Pt(PointA=point_2, PointB=move_5.Geometry, Unitize=False)  # -> Vector, Length
stream_filter_11 = StreamFilter(Gate=panel_17, Stream1=mesh)
unit_y_8 = UnitY(Factor=1)
vector_2pt_2 = Vector2Pt(PointA=point_5, PointB=area_13.Centroid, Unitize=False)  # -> Vector, Length
vector_2pt_3 = Vector2Pt(PointA=point, PointB=area_5.Centroid, Unitize=False)  # -> Vector, Length
move_14 = Move(Geometry=stream_filter_5, Motion=vector_2pt.Vector)  # -> Geometry, Transform
vector_2pt_4 = Vector2Pt(PointA=point_4, PointB=move.Geometry, Unitize=False)  # -> Vector, Length
vector_2pt_5 = Vector2Pt(PointA=point_4, PointB=move.Geometry, Unitize=False)  # -> Vector, Length
vector_2pt_6 = Vector2Pt(PointA=point_3, PointB=move_6.Geometry, Unitize=False)  # -> Vector, Length
rotate_3d_3 = Rotate3D(Geometry=stream_filter_11, Angle=degrees("180"), Center=point, Axis=unit_y_8)  # -> Geometry, Transform
move_15 = Move(Geometry=stream_filter_6, Motion=vector_2pt_2.Vector)  # -> Geometry, Transform
move_16 = Move(Geometry=stream_filter_7, Motion=vector_2pt_5.Vector)  # -> Geometry, Transform
move_17 = Move(Geometry=stream_filter_9, Motion=vector_2pt_3.Vector)  # -> Geometry, Transform
move_18 = Move(Geometry=stream_filter_8, Motion=vector_2pt_4.Vector)  # -> Geometry, Transform
vector_2pt_7 = Vector2Pt(PointA=point, PointB=area_9.Centroid, Unitize=False)  # -> Vector, Length
geometry = ClusterOutput(move_14.Geometry)
move_19 = Move(Geometry=stream_filter_10, Motion=vector_2pt_6.Vector)  # -> Geometry, Transform
mirror_5 = Mirror(Geometry=move_14.Geometry, Plane=xz_plane_3)  # -> TarugoInferior, Transform
rotate_3d_4 = Rotate3D(Geometry=move_15.Geometry, Angle=degrees("180"), Center=xy_plane_2, Axis=Vector(0, 0, 1))  # -> Geometry, Transform
move_20 = Move(Geometry=rotate_3d_3.Geometry, Motion=vector_2pt_7.Vector)  # -> Geometry, Transform
mirror_6 = Mirror(Geometry=move_17.Geometry, Plane=xz_plane_3)  # -> Geometry, Transform
rotate_3d_5 = Rotate3D(Geometry=move_16.Geometry, Angle=degrees("180"), Center=xy_plane_4, Axis=Vector(0, 0, 1))  # -> Geometry, Transform
mirror_7 = Mirror(Geometry=move_19.Geometry, Plane=xz_plane_3)  # -> Geometry, Transform
stream_filter_12 = StreamFilter(GirarTuercaPlastica=relay, Stream0=move_15.Geometry, Stream1=rotate_3d_4.Geometry)
mirror_8 = Mirror(Geometry=move_20.Geometry, Plane=xz_plane_3)  # -> DrywallInferior, Transform
stream_filter_13 = StreamFilter(GirarPerno=relay_2, Stream0=move_16.Geometry, Stream1=rotate_3d_5.Geometry)
mirror_9 = Mirror(Geometry=stream_filter_12, Plane=xz_plane_2)  # -> Geometry, Transform
drywall_inferior = ClusterOutput(mirror_8.DrywallInferior)
relay_3 = ClusterInput()
herrajes_inferiores = ClusterInput()
mirror_10 = Mirror(Geometry=move_18.Geometry, Plane=xz_plane)  # -> Geometry, Transform
mirror_11 = Mirror(Geometry=stream_filter_13, Plane=xz_plane)  # -> Geometry, Transform
stream_filter_14 = StreamFilter(HerrajesInferiores=herrajes_inferiores, Stream0=[stream_filter_12, mirror_9.Geometry])
s_0_2 = ClusterOutput(stream_filter_14)
stream_filter_15 = StreamFilter(Tarugo=relay_3, Stream0=[mirror_7.Geometry, move_19.Geometry])
stream_filter_16 = StreamFilter(Drywall=relay_3, Stream0=[mirror_6.Geometry, move_17.Geometry])
stream_filter_17 = StreamFilter(Perno=relay_3, Stream1=[mirror_10.Geometry, move_18.Geometry])
stream_filter_18 = StreamFilter(Gate=relay_3, Stream1=[mirror_11.Geometry, stream_filter_13])
s_1_2 = ClusterOutput(stream_filter_15)
s_1_3 = ClusterOutput(stream_filter_18)
s_1_4 = ClusterOutput(stream_filter_17)
drywall_superior = ClusterOutput(stream_filter_16)

# ==== cluster Cluster_3
pieza = ClusterInput()
# Maquinado Minifix + Tornillo Drywall *Superior
deconstruct_brep = DeconstructBrep(Pieza=pieza)  # -> Faces, Edges, Vertices
# Maquinado Tuerca + Tornillo Drywall + Tarugo *Inferior
deconstruct_brep_2 = DeconstructBrep(Pieza=pieza)  # -> Faces, Edges, Vertices
# Maquinado Tarugos + Tornillo Drywall *Superior
deconstruct_brep_3 = DeconstructBrep(Pieza=pieza)  # -> Faces, Edges, Vertices
# Maquinado Tornillo Drywall + Tarugo *Inferior
deconstruct_brep_4 = DeconstructBrep(Pieza=pieza)  # -> Faces, Edges, Vertices
list_item = ListItem(List=deconstruct_brep.Edges, Index="18", Wrap=True)
list_item_2 = ListItem(List=deconstruct_brep_2.Edges, Index="2", Wrap=True)
list_item_3 = ListItem(List=deconstruct_brep.Faces, Index="5", Wrap=True)
list_item_4 = ListItem(List=deconstruct_brep_2.Faces, Index="4", Wrap=True)
list_item_5 = ListItem(List=deconstruct_brep_3.Edges, Index="18", Wrap=True)
list_item_6 = ListItem(List=deconstruct_brep_3.Faces, Index="5", Wrap=True)
list_item_7 = ListItem(List=deconstruct_brep_4.Edges, Index="2", Wrap=True)
list_item_8 = ListItem(List=deconstruct_brep_4.Faces, Index="4", Wrap=True)
area = Area(Geometry=list_item_3)  # -> Area, Centroid
area_2 = Area(Geometry=list_item_4)  # -> Area, Centroid
curve_middle = CurveMiddle(Curve=list_item)
curve_middle_2 = CurveMiddle(Curve=list_item_2)
area_3 = Area(Geometry=list_item_6)  # -> Area, Centroid
curve_middle_3 = CurveMiddle(Curve=list_item_5)
area_4 = Area(Geometry=list_item_8)  # -> Area, Centroid
curve_middle_4 = CurveMiddle(Curve=list_item_7)
line = Line(StartPoint=area.Centroid, EndPoint=curve_middle)
line_2 = Line(StartPoint=area_2.Centroid, EndPoint=curve_middle_2)
xz_plane = XZPlane(Origin=area.Centroid)
xz_plane_2 = XZPlane(Origin=area_2.Centroid)
line_3 = Line(StartPoint=area_3.Centroid, EndPoint=curve_middle_3)
xz_plane_3 = XZPlane(Origin=area_3.Centroid)
line_4 = Line(StartPoint=area_4.Centroid, EndPoint=curve_middle_4)
xz_plane_4 = XZPlane(Origin=area_4.Centroid)
length = Length(Curve=line)
length_2 = Length(Curve=line_2)
length_3 = Length(Curve=line_3)
length_4 = Length(Curve=line_4)
panel = Panel(length)
panel_2 = Panel(length_2)
panel_3 = Panel(length_3)
panel_4 = Panel(length_4)
distancia_minima_al_borde = Panel("20")
distancia_minima_al_borde_2 = Panel("20")
distancia_minima_al_borde_3 = Panel("20")
distancia_minima_al_borde_4 = Panel("20")
paso_maquinas = Panel("32")
paso_maquinas_2 = Panel("32")
subtraction = Subtraction(A=panel, B=distancia_minima_al_borde)
subtraction_2 = Subtraction(A=panel_2, B=distancia_minima_al_borde_2)
paso_maquinas_3 = Panel("32")
subtraction_3 = Subtraction(A=panel_3, B=distancia_minima_al_borde_3)
paso_maquinas_4 = Panel("32")
subtraction_4 = Subtraction(A=panel_4, B=distancia_minima_al_borde_4)
division = Division(A=subtraction, B=paso_maquinas)
division_2 = Division(A=subtraction_2, B=paso_maquinas_2)
division_3 = Division(A=subtraction_3, B=paso_maquinas_3)
division_4 = Division(A=subtraction_4, B=paso_maquinas_4)
panel_5 = Panel(division)
panel_6 = Panel(division_2)
panel_7 = Panel(division_3)
panel_8 = Panel(division_4)
round = Round(Number=panel_5)  # -> Nearest, Floor, Ceiling
round_2 = Round(Number=panel_6)  # -> Nearest, Floor, Ceiling
round_3 = Round(Number=panel_7)  # -> Nearest, Floor, Ceiling
round_4 = Round(Number=panel_8)  # -> Nearest, Floor, Ceiling
panel_9 = Panel(round.Floor)
panel_10 = Panel(round_2.Floor)
panel_11 = Panel(round_3.Floor)
panel_12 = Panel(round_4.Floor)
multiplication = Multiplication(A=panel_9, B=paso_maquinas)
multiplication_2 = Multiplication(A=panel_10, B=paso_maquinas_2)
multiplication_3 = Multiplication(A=panel_11, B=paso_maquinas_3)
multiplication_4 = Multiplication(A=panel_12, B=paso_maquinas_4)
unit_y = UnitY(Factor=multiplication)
unit_y_2 = UnitY(Factor=multiplication_2)
unit_y_3 = UnitY(Factor=multiplication_3)
unit_y_4 = UnitY(Factor=multiplication_4)
negative = Negative(Value=paso_maquinas_2)
negative_2 = Negative(Value=paso_maquinas_3)
move = Move(Geometry=area.Centroid, Motion=unit_y)  # -> Geometry, Transform
negative_3 = Negative(Value=paso_maquinas_4)
move_2 = Move(Geometry=area_2.Centroid, Motion=unit_y_2)  # -> Geometry, Transform
move_3 = Move(Geometry=area_3.Centroid, Motion=unit_y_3)  # -> Geometry, Transform
move_4 = Move(Geometry=area_4.Centroid, Motion=unit_y_4)  # -> Geometry, Transform
unit_y_5 = UnitY(Factor=negative)
unit_y_6 = UnitY(Factor=negative_2)
unit_y_7 = UnitY(Factor=negative_3)
xy_plane = XYPlane(Origin=move.Geometry)
move_5 = Move(Geometry=move_2.Geometry, Motion=unit_y_5)  # -> Geometry, Transform
xy_plane_2 = XYPlane(Origin=move_2.Geometry)
move_6 = Move(Geometry=move_3.Geometry, Motion=unit_y_6)  # -> Geometry, Transform
xy_plane_3 = XYPlane(Origin=move_3.Geometry)
xy_plane_4 = XYPlane(Origin=move.Geometry)
move_7 = Move(Geometry=move_4.Geometry, Motion=unit_y_7)  # -> Geometry, Transform
unit_z = UnitZ(Factor="22")
xy_plane_5 = XYPlane(Origin=move_4.Geometry)
cylinder = Cylinder(Base=xy_plane, Radius="2.5", Length="10")
unit_z_2 = UnitZ(Factor="22")
cylinder_2 = Cylinder(Base=xy_plane_2, Radius="3", Length="-15")
move_8 = Move(Geometry=move_5.Geometry, Motion=unit_z)  # -> Geometry, Transform
cylinder_3 = Cylinder(Base=xy_plane_3, Radius="3", Length="15")
xy_plane_6 = XYPlane(Origin=move.Geometry)
unit_z_3 = UnitZ(Factor="10")
cap_holes = CapHoles(Brep=cylinder)
cylinder_4 = Cylinder(Base=xy_plane_5, Radius="3", Length="-15")
move_9 = Move(Geometry=move_7.Geometry, Motion=unit_z_2)  # -> Geometry, Transform
cylinder_5 = Cylinder(Base=xy_plane_6, Radius="3.5", Length="-22")
move_10 = Move(Geometry=move_6.Geometry, Motion=unit_z_3)  # -> Geometry, Transform
xy_plane_7 = XYPlane(Origin=move_8.Geometry)
cylinder_6 = Cylinder(Base=xy_plane_2, Radius="1.5", Length="20")
cylinder_7 = Cylinder(Base=xy_plane_3, Radius="1.5", Length="-20")
cap_holes_2 = CapHoles(Brep=cylinder_2)
xy_plane_8 = XYPlane(Origin=move_9.Geometry)
cap_holes_3 = CapHoles(Brep=cylinder_3)
cylinder_8 = Cylinder(Base=xy_plane_5, Radius="1.5", Length="20")
cap_holes_4 = CapHoles(Brep=cylinder_5)
cap_holes_5 = CapHoles(Brep=cylinder_4)
xy_plane_9 = XYPlane(Origin=move_10.Geometry)
cylinder_9 = Cylinder(Base=xy_plane_7, Radius="4", Length="-32")
cap_holes_6 = CapHoles(Brep=cylinder_6)
deconstruct_brep_5 = DeconstructBrep(Brep=cap_holes_3)  # -> Faces, Edges, Vertices
cap_holes_7 = CapHoles(Brep=cylinder_7)
cylinder_10 = Cylinder(Base=xy_plane_8, Radius="4", Length="-32")
deconstruct_brep_6 = DeconstructBrep(Brep=cap_holes_4)  # -> Faces, Edges, Vertices
cap_holes_8 = CapHoles(Brep=cylinder_8)
solid_union = SolidUnion(Breps=[cap_holes_2, cap_holes_6])
cylinder_11 = Cylinder(Base=xy_plane_9, Radius="4", Length="-32")
cap_holes_9 = CapHoles(Brep=cylinder_9)
solid_union_2 = SolidUnion(Breps=[cap_holes_3, cap_holes_7])
cap_holes_10 = CapHoles(Brep=cylinder_10)
list_item_9 = ListItem(List=deconstruct_brep_5.Faces, Index="2", Wrap=True)
list_item_10 = ListItem(List=deconstruct_brep_6.Faces, Index="4", Wrap=True)
deconstruct_brep_7 = DeconstructBrep(Brep=cap_holes_9)  # -> Faces, Edges, Vertices
deconstruct_brep_8 = DeconstructBrep(Brep=cap_holes_2)  # -> Faces, Edges, Vertices
cap_holes_11 = CapHoles(Brep=cylinder_11)
deconstruct_brep_9 = DeconstructBrep(Brep=cap_holes_6)  # -> Faces, Edges, Vertices
solid_union_3 = SolidUnion(Breps=cap_holes_9)
deconstruct_brep_10 = DeconstructBrep(Brep=cap_holes_10)  # -> Faces, Edges, Vertices
deconstruct_brep_11 = DeconstructBrep(Brep=cap_holes_5)  # -> Faces, Edges, Vertices
area_5 = Area(Geometry=list_item_9)  # -> Area, Centroid
area_6 = Area(Geometry=list_item_10)  # -> Area, Centroid
solid_union_4 = SolidUnion(Breps=cap_holes_10)
solid_union_5 = SolidUnion(Breps=[solid_union_2, cap_holes_11])
unit_z_4 = UnitZ(Factor="-2")
list_item_11 = ListItem(List=deconstruct_brep_7.Faces, Index="1", Wrap=True)
list_item_12 = ListItem(List=deconstruct_brep_8.Faces, Index="1", Wrap=True)
list_item_13 = ListItem(List=deconstruct_brep_10.Faces, Index="1", Wrap=True)
list_item_14 = ListItem(List=deconstruct_brep_9.Faces, Index="2", Wrap=True)
deconstruct_brep_12 = DeconstructBrep(Brep=cap_holes_11)  # -> Faces, Edges, Vertices
list_item_15 = ListItem(List=deconstruct_brep_11.Faces, Index="1", Wrap=True)
move_11 = Move(Geometry=area_6.Centroid, Motion=unit_z_4)  # -> Geometry, Transform
mirror = Mirror(Geometry=solid_union_5, Plane=xz_plane_3)  # -> Geometry, Transform
area_7 = Area(Geometry=list_item_11)  # -> Area, Centroid
area_8 = Area(Geometry=list_item_14)  # -> Area, Centroid
area_9 = Area(Geometry=list_item_12)  # -> Area, Centroid
unit_x = UnitX(Factor="-4")
unit_x_2 = UnitX(Factor="-4")
area_10 = Area(Geometry=list_item_13)  # -> Area, Centroid
area_11 = Area(Geometry=list_item_15)  # -> Area, Centroid
relay = ClusterInput()
relay_2 = ClusterInput()
list_item_16 = ListItem(List=deconstruct_brep_12.Faces, Index="2", Wrap=True)
move_12 = Move(Geometry=move_11.Geometry, Motion=unit_x_2)  # -> Geometry, Transform
solid_union_6 = SolidUnion(Breps=[mirror.Geometry, solid_union_5])
area_12 = Area(Geometry=list_item_16)  # -> Area, Centroid
move_13 = Move(Geometry=area_8.Centroid, Motion=unit_x)  # -> Geometry, Transform
solid_union_7 = SolidUnion(Breps=[cap_holes_5, cap_holes_8])
yz_plane = YZPlane(Origin=move_12.Geometry)
yz_plane_2 = YZPlane(Origin=move_13.Geometry)
cylinder_12 = Cylinder(Base=yz_plane, Radius="7.5", Length="12")
cylinder_13 = Cylinder(Base=yz_plane_2, Radius="6", Length="11.5")
cap_holes_12 = CapHoles(Brep=cylinder_12)
solid_union_8 = SolidUnion(Breps=[solid_union_7, solid_union_4])
solid_union_9 = SolidUnion(Breps=[cap_holes_12, cap_holes_4, cap_holes])
cap_holes_13 = CapHoles(Brep=cylinder_13)
deconstruct_brep_13 = DeconstructBrep(Brep=cap_holes_13)  # -> Faces, Edges, Vertices
rotate_3d = Rotate3D(Geometry=solid_union_9, Angle=degrees("180"), Center=xy_plane_6, Axis=Vector(0, 0, 1))  # -> Geometry, Transform
solid_union_10 = SolidUnion(Breps=[cap_holes_13, cap_holes_2, cap_holes_6])
list_item_17 = ListItem(List=deconstruct_brep_13.Faces, Index="1", Wrap=True)
mirror_2 = Mirror(Geometry=solid_union_8, Plane=xz_plane_4)  # -> Geometry, Transform
rotate_3d_2 = Rotate3D(Geometry=solid_union_10, Angle=degrees("180"), Center=move_2.Geometry, Axis=Vector(0, 0, 1))  # -> Geometry, Transform
stream_filter = StreamFilter(GirarMaquinadoPerno=relay_2, Stream0=solid_union_9, Stream1=rotate_3d.Geometry)
area_13 = Area(Geometry=list_item_17)  # -> Area, Centroid
stream_filter_2 = StreamFilter(GirarTuercaPlastica=relay, Stream0=solid_union_10, Stream1=rotate_3d_2.Geometry)
solid_union_11 = SolidUnion(Breps=[mirror_2.Geometry, solid_union_8])
mirror_3 = Mirror(Geometry=stream_filter, Plane=xz_plane)  # -> Geometry, Transform
solid_union_12 = SolidUnion(Breps=[stream_filter, mirror_3.Geometry])
solid_union_13 = SolidUnion(Breps=[solid_union_3, stream_filter_2])
mirror_4 = Mirror(Geometry=solid_union_13, Plane=xz_plane_2)  # -> Geometry, Transform
solid_union_14 = SolidUnion(Breps=[mirror_4.Geometry, solid_union_13])
list_length = ListLength(List=[pieza, "0"])  # -> flatten(Length)
panel_13 = Panel(list_length)
dispatch = Dispatch(List=panel_13, DispatchPattern=[True, False])  # -> ListA, ListB
panel_14 = Panel(dispatch.ListB)
panel_15 = Panel(dispatch.ListA)
addition = Addition(A=panel_15, B=panel_14)
panel_16 = Panel(addition)
union_superior = ClusterInput()
union_inferior = ClusterInput()
expression = Expression(x=panel_16, Expression="if(x=\"1\",0,1)")
# Aqui se definen cuales son los herrajes superiores e inferiores
stream_filter_3 = StreamFilter(UnionSuperior=union_superior, Stream0=solid_union_6, Stream1=solid_union_12)
stream_filter_4 = StreamFilter(UnionInferior=union_inferior, Stream0=solid_union_14, Stream1=solid_union_11)
s_0 = ClusterOutput(stream_filter_4)
s_1 = ClusterOutput(stream_filter_3)
panel_17 = Panel(expression)

mesh = Mesh(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)
point = Point(Point(-380.6006041, 587.7908738, 256.8805061))

point_2 = Point(Point(-134.1035289, 107.5129007, 256.9310845))
mesh_2 = Mesh(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)
point_3 = Point(Point(-134.1035289, 107.5129007, 270.9310845))

mesh_3 = Mesh(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)
point_4 = Point(Point(-97.39304191, 111.3185558, 290.5782605))
mesh_4 = Mesh(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)

mesh_5 = Mesh(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)
point_5 = Point(Point(-135.4591294, 432, 101.6471077))

stream_filter_5 = StreamFilter(Gate=panel_17, Stream1=mesh_2)
stream_filter_6 = StreamFilter(Gate=panel_17, Stream1=mesh_5)
stream_filter_7 = StreamFilter(Gate=panel_17, Stream1=mesh_3)
stream_filter_8 = StreamFilter(Gate=panel_17, Stream1=mesh_4)
stream_filter_9 = StreamFilter(Gate=panel_17, Stream1=mesh)
stream_filter_10 = StreamFilter(Gate=panel_17, Stream1=mesh_2)
vector_2pt = Vector2Pt(PointA=point_2, PointB=move_5.Geometry, Unitize=False)  # -> Vector, Length
stream_filter_11 = StreamFilter(Gate=panel_17, Stream1=mesh)
unit_y_8 = UnitY(Factor=1)
vector_2pt_2 = Vector2Pt(PointA=point_5, PointB=area_13.Centroid, Unitize=False)  # -> Vector, Length
move_14 = Move(Geometry=stream_filter_5, Motion=vector_2pt.Vector)  # -> Geometry, Transform
vector_2pt_3 = Vector2Pt(PointA=point, PointB=area_5.Centroid, Unitize=False)  # -> Vector, Length
vector_2pt_4 = Vector2Pt(PointA=point_3, PointB=move_6.Geometry, Unitize=False)  # -> Vector, Length
vector_2pt_5 = Vector2Pt(PointA=point_4, PointB=move.Geometry, Unitize=False)  # -> Vector, Length
rotate_3d_3 = Rotate3D(Geometry=stream_filter_11, Angle=degrees("180"), Center=point, Axis=unit_y_8)  # -> Geometry, Transform
move_15 = Move(Geometry=stream_filter_6, Motion=vector_2pt_2.Vector)  # -> Geometry, Transform
vector_2pt_6 = Vector2Pt(PointA=point_4, PointB=move.Geometry, Unitize=False)  # -> Vector, Length
geometry = ClusterOutput(move_14.Geometry)
move_16 = Move(Geometry=stream_filter_9, Motion=vector_2pt_3.Vector)  # -> Geometry, Transform
move_17 = Move(Geometry=stream_filter_8, Motion=vector_2pt_5.Vector)  # -> Geometry, Transform
vector_2pt_7 = Vector2Pt(PointA=point, PointB=area_9.Centroid, Unitize=False)  # -> Vector, Length
move_18 = Move(Geometry=stream_filter_10, Motion=vector_2pt_4.Vector)  # -> Geometry, Transform
move_19 = Move(Geometry=stream_filter_7, Motion=vector_2pt_6.Vector)  # -> Geometry, Transform
mirror_5 = Mirror(Plane=xz_plane_3)  # -> TarugoInferior, Transform
rotate_3d_4 = Rotate3D(Geometry=move_15.Geometry, Angle=degrees("180"), Center=xy_plane_2, Axis=Vector(0, 0, 1))  # -> Geometry, Transform
move_20 = Move(Geometry=rotate_3d_3.Geometry, Motion=vector_2pt_7.Vector)  # -> Geometry, Transform
mirror_6 = Mirror(Geometry=move_16.Geometry, Plane=xz_plane_3)  # -> Geometry, Transform
rotate_3d_5 = Rotate3D(Geometry=move_19.Geometry, Angle=degrees("180"), Center=xy_plane_4, Axis=Vector(0, 0, 1))  # -> Geometry, Transform
mirror_7 = Mirror(Geometry=move_18.Geometry, Plane=xz_plane_3)  # -> Geometry, Transform
stream_filter_12 = StreamFilter(GirarTuercaPlastica=relay, Stream0=move_15.Geometry, Stream1=rotate_3d_4.Geometry)
mirror_8 = Mirror(Geometry=move_20.Geometry, Plane=xz_plane_3)  # -> DrywallInferior, Transform
stream_filter_13 = StreamFilter(GirarPerno=relay_2, Stream0=move_19.Geometry, Stream1=rotate_3d_5.Geometry)
mirror_9 = Mirror(Geometry=stream_filter_12, Plane=xz_plane_2)  # -> Geometry, Transform
drywall_inferior = ClusterOutput(mirror_8.DrywallInferior)
relay_3 = ClusterInput()
herrajes_inferiores = ClusterInput()
mirror_10 = Mirror(Geometry=move_17.Geometry, Plane=xz_plane)  # -> Geometry, Transform
mirror_11 = Mirror(Geometry=stream_filter_13, Plane=xz_plane)  # -> Geometry, Transform
stream_filter_14 = StreamFilter(HerrajesInferiores=herrajes_inferiores, Stream0=[stream_filter_12, mirror_9.Geometry])
s_0_2 = ClusterOutput(stream_filter_14)
stream_filter_15 = StreamFilter(Tarugo=relay_3, Stream0=[mirror_7.Geometry, move_18.Geometry])
stream_filter_16 = StreamFilter(Drywall=relay_3, Stream0=[mirror_6.Geometry, move_16.Geometry])
stream_filter_17 = StreamFilter(Perno=relay_3, Stream1=[mirror_10.Geometry, move_17.Geometry])
stream_filter_18 = StreamFilter(Gate=relay_3, Stream1=[mirror_11.Geometry, stream_filter_13])
s_1_2 = ClusterOutput(stream_filter_15)
s_1_3 = ClusterOutput(stream_filter_18)
s_1_4 = ClusterOutput(stream_filter_17)
drywall_superior = ClusterOutput(stream_filter_16)

# ==== cluster Cluster_4
pieza = ClusterInput()
# Maquinado Tarugos + Tornillo Drywall *Superior
deconstruct_brep = DeconstructBrep(Pieza=pieza)  # -> Faces, Edges, Vertices
# Maquinado Minifix + Tornillo Drywall *Superior
deconstruct_brep_2 = DeconstructBrep(Pieza=pieza)  # -> Faces, Edges, Vertices
# Maquinado Tuerca + Tornillo Drywall + Tarugo *Inferior
deconstruct_brep_3 = DeconstructBrep(Pieza=pieza)  # -> Faces, Edges, Vertices
# Maquinado Tornillo Drywall + Tarugo *Inferior
deconstruct_brep_4 = DeconstructBrep(Pieza=pieza)  # -> Faces, Edges, Vertices
list_item = ListItem(List=deconstruct_brep_2.Edges, Index="18", Wrap=True)
list_item_2 = ListItem(List=deconstruct_brep_3.Edges, Index="2", Wrap=True)
list_item_3 = ListItem(List=deconstruct_brep_2.Faces, Index="5", Wrap=True)
list_item_4 = ListItem(List=deconstruct_brep_3.Faces, Index="4", Wrap=True)
list_item_5 = ListItem(List=deconstruct_brep.Edges, Index="18", Wrap=True)
list_item_6 = ListItem(List=deconstruct_brep.Faces, Index="5", Wrap=True)
list_item_7 = ListItem(List=deconstruct_brep_4.Edges, Index="2", Wrap=True)
list_item_8 = ListItem(List=deconstruct_brep_4.Faces, Index="4", Wrap=True)
area = Area(Geometry=list_item_3)  # -> Area, Centroid
area_2 = Area(Geometry=list_item_4)  # -> Area, Centroid
curve_middle = CurveMiddle(Curve=list_item)
curve_middle_2 = CurveMiddle(Curve=list_item_2)
area_3 = Area(Geometry=list_item_6)  # -> Area, Centroid
curve_middle_3 = CurveMiddle(Curve=list_item_5)
area_4 = Area(Geometry=list_item_8)  # -> Area, Centroid
curve_middle_4 = CurveMiddle(Curve=list_item_7)
line = Line(StartPoint=area.Centroid, EndPoint=curve_middle)
line_2 = Line(StartPoint=area_2.Centroid, EndPoint=curve_middle_2)
xz_plane = XZPlane(Origin=area.Centroid)
xz_plane_2 = XZPlane(Origin=area_2.Centroid)
line_3 = Line(StartPoint=area_3.Centroid, EndPoint=curve_middle_3)
xz_plane_3 = XZPlane(Origin=area_3.Centroid)
deconstruct = Deconstruct(Point=area_3.Centroid)  # -> XComponent, YComponent, ZComponent
line_4 = Line(StartPoint=area_4.Centroid, EndPoint=curve_middle_4)
xz_plane_4 = XZPlane(Origin=area_4.Centroid)
length = Length(Curve=line)
length_2 = Length(Curve=line_2)
length_3 = Length(Curve=line_3)
length_4 = Length(Curve=line_4)
expression = Expression(x=deconstruct.XComponent, Expression="if(x>1,1,0)")
panel = Panel(length)
panel_2 = Panel(length_2)
panel_3 = Panel(length_3)
panel_4 = Panel(length_4)
panel_5 = Panel(expression)
distancia_minima_al_borde = Panel("20")
distancia_minima_al_borde_2 = Panel("20")
distancia_minima_al_borde_3 = Panel("20")
distancia_minima_al_borde_4 = Panel("20")
stream_filter = StreamFilter(Gate=panel_5)
paso_maquinas = Panel("32")
paso_maquinas_2 = Panel("32")
subtraction = Subtraction(A=panel, B=distancia_minima_al_borde)
subtraction_2 = Subtraction(A=panel_2, B=distancia_minima_al_borde_2)
paso_maquinas_3 = Panel("32")
subtraction_3 = Subtraction(A=panel_3, B=distancia_minima_al_borde_3)
paso_maquinas_4 = Panel("32")
subtraction_4 = Subtraction(A=panel_4, B=distancia_minima_al_borde_4)
division = Division(A=subtraction, B=paso_maquinas)
division_2 = Division(A=subtraction_2, B=paso_maquinas_2)
division_3 = Division(A=subtraction_3, B=paso_maquinas_3)
division_4 = Division(A=subtraction_4, B=paso_maquinas_4)
panel_6 = Panel(division)
panel_7 = Panel(division_2)
panel_8 = Panel(division_3)
panel_9 = Panel(division_4)
round = Round(Number=panel_6)  # -> Nearest, Floor, Ceiling
round_2 = Round(Number=panel_7)  # -> Nearest, Floor, Ceiling
round_3 = Round(Number=panel_8)  # -> Nearest, Floor, Ceiling
round_4 = Round(Number=panel_9)  # -> Nearest, Floor, Ceiling
panel_10 = Panel(round.Floor)
panel_11 = Panel(round_2.Floor)
panel_12 = Panel(round_3.Floor)
panel_13 = Panel(round_4.Floor)
multiplication = Multiplication(A=panel_10, B=paso_maquinas)
multiplication_2 = Multiplication(A=panel_11, B=paso_maquinas_2)
multiplication_3 = Multiplication(A=panel_12, B=paso_maquinas_3)
multiplication_4 = Multiplication(A=panel_13, B=paso_maquinas_4)
unit_y = UnitY(Factor=multiplication)
unit_y_2 = UnitY(Factor=multiplication_2)
unit_y_3 = UnitY(Factor=multiplication_3)
unit_y_4 = UnitY(Factor=multiplication_4)
negative = Negative(Value=paso_maquinas_2)
negative_2 = Negative(Value=paso_maquinas_3)
move = Move(Geometry=area.Centroid, Motion=unit_y)  # -> Geometry, Transform
negative_3 = Negative(Value=paso_maquinas_4)
move_2 = Move(Geometry=area_2.Centroid, Motion=unit_y_2)  # -> Geometry, Transform
move_3 = Move(Geometry=area_3.Centroid, Motion=unit_y_3)  # -> Geometry, Transform
move_4 = Move(Geometry=area_4.Centroid, Motion=unit_y_4)  # -> Geometry, Transform
unit_y_5 = UnitY(Factor=negative)
unit_y_6 = UnitY(Factor=negative_2)
unit_y_7 = UnitY(Factor=negative_3)
xy_plane = XYPlane(Origin=move.Geometry)
move_5 = Move(Geometry=move_2.Geometry, Motion=unit_y_5)  # -> Geometry, Transform
deconstruct_2 = Deconstruct(Point=move_5.Geometry)  # -> XComponent, YComponent, ZComponent
expression_2 = Expression(x=deconstruct_2.XComponent, Expression="if(x>1,1,0)")
xy_plane_2 = XYPlane(Origin=move_2.Geometry)
move_6 = Move(Geometry=move_3.Geometry, Motion=unit_y_6)  # -> Geometry, Transform
deconstruct_3 = Deconstruct(Point=move_6.Geometry)  # -> XComponent, YComponent, ZComponent
xy_plane_3 = XYPlane(Origin=move_3.Geometry)
xy_plane_4 = XYPlane(Origin=move.Geometry)
deconstruct_4 = Deconstruct(Point=move.Geometry)  # -> XComponent, YComponent, ZComponent
move_7 = Move(Geometry=move_4.Geometry, Motion=unit_y_7)  # -> Geometry, Transform
unit_z = UnitZ(Factor="22")
xy_plane_5 = XYPlane(Origin=move_4.Geometry)
expression_3 = Expression(x=deconstruct_3.XComponent, Expression="if(x>1,1,0)")
cylinder = Cylinder(Base=xy_plane, Radius="2.5", Length="10")
unit_z_2 = UnitZ(Factor="22")
panel_14 = Panel(expression_2)
cylinder_2 = Cylinder(Base=xy_plane_2, Radius="3", Length="-15")
move_8 = Move(Geometry=move_5.Geometry, Motion=unit_z)  # -> Geometry, Transform
cap_holes = CapHoles(Brep=cylinder)
cylinder_3 = Cylinder(Base=xy_plane_3, Radius="3", Length="15")
expression_4 = Expression(x=deconstruct_4.XComponent, Expression="if(x>1,1,0)")
xy_plane_6 = XYPlane(Origin=move.Geometry)
unit_z_3 = UnitZ(Factor="10")
cylinder_4 = Cylinder(Base=xy_plane_5, Radius="3", Length="-15")
panel_15 = Panel(expression_3)
move_9 = Move(Geometry=move_7.Geometry, Motion=unit_z_2)  # -> Geometry, Transform
stream_filter_2 = StreamFilter(Gate=panel_14, Stream1=move_5.Geometry)
cylinder_5 = Cylinder(Base=xy_plane_6, Radius="3.5", Length="-22")
move_10 = Move(Geometry=move_6.Geometry, Motion=unit_z_3)  # -> Geometry, Transform
xy_plane_7 = XYPlane(Origin=move_8.Geometry)
stream_filter_3 = StreamFilter(Gate=panel_15, Stream1=move_6.Geometry)
panel_16 = Panel(expression_4)
cylinder_6 = Cylinder(Base=xy_plane_2, Radius="1.5", Length="20")
cylinder_7 = Cylinder(Base=xy_plane_3, Radius="1.5", Length="-20")
cap_holes_2 = CapHoles(Brep=cylinder_2)
xy_plane_8 = XYPlane(Origin=move_9.Geometry)
cap_holes_3 = CapHoles(Brep=cylinder_3)
cylinder_8 = Cylinder(Base=xy_plane_5, Radius="1.5", Length="20")
cap_holes_4 = CapHoles(Brep=cylinder_5)
cap_holes_5 = CapHoles(Brep=cylinder_4)
xy_plane_9 = XYPlane(Origin=move_10.Geometry)
stream_filter_4 = StreamFilter(Gate=panel_16, Stream1=move.Geometry)
cylinder_9 = Cylinder(Base=xy_plane_7, Radius="4", Length="-32")
cap_holes_6 = CapHoles(Brep=cylinder_6)
deconstruct_brep_5 = DeconstructBrep(Brep=cap_holes_3)  # -> Faces, Edges, Vertices
cap_holes_7 = CapHoles(Brep=cylinder_7)
cylinder_10 = Cylinder(Base=xy_plane_8, Radius="4", Length="-32")
deconstruct_brep_6 = DeconstructBrep(Brep=cap_holes_4)  # -> Faces, Edges, Vertices
cap_holes_8 = CapHoles(Brep=cylinder_8)
solid_union = SolidUnion(Breps=[cap_holes_2, cap_holes_6])
cylinder_11 = Cylinder(Base=xy_plane_9, Radius="4", Length="-32")
cap_holes_9 = CapHoles(Brep=cylinder_9)
solid_union_2 = SolidUnion(Breps=[cap_holes_3, cap_holes_7])
cap_holes_10 = CapHoles(Brep=cylinder_10)
list_item_9 = ListItem(List=deconstruct_brep_5.Faces, Index="2", Wrap=True)
list_item_10 = ListItem(List=deconstruct_brep_6.Faces, Index="4", Wrap=True)
deconstruct_brep_7 = DeconstructBrep(Brep=cap_holes_9)  # -> Faces, Edges, Vertices
deconstruct_brep_8 = DeconstructBrep(Brep=cap_holes_2)  # -> Faces, Edges, Vertices
cap_holes_11 = CapHoles(Brep=cylinder_11)
deconstruct_brep_9 = DeconstructBrep(Brep=cap_holes_6)  # -> Faces, Edges, Vertices
solid_union_3 = SolidUnion(Breps=cap_holes_9)
deconstruct_brep_10 = DeconstructBrep(Brep=cap_holes_10)  # -> Faces, Edges, Vertices
deconstruct_brep_11 = DeconstructBrep(Brep=cap_holes_5)  # -> Faces, Edges, Vertices
area_5 = Area(Geometry=list_item_9)  # -> Area, Centroid
deconstruct_5 = Deconstruct(Point=area_5.Centroid)  # -> XComponent, YComponent, ZComponent
area_6 = Area(Geometry=list_item_10)  # -> Area, Centroid
solid_union_4 = SolidUnion(Breps=cap_holes_10)
solid_union_5 = SolidUnion(Breps=[solid_union_2, cap_holes_11])
unit_z_4 = UnitZ(Factor="-2")
list_item_11 = ListItem(List=deconstruct_brep_7.Faces, Index="1", Wrap=True)
list_item_12 = ListItem(List=deconstruct_brep_8.Faces, Index="1", Wrap=True)
expression_5 = Expression(x=deconstruct_5.XComponent, Expression="if(x>1,1,0)")
list_item_13 = ListItem(List=deconstruct_brep_10.Faces, Index="1", Wrap=True)
list_item_14 = ListItem(List=deconstruct_brep_9.Faces, Index="2", Wrap=True)
deconstruct_brep_12 = DeconstructBrep(Brep=cap_holes_11)  # -> Faces, Edges, Vertices
list_item_15 = ListItem(List=deconstruct_brep_11.Faces, Index="1", Wrap=True)
move_11 = Move(Geometry=area_6.Centroid, Motion=unit_z_4)  # -> Geometry, Transform
mirror = Mirror(Geometry=solid_union_5, Plane=xz_plane_3)  # -> Geometry, Transform
area_7 = Area(Geometry=list_item_11)  # -> Area, Centroid
area_8 = Area(Geometry=list_item_14)  # -> Area, Centroid
area_9 = Area(Geometry=list_item_12)  # -> Area, Centroid
unit_x = UnitX(Factor="-4")
unit_x_2 = UnitX(Factor="-4")
area_10 = Area(Geometry=list_item_13)  # -> Area, Centroid
area_11 = Area(Geometry=list_item_15)  # -> Area, Centroid
panel_17 = Panel(expression_5)
relay = ClusterInput()
relay_2 = ClusterInput()
list_item_16 = ListItem(List=deconstruct_brep_12.Faces, Index="2", Wrap=True)
stream_filter_5 = StreamFilter(Gate=panel_17, Stream1=area_5.Centroid)
move_12 = Move(Geometry=move_11.Geometry, Motion=unit_x_2)  # -> Geometry, Transform
solid_union_6 = SolidUnion(Breps=[mirror.Geometry, solid_union_5])
area_12 = Area(Geometry=list_item_16)  # -> Area, Centroid
deconstruct_6 = Deconstruct(Point=area_9.Centroid)  # -> XComponent, YComponent, ZComponent
move_13 = Move(Geometry=area_8.Centroid, Motion=unit_x)  # -> Geometry, Transform
solid_union_7 = SolidUnion(Breps=[cap_holes_5, cap_holes_8])
yz_plane = YZPlane(Origin=move_12.Geometry)
yz_plane_2 = YZPlane(Origin=move_13.Geometry)
expression_6 = Expression(x=deconstruct_6.XComponent, Expression="if(x>1,1,0)")
cylinder_12 = Cylinder(Base=yz_plane, Radius="7.5", Length="12")
cylinder_13 = Cylinder(Base=yz_plane_2, Radius="6", Length="11.5")
cap_holes_12 = CapHoles(Brep=cylinder_12)
panel_18 = Panel(expression_6)
solid_union_8 = SolidUnion(Breps=[solid_union_7, solid_union_4])
solid_union_9 = SolidUnion(Breps=[cap_holes_12, cap_holes_4, cap_holes])
cap_holes_13 = CapHoles(Brep=cylinder_13)
stream_filter_6 = StreamFilter(Gate=panel_18, Stream1=area_9.Centroid)
deconstruct_brep_13 = DeconstructBrep(Brep=cap_holes_13)  # -> Faces, Edges, Vertices
rotate_3d = Rotate3D(Geometry=solid_union_9, Angle=degrees("180"), Center=xy_plane_6, Axis=Vector(0, 0, 1))  # -> Geometry, Transform
solid_union_10 = SolidUnion(Breps=[cap_holes_13, cap_holes_2, cap_holes_6])
list_item_17 = ListItem(List=deconstruct_brep_13.Faces, Index="1", Wrap=True)
mirror_2 = Mirror(Geometry=solid_union_8, Plane=xz_plane_4)  # -> Geometry, Transform
rotate_3d_2 = Rotate3D(Geometry=solid_union_10, Angle=degrees("180"), Center=move_2.Geometry, Axis=Vector(0, 0, 1))  # -> Geometry, Transform
stream_filter_7 = StreamFilter(GirarMaquinadoPerno=relay_2, Stream0=solid_union_9, Stream1=rotate_3d.Geometry)
area_13 = Area(Geometry=list_item_17)  # -> Area, Centroid
stream_filter_8 = StreamFilter(GirarTuercaPlastica=relay, Stream0=solid_union_10, Stream1=rotate_3d_2.Geometry)
solid_union_11 = SolidUnion(Breps=[mirror_2.Geometry, solid_union_8])
mirror_3 = Mirror(Geometry=stream_filter_7, Plane=xz_plane)  # -> Geometry, Transform
deconstruct_7 = Deconstruct(Point=area_13.Centroid)  # -> XComponent, YComponent, ZComponent
solid_union_12 = SolidUnion(Breps=[stream_filter_7, mirror_3.Geometry])
solid_union_13 = SolidUnion(Breps=[solid_union_3, stream_filter_8])
expression_7 = Expression(x=deconstruct_7.XComponent, Expression="if(x>1,1,0)")
mirror_4 = Mirror(Geometry=solid_union_13, Plane=xz_plane_2)  # -> Geometry, Transform
panel_19 = Panel(expression_7)
solid_union_14 = SolidUnion(Breps=[mirror_4.Geometry, solid_union_13])
stream_filter_9 = StreamFilter(Gate=panel_19, Stream1=area_13.Centroid)
union_superior = ClusterInput()
union_inferior = ClusterInput()
# Aqui se definen cuales son los herrajes superiores e inferiores
stream_filter_10 = StreamFilter(UnionSuperior=union_superior, Stream0=solid_union_6, Stream1=solid_union_12)
stream_filter_11 = StreamFilter(UnionInferior=union_inferior, Stream0=solid_union_14, Stream1=solid_union_11)
s_0 = ClusterOutput(stream_filter_11)
s_1 = ClusterOutput(stream_filter_10)

mesh = Mesh(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)
point = Point(Point(-380.6006041, 587.7908738, 256.8805061))

point_2 = Point(Point(-134.1035289, 107.5129007, 256.9310845))
mesh_2 = Mesh(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)
point_3 = Point(Point(-134.1035289, 107.5129007, 270.9310845))

mesh_3 = Mesh(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)
point_4 = Point(Point(-97.39304191, 111.3185558, 290.5782605))
mesh_4 = Mesh(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)

mesh_5 = Mesh(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)

mesh_6 = Mesh(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)
point_5 = Point(Point(-135.4591294, 432, 101.6471077))

mesh_7 = Mesh(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)
point_6 = Point(Point(-134.1035289, 107.5129007, 256.9310845))

vector_2pt = Vector2Pt(PointA=point_6, PointB=stream_filter_2, Unitize=False)  # -> Vector, Length
vector_2pt_2 = Vector2Pt(PointA=point, PointB=stream_filter_5, Unitize=False)  # -> Vector, Length
vector_2pt_3 = Vector2Pt(PointA=point_5, PointB=stream_filter_9, Unitize=False)  # -> Vector, Length
move_14 = Move(Geometry=mesh_7, Motion=vector_2pt.Vector)  # -> Geometry, Transform
vector_2pt_4 = Vector2Pt(PointA=point_4, PointB=stream_filter_4, Unitize=False)  # -> Vector, Length
vector_2pt_5 = Vector2Pt(PointA=point_4, PointB=stream_filter_4, Unitize=False)  # -> Vector, Length
vector_2pt_6 = Vector2Pt(PointA=point_3, PointB=stream_filter_3, Unitize=False)  # -> Vector, Length
move_15 = Move(Geometry=mesh, Motion=vector_2pt_2.Vector)  # -> Geometry, Transform
move_16 = Move(Geometry=mesh_6, Motion=vector_2pt_3.Vector)  # -> Geometry, Transform
move_17 = Move(Geometry=mesh_4, Motion=vector_2pt_4.Vector)  # -> Geometry, Transform
move_18 = Move(Geometry=mesh_3, Motion=vector_2pt_5.Vector)  # -> Geometry, Transform
move_19 = Move(Geometry=mesh_2, Motion=vector_2pt_6.Vector)  # -> Geometry, Transform
vector_2pt_7 = Vector2Pt(PointA=point, PointB=stream_filter_6, Unitize=False)  # -> Vector, Length
mirror_5 = Mirror(Geometry=move_14.Geometry, Plane=xz_plane_3)  # -> TarugoInferior, Transform
rotate_3d_3 = Rotate3D(Geometry=move_16.Geometry, Angle=degrees("180"), Center=xy_plane_2, Axis=Vector(0, 0, 1))  # -> Geometry, Transform
mirror_6 = Mirror(Geometry=move_15.Geometry, Plane=xz_plane_3)  # -> Geometry, Transform
rotate_3d_4 = Rotate3D(Geometry=move_18.Geometry, Angle=degrees("180"), Center=xy_plane_4, Axis=Vector(0, 0, 1))  # -> Geometry, Transform
move_20 = Move(Geometry=mesh_5, Motion=vector_2pt_7.Vector)  # -> Geometry, Transform
stream_filter_12 = StreamFilter(GirarTuercaPlastica=relay, Stream0=move_16.Geometry, Stream1=rotate_3d_3.Geometry)
mirror_7 = Mirror(Geometry=move_19.Geometry, Plane=xz_plane_3)  # -> Geometry, Transform
mirror_8 = Mirror(Geometry=move_20.Geometry, Plane=xz_plane_3)  # -> DrywallInferior, Transform
stream_filter_13 = StreamFilter(GirarPerno=relay_2, Stream0=move_18.Geometry, Stream1=rotate_3d_4.Geometry)
tarugo_inferior = Relay([move_14.Geometry, mirror_5.TarugoInferior])
mirror_9 = Mirror(Geometry=stream_filter_12, Plane=xz_plane_2)  # -> Geometry, Transform
relay_3 = ClusterInput()
tarugo_inferior_2 = ClusterOutput(tarugo_inferior)
herrajes_inferiores = ClusterInput()
mirror_10 = Mirror(Geometry=move_17.Geometry, Plane=xz_plane)  # -> Geometry, Transform
mirror_11 = Mirror(Geometry=stream_filter_13, Plane=xz_plane)  # -> Geometry, Transform
stream_filter_14 = StreamFilter(HerrajesInferiores=herrajes_inferiores, Stream0=[stream_filter_12, mirror_9.Geometry])
drywall_inferior = Relay([move_20.Geometry, mirror_8.DrywallInferior])
drywall_inferior_2 = ClusterOutput(drywall_inferior)
stream_filter_15 = StreamFilter(Drywall=relay_3, Stream0=[mirror_6.Geometry, move_15.Geometry])
tuerca = ClusterOutput(stream_filter_14)
stream_filter_16 = StreamFilter(Tarugo=relay_3, Stream0=[mirror_7.Geometry, move_19.Geometry])
stream_filter_17 = StreamFilter(Perno=relay_3, Stream1=[mirror_10.Geometry, move_17.Geometry])
stream_filter_18 = StreamFilter(Gate=relay_3, Stream1=[mirror_11.Geometry, stream_filter_13])
perno = ClusterOutput(stream_filter_17)
caja = ClusterOutput(stream_filter_18)
tarugo = ClusterOutput(stream_filter_16)
drywall_superior = ClusterOutput(stream_filter_15)

# ==== cluster Cluster_5
pieza = ClusterInput()
# Maquinado Minifix + Tornillo Drywall *Superior
deconstruct_brep = DeconstructBrep(Pieza=pieza)  # -> Faces, Edges, Vertices
# Maquinado Tuerca + Tornillo Drywall + Tarugo *Inferior
deconstruct_brep_2 = DeconstructBrep(Pieza=pieza)  # -> Faces, Edges, Vertices
# Maquinado Tarugos + Tornillo Drywall *Superior
deconstruct_brep_3 = DeconstructBrep(Pieza=pieza)  # -> Faces, Edges, Vertices
# Maquinado Tornillo Drywall + Tarugo *Inferior
deconstruct_brep_4 = DeconstructBrep(Pieza=pieza)  # -> Faces, Edges, Vertices
list_item = ListItem(List=deconstruct_brep.Edges, Index="18", Wrap=True)
list_item_2 = ListItem(List=deconstruct_brep_2.Edges, Index="2", Wrap=True)
list_item_3 = ListItem(List=deconstruct_brep.Faces, Index="5", Wrap=True)
list_item_4 = ListItem(List=deconstruct_brep_2.Faces, Index="4", Wrap=True)
list_item_5 = ListItem(List=deconstruct_brep_3.Edges, Index="18", Wrap=True)
list_item_6 = ListItem(List=deconstruct_brep_3.Faces, Index="5", Wrap=True)
list_item_7 = ListItem(List=deconstruct_brep_4.Edges, Index="2", Wrap=True)
list_item_8 = ListItem(List=deconstruct_brep_4.Faces, Index="4", Wrap=True)
area = Area(Geometry=list_item_3)  # -> Area, Centroid
area_2 = Area(Geometry=list_item_4)  # -> Area, Centroid
curve_middle = CurveMiddle(Curve=list_item)
curve_middle_2 = CurveMiddle(Curve=list_item_2)
area_3 = Area(Geometry=list_item_6)  # -> Area, Centroid
curve_middle_3 = CurveMiddle(Curve=list_item_5)
area_4 = Area(Geometry=list_item_8)  # -> Area, Centroid
curve_middle_4 = CurveMiddle(Curve=list_item_7)
line = Line(StartPoint=area.Centroid, EndPoint=curve_middle)
line_2 = Line(StartPoint=area_2.Centroid, EndPoint=curve_middle_2)
xz_plane = XZPlane(Origin=area.Centroid)
xz_plane_2 = XZPlane(Origin=area_2.Centroid)
line_3 = Line(StartPoint=area_3.Centroid, EndPoint=curve_middle_3)
xz_plane_3 = XZPlane(Origin=area_3.Centroid)
line_4 = Line(StartPoint=area_4.Centroid, EndPoint=curve_middle_4)
xz_plane_4 = XZPlane(Origin=area_4.Centroid)
length = Length(Curve=line)
length_2 = Length(Curve=line_2)
length_3 = Length(Curve=line_3)
length_4 = Length(Curve=line_4)
panel = Panel(length)
panel_2 = Panel(length_2)
panel_3 = Panel(length_3)
panel_4 = Panel(length_4)
distancia_minima_al_borde = Panel("20")
distancia_minima_al_borde_2 = Panel("20")
distancia_minima_al_borde_3 = Panel("20")
distancia_minima_al_borde_4 = Panel("20")
paso_maquinas = Panel("32")
paso_maquinas_2 = Panel("32")
subtraction = Subtraction(A=panel, B=distancia_minima_al_borde)
subtraction_2 = Subtraction(A=panel_2, B=distancia_minima_al_borde_2)
paso_maquinas_3 = Panel("32")
subtraction_3 = Subtraction(A=panel_3, B=distancia_minima_al_borde_3)
paso_maquinas_4 = Panel("32")
subtraction_4 = Subtraction(A=panel_4, B=distancia_minima_al_borde_4)
division = Division(A=subtraction, B=paso_maquinas)
division_2 = Division(A=subtraction_2, B=paso_maquinas_2)
division_3 = Division(A=subtraction_3, B=paso_maquinas_3)
division_4 = Division(A=subtraction_4, B=paso_maquinas_4)
panel_5 = Panel(division)
panel_6 = Panel(division_2)
panel_7 = Panel(division_3)
panel_8 = Panel(division_4)
round = Round(Number=panel_5)  # -> Nearest, Floor, Ceiling
round_2 = Round(Number=panel_6)  # -> Nearest, Floor, Ceiling
round_3 = Round(Number=panel_7)  # -> Nearest, Floor, Ceiling
round_4 = Round(Number=panel_8)  # -> Nearest, Floor, Ceiling
panel_9 = Panel(round.Floor)
panel_10 = Panel(round_2.Floor)
panel_11 = Panel(round_3.Floor)
panel_12 = Panel(round_4.Floor)
multiplication = Multiplication(A=panel_9, B=paso_maquinas)
multiplication_2 = Multiplication(A=panel_10, B=paso_maquinas_2)
multiplication_3 = Multiplication(A=panel_11, B=paso_maquinas_3)
multiplication_4 = Multiplication(A=panel_12, B=paso_maquinas_4)
unit_y = UnitY(Factor=multiplication)
unit_y_2 = UnitY(Factor=multiplication_2)
unit_y_3 = UnitY(Factor=multiplication_3)
unit_y_4 = UnitY(Factor=multiplication_4)
negative = Negative(Value=paso_maquinas_2)
negative_2 = Negative(Value=paso_maquinas_3)
move = Move(Geometry=area.Centroid, Motion=unit_y)  # -> Geometry, Transform
negative_3 = Negative(Value=paso_maquinas_4)
move_2 = Move(Geometry=area_2.Centroid, Motion=unit_y_2)  # -> Geometry, Transform
move_3 = Move(Geometry=area_3.Centroid, Motion=unit_y_3)  # -> Geometry, Transform
move_4 = Move(Geometry=area_4.Centroid, Motion=unit_y_4)  # -> Geometry, Transform
unit_y_5 = UnitY(Factor=negative)
unit_y_6 = UnitY(Factor=negative_2)
unit_y_7 = UnitY(Factor=negative_3)
xy_plane = XYPlane(Origin=move.Geometry)
move_5 = Move(Geometry=move_2.Geometry, Motion=unit_y_5)  # -> Geometry, Transform
xy_plane_2 = XYPlane(Origin=move_2.Geometry)
move_6 = Move(Geometry=move_3.Geometry, Motion=unit_y_6)  # -> Geometry, Transform
xy_plane_3 = XYPlane(Origin=move_3.Geometry)
xy_plane_4 = XYPlane(Origin=move.Geometry)
move_7 = Move(Geometry=move_4.Geometry, Motion=unit_y_7)  # -> Geometry, Transform
unit_z = UnitZ(Factor="22")
xy_plane_5 = XYPlane(Origin=move_4.Geometry)
unit_z_2 = UnitZ(Factor="22")
cylinder = Cylinder(Base=xy_plane, Radius="2.5", Length="10")
cylinder_2 = Cylinder(Base=xy_plane_2, Radius="3", Length="-15")
move_8 = Move(Geometry=move_5.Geometry, Motion=unit_z)  # -> Geometry, Transform
cylinder_3 = Cylinder(Base=xy_plane_3, Radius="3", Length="15")
xy_plane_6 = XYPlane(Origin=move.Geometry)
unit_z_3 = UnitZ(Factor="10")
cap_holes = CapHoles(Brep=cylinder)
cylinder_4 = Cylinder(Base=xy_plane_5, Radius="3", Length="-15")
move_9 = Move(Geometry=move_7.Geometry, Motion=unit_z_2)  # -> Geometry, Transform
cylinder_5 = Cylinder(Base=xy_plane_6, Radius="3.5", Length="-22")
move_10 = Move(Geometry=move_6.Geometry, Motion=unit_z_3)  # -> Geometry, Transform
xy_plane_7 = XYPlane(Origin=move_8.Geometry)
cylinder_6 = Cylinder(Base=xy_plane_2, Radius="1.5", Length="20")
cylinder_7 = Cylinder(Base=xy_plane_3, Radius="1.5", Length="-20")
cap_holes_2 = CapHoles(Brep=cylinder_2)
xy_plane_8 = XYPlane(Origin=move_9.Geometry)
cap_holes_3 = CapHoles(Brep=cylinder_3)
cylinder_8 = Cylinder(Base=xy_plane_5, Radius="1.5", Length="20")
cap_holes_4 = CapHoles(Brep=cylinder_5)
cap_holes_5 = CapHoles(Brep=cylinder_4)
xy_plane_9 = XYPlane(Origin=move_10.Geometry)
cylinder_9 = Cylinder(Base=xy_plane_7, Radius="4", Length="-32")
cap_holes_6 = CapHoles(Brep=cylinder_6)
deconstruct_brep_5 = DeconstructBrep(Brep=cap_holes_3)  # -> Faces, Edges, Vertices
cap_holes_7 = CapHoles(Brep=cylinder_7)
cylinder_10 = Cylinder(Base=xy_plane_8, Radius="4", Length="-32")
deconstruct_brep_6 = DeconstructBrep(Brep=cap_holes_4)  # -> Faces, Edges, Vertices
cap_holes_8 = CapHoles(Brep=cylinder_8)
solid_union = SolidUnion(Breps=[cap_holes_2, cap_holes_6])
cylinder_11 = Cylinder(Base=xy_plane_9, Radius="4", Length="-32")
cap_holes_9 = CapHoles(Brep=cylinder_9)
solid_union_2 = SolidUnion(Breps=[cap_holes_3, cap_holes_7])
cap_holes_10 = CapHoles(Brep=cylinder_10)
list_item_9 = ListItem(List=deconstruct_brep_5.Faces, Index="2", Wrap=True)
list_item_10 = ListItem(List=deconstruct_brep_6.Faces, Index="4", Wrap=True)
deconstruct_brep_7 = DeconstructBrep(Brep=cap_holes_9)  # -> Faces, Edges, Vertices
deconstruct_brep_8 = DeconstructBrep(Brep=cap_holes_2)  # -> Faces, Edges, Vertices
cap_holes_11 = CapHoles(Brep=cylinder_11)
deconstruct_brep_9 = DeconstructBrep(Brep=cap_holes_6)  # -> Faces, Edges, Vertices
solid_union_3 = SolidUnion(Breps=cap_holes_9)
deconstruct_brep_10 = DeconstructBrep(Brep=cap_holes_10)  # -> Faces, Edges, Vertices
deconstruct_brep_11 = DeconstructBrep(Brep=cap_holes_5)  # -> Faces, Edges, Vertices
area_5 = Area(Geometry=list_item_9)  # -> Area, Centroid
area_6 = Area(Geometry=list_item_10)  # -> Area, Centroid
solid_union_4 = SolidUnion(Breps=cap_holes_10)
solid_union_5 = SolidUnion(Breps=[solid_union_2, cap_holes_11])
unit_z_4 = UnitZ(Factor="-2")
list_item_11 = ListItem(List=deconstruct_brep_7.Faces, Index="1", Wrap=True)
list_item_12 = ListItem(List=deconstruct_brep_8.Faces, Index="1", Wrap=True)
list_item_13 = ListItem(List=deconstruct_brep_10.Faces, Index="1", Wrap=True)
list_item_14 = ListItem(List=deconstruct_brep_9.Faces, Index="2", Wrap=True)
deconstruct_brep_12 = DeconstructBrep(Brep=cap_holes_11)  # -> Faces, Edges, Vertices
list_item_15 = ListItem(List=deconstruct_brep_11.Faces, Index="1", Wrap=True)
move_11 = Move(Geometry=area_6.Centroid, Motion=unit_z_4)  # -> Geometry, Transform
mirror = Mirror(Geometry=solid_union_5, Plane=xz_plane_3)  # -> Geometry, Transform
area_7 = Area(Geometry=list_item_11)  # -> Area, Centroid
area_8 = Area(Geometry=list_item_14)  # -> Area, Centroid
area_9 = Area(Geometry=list_item_12)  # -> Area, Centroid
unit_x = UnitX(Factor="-4")
unit_x_2 = UnitX(Factor="-4")
area_10 = Area(Geometry=list_item_13)  # -> Area, Centroid
area_11 = Area(Geometry=list_item_15)  # -> Area, Centroid
relay = ClusterInput()
relay_2 = ClusterInput()
list_item_16 = ListItem(List=deconstruct_brep_12.Faces, Index="2", Wrap=True)
move_12 = Move(Geometry=move_11.Geometry, Motion=unit_x_2)  # -> Geometry, Transform
solid_union_6 = SolidUnion(Breps=[mirror.Geometry, solid_union_5])
area_12 = Area(Geometry=list_item_16)  # -> Area, Centroid
move_13 = Move(Geometry=area_8.Centroid, Motion=unit_x)  # -> Geometry, Transform
solid_union_7 = SolidUnion(Breps=[cap_holes_5, cap_holes_8])
yz_plane = YZPlane(Origin=move_12.Geometry)
yz_plane_2 = YZPlane(Origin=move_13.Geometry)
cylinder_12 = Cylinder(Base=yz_plane, Radius="7.5", Length="12")
cylinder_13 = Cylinder(Base=yz_plane_2, Radius="6", Length="11.5")
cap_holes_12 = CapHoles(Brep=cylinder_12)
solid_union_8 = SolidUnion(Breps=[solid_union_7, solid_union_4])
solid_union_9 = SolidUnion(Breps=[cap_holes_12, cap_holes_4, cap_holes])
cap_holes_13 = CapHoles(Brep=cylinder_13)
deconstruct_brep_13 = DeconstructBrep(Brep=cap_holes_13)  # -> Faces, Edges, Vertices
rotate_3d = Rotate3D(Geometry=solid_union_9, Angle=degrees("180"), Center=xy_plane_6, Axis=Vector(0, 0, 1))  # -> Geometry, Transform
solid_union_10 = SolidUnion(Breps=[cap_holes_13, cap_holes_2, cap_holes_6])
list_item_17 = ListItem(List=deconstruct_brep_13.Faces, Index="1", Wrap=True)
mirror_2 = Mirror(Geometry=solid_union_8, Plane=xz_plane_4)  # -> Geometry, Transform
rotate_3d_2 = Rotate3D(Geometry=solid_union_10, Angle=degrees("180"), Center=move_2.Geometry, Axis=Vector(0, 0, 1))  # -> Geometry, Transform
stream_filter = StreamFilter(GirarMaquinadoPerno=relay_2, Stream0=solid_union_9, Stream1=rotate_3d.Geometry)
area_13 = Area(Geometry=list_item_17)  # -> Area, Centroid
stream_filter_2 = StreamFilter(GirarTuercaPlastica=relay, Stream0=solid_union_10, Stream1=rotate_3d_2.Geometry)
solid_union_11 = SolidUnion(Breps=[mirror_2.Geometry, solid_union_8])
mirror_3 = Mirror(Geometry=stream_filter, Plane=xz_plane)  # -> Geometry, Transform
solid_union_12 = SolidUnion(Breps=[stream_filter, mirror_3.Geometry])
solid_union_13 = SolidUnion(Breps=[solid_union_3, stream_filter_2])
mirror_4 = Mirror(Geometry=solid_union_13, Plane=xz_plane_2)  # -> Geometry, Transform
solid_union_14 = SolidUnion(Breps=[mirror_4.Geometry, solid_union_13])
list_length = ListLength(List=[pieza, "0"])  # -> flatten(Length)
panel_13 = Panel(list_length)
dispatch = Dispatch(List=panel_13, DispatchPattern=[True, False])  # -> ListA, ListB
panel_14 = Panel(dispatch.ListB)
panel_15 = Panel(dispatch.ListA)
addition = Addition(A=panel_15, B=panel_14)
panel_16 = Panel(addition)
union_superior = ClusterInput()
union_inferior = ClusterInput()
expression = Expression(x=panel_16, Expression="if(x=\"1\",0,1)")
# Aqui se definen cuales son los herrajes superiores e inferiores
stream_filter_3 = StreamFilter(UnionSuperior=union_superior, Stream0=solid_union_6, Stream1=solid_union_12)
stream_filter_4 = StreamFilter(UnionInferior=union_inferior, Stream0=solid_union_14, Stream1=solid_union_11)
s_0 = ClusterOutput(stream_filter_4)
s_1 = ClusterOutput(stream_filter_3)
panel_17 = Panel(expression)

mesh = Mesh(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)
point = Point(Point(-380.6006041, 587.7908738, 256.8805061))

point_2 = Point(Point(-134.1035289, 107.5129007, 256.9310845))
mesh_2 = Mesh(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)
point_3 = Point(Point(-134.1035289, 107.5129007, 270.9310845))

mesh_3 = Mesh(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)
point_4 = Point(Point(-97.39304191, 111.3185558, 290.5782605))
mesh_4 = Mesh(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)

mesh_5 = Mesh(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)
point_5 = Point(Point(-135.4591294, 432, 101.6471077))

stream_filter_5 = StreamFilter(Gate=panel_17, Stream1=mesh_2)
stream_filter_6 = StreamFilter(Gate=panel_17, Stream1=mesh_5)
stream_filter_7 = StreamFilter(Gate=panel_17, Stream1=mesh_3)
stream_filter_8 = StreamFilter(Gate=panel_17, Stream1=mesh_4)
stream_filter_9 = StreamFilter(Gate=panel_17, Stream1=mesh)
stream_filter_10 = StreamFilter(Gate=panel_17, Stream1=mesh_2)
vector_2pt = Vector2Pt(PointA=point_2, PointB=move_5.Geometry, Unitize=False)  # -> Vector, Length
stream_filter_11 = StreamFilter(Gate=panel_17, Stream1=mesh)
unit_y_8 = UnitY(Factor=1)
move_14 = Move(Geometry=stream_filter_5, Motion=vector_2pt.Vector)  # -> Geometry, Transform
vector_2pt_2 = Vector2Pt(PointA=point_5, PointB=area_13.Centroid, Unitize=False)  # -> Vector, Length
vector_2pt_3 = Vector2Pt(PointA=point, PointB=area_5.Centroid, Unitize=False)  # -> Vector, Length
vector_2pt_4 = Vector2Pt(PointA=point_4, PointB=move.Geometry, Unitize=False)  # -> Vector, Length
vector_2pt_5 = Vector2Pt(PointA=point_4, PointB=move.Geometry, Unitize=False)  # -> Vector, Length
vector_2pt_6 = Vector2Pt(PointA=point_3, PointB=move_6.Geometry, Unitize=False)  # -> Vector, Length
rotate_3d_3 = Rotate3D(Geometry=stream_filter_11, Angle=degrees("180"), Center=point, Axis=unit_y_8)  # -> Geometry, Transform
geometry = ClusterOutput(move_14.Geometry)
move_15 = Move(Geometry=stream_filter_9, Motion=vector_2pt_3.Vector)  # -> Geometry, Transform
move_16 = Move(Geometry=stream_filter_8, Motion=vector_2pt_4.Vector)  # -> Geometry, Transform
move_17 = Move(Geometry=stream_filter_6, Motion=vector_2pt_2.Vector)  # -> Geometry, Transform
vector_2pt_7 = Vector2Pt(PointA=point, PointB=area_9.Centroid, Unitize=False)  # -> Vector, Length
move_18 = Move(Geometry=stream_filter_10, Motion=vector_2pt_6.Vector)  # -> Geometry, Transform
move_19 = Move(Geometry=stream_filter_7, Motion=vector_2pt_5.Vector)  # -> Geometry, Transform
mirror_5 = Mirror(Geometry=move_14.Geometry, Plane=xz_plane_3)  # -> TarugoInferior, Transform
rotate_3d_4 = Rotate3D(Geometry=move_17.Geometry, Angle=degrees("180"), Center=xy_plane_2, Axis=Vector(0, 0, 1))  # -> Geometry, Transform
move_20 = Move(Geometry=rotate_3d_3.Geometry, Motion=vector_2pt_7.Vector)  # -> Geometry, Transform
mirror_6 = Mirror(Geometry=move_15.Geometry, Plane=xz_plane_3)  # -> Geometry, Transform
rotate_3d_5 = Rotate3D(Geometry=move_19.Geometry, Angle=degrees("180"), Center=xy_plane_4, Axis=Vector(0, 0, 1))  # -> Geometry, Transform
mirror_7 = Mirror(Geometry=move_18.Geometry, Plane=xz_plane_3)  # -> Geometry, Transform
stream_filter_12 = StreamFilter(GirarTuercaPlastica=relay, Stream0=move_17.Geometry, Stream1=rotate_3d_4.Geometry)
mirror_8 = Mirror(Geometry=move_20.Geometry, Plane=xz_plane_3)  # -> DrywallInferior, Transform
stream_filter_13 = StreamFilter(GirarPerno=relay_2, Stream0=move_19.Geometry, Stream1=rotate_3d_5.Geometry)
mirror_9 = Mirror(Geometry=stream_filter_12, Plane=xz_plane_2)  # -> Geometry, Transform
drywall_inferior = ClusterOutput(mirror_8.DrywallInferior)
relay_3 = ClusterInput()
herrajes_inferiores = ClusterInput()
mirror_10 = Mirror(Geometry=move_16.Geometry, Plane=xz_plane)  # -> Geometry, Transform
mirror_11 = Mirror(Geometry=stream_filter_13, Plane=xz_plane)  # -> Geometry, Transform
stream_filter_14 = StreamFilter(HerrajesInferiores=herrajes_inferiores, Stream0=[stream_filter_12, mirror_9.Geometry])
s_0_2 = ClusterOutput(stream_filter_14)
stream_filter_15 = StreamFilter(Tarugo=relay_3, Stream0=[mirror_7.Geometry, move_18.Geometry])
stream_filter_16 = StreamFilter(Drywall=relay_3, Stream0=[mirror_6.Geometry, move_15.Geometry])
stream_filter_17 = StreamFilter(Perno=relay_3, Stream1=[mirror_10.Geometry, move_16.Geometry])
stream_filter_18 = StreamFilter(Gate=relay_3, Stream1=[mirror_11.Geometry, stream_filter_13])
s_1_2 = ClusterOutput(stream_filter_15)
s_1_3 = ClusterOutput(stream_filter_18)
s_1_4 = ClusterOutput(stream_filter_17)
drywall_superior = ClusterOutput(stream_filter_16)

# ==== cluster Cluster_6
pieza = ClusterInput()
# Maquinado Tarugos + Tornillo Drywall *Superior
deconstruct_brep = DeconstructBrep(Pieza=pieza)  # -> Faces, Edges, Vertices
# Maquinado Minifix + Tornillo Drywall *Superior
deconstruct_brep_2 = DeconstructBrep(Pieza=pieza)  # -> Faces, Edges, Vertices
# Maquinado Tuerca + Tornillo Drywall + Tarugo *Inferior
deconstruct_brep_3 = DeconstructBrep(Pieza=pieza)  # -> Faces, Edges, Vertices
deconstruct_brep_4 = DeconstructBrep(Pieza=pieza)  # -> Faces, Edges, Vertices
list_item = ListItem(List=deconstruct_brep_2.Edges, Index="18", Wrap=True)
list_item_2 = ListItem(List=deconstruct_brep_3.Edges, Index="2", Wrap=True)
list_item_3 = ListItem(List=deconstruct_brep_2.Faces, Index="5", Wrap=True)
list_item_4 = ListItem(List=deconstruct_brep_3.Faces, Index="4", Wrap=True)
list_item_5 = ListItem(List=deconstruct_brep.Edges, Index="18", Wrap=True)
list_item_6 = ListItem(List=deconstruct_brep.Faces, Index="5", Wrap=True)
list_item_7 = ListItem(List=deconstruct_brep_4.Edges, Index="2", Wrap=True)
list_item_8 = ListItem(List=deconstruct_brep_4.Faces, Index="4", Wrap=True)
area = Area(Geometry=list_item_3)  # -> Area, Centroid
area_2 = Area(Geometry=list_item_4)  # -> Area, Centroid
curve_middle = CurveMiddle(Curve=list_item)
curve_middle_2 = CurveMiddle(Curve=list_item_2)
area_3 = Area(Geometry=list_item_6)  # -> Area, Centroid
curve_middle_3 = CurveMiddle(Curve=list_item_5)
area_4 = Area(Geometry=list_item_8)  # -> Area, Centroid
curve_middle_4 = CurveMiddle(Curve=list_item_7)
line = Line(StartPoint=area.Centroid, EndPoint=curve_middle)
line_2 = Line(StartPoint=area_2.Centroid, EndPoint=curve_middle_2)
xz_plane = XZPlane(Origin=area.Centroid)
xz_plane_2 = XZPlane(Origin=area_2.Centroid)
line_3 = Line(StartPoint=area_3.Centroid, EndPoint=curve_middle_3)
xz_plane_3 = XZPlane(Origin=area_3.Centroid)
deconstruct = Deconstruct(Point=area_3.Centroid)  # -> XComponent, YComponent, ZComponent
line_4 = Line(StartPoint=area_4.Centroid, EndPoint=curve_middle_4)
xz_plane_4 = XZPlane(Origin=area_4.Centroid)
length = Length(Curve=line)
length_2 = Length(Curve=line_2)
length_3 = Length(Curve=line_3)
length_4 = Length(Curve=line_4)
expression = Expression(x=deconstruct.XComponent, Expression="if(x>1,1,0)")
panel = Panel(length)
panel_2 = Panel(length_2)
panel_3 = Panel(length_3)
panel_4 = Panel(length_4)
panel_5 = Panel(expression)
distancia_minima_al_borde = Panel("20")
distancia_minima_al_borde_2 = Panel("20")
distancia_minima_al_borde_3 = Panel("20")
distancia_minima_al_borde_4 = Panel("20")
stream_filter = StreamFilter(Gate=panel_5)
paso_maquinas = Panel("32")
paso_maquinas_2 = Panel("32")
subtraction = Subtraction(A=panel, B=distancia_minima_al_borde)
subtraction_2 = Subtraction(A=panel_2, B=distancia_minima_al_borde_2)
paso_maquinas_3 = Panel("32")
subtraction_3 = Subtraction(A=panel_3, B=distancia_minima_al_borde_3)
paso_maquinas_4 = Panel("32")
subtraction_4 = Subtraction(A=panel_4, B=distancia_minima_al_borde_4)
division = Division(A=subtraction, B=paso_maquinas)
division_2 = Division(A=subtraction_2, B=paso_maquinas_2)
division_3 = Division(A=subtraction_3, B=paso_maquinas_3)
division_4 = Division(A=subtraction_4, B=paso_maquinas_4)
panel_6 = Panel(division)
panel_7 = Panel(division_2)
panel_8 = Panel(division_3)
panel_9 = Panel(division_4)
round = Round(Number=panel_6)  # -> Nearest, Floor, Ceiling
round_2 = Round(Number=panel_7)  # -> Nearest, Floor, Ceiling
round_3 = Round(Number=panel_8)  # -> Nearest, Floor, Ceiling
round_4 = Round(Number=panel_9)  # -> Nearest, Floor, Ceiling
panel_10 = Panel(round.Floor)
panel_11 = Panel(round_2.Floor)
panel_12 = Panel(round_3.Floor)
panel_13 = Panel(round_4.Floor)
multiplication = Multiplication(A=panel_10, B=paso_maquinas)
multiplication_2 = Multiplication(A=panel_11, B=paso_maquinas_2)
multiplication_3 = Multiplication(A=panel_12, B=paso_maquinas_3)
multiplication_4 = Multiplication(A=panel_13, B=paso_maquinas_4)
unit_y = UnitY(Factor=multiplication)
unit_y_2 = UnitY(Factor=multiplication_2)
unit_y_3 = UnitY(Factor=multiplication_3)
unit_y_4 = UnitY(Factor=multiplication_4)
negative = Negative(Value=paso_maquinas_2)
negative_2 = Negative(Value=paso_maquinas_3)
move = Move(Geometry=area.Centroid, Motion=unit_y)  # -> Geometry, Transform
negative_3 = Negative(Value=paso_maquinas_4)
move_2 = Move(Geometry=area_2.Centroid, Motion=unit_y_2)  # -> Geometry, Transform
move_3 = Move(Geometry=area_3.Centroid, Motion=unit_y_3)  # -> Geometry, Transform
move_4 = Move(Geometry=area_4.Centroid, Motion=unit_y_4)  # -> Geometry, Transform
unit_y_5 = UnitY(Factor=negative)
unit_y_6 = UnitY(Factor=negative_2)
unit_y_7 = UnitY(Factor=negative_3)
xy_plane = XYPlane(Origin=move.Geometry)
move_5 = Move(Geometry=move_2.Geometry, Motion=unit_y_5)  # -> Geometry, Transform
deconstruct_2 = Deconstruct(Point=move_5.Geometry)  # -> XComponent, YComponent, ZComponent
expression_2 = Expression(x=deconstruct_2.XComponent, Expression="if(x>1,1,0)")
xy_plane_2 = XYPlane(Origin=move_2.Geometry)
move_6 = Move(Geometry=move_3.Geometry, Motion=unit_y_6)  # -> Geometry, Transform
deconstruct_3 = Deconstruct(Point=move_6.Geometry)  # -> XComponent, YComponent, ZComponent
xy_plane_3 = XYPlane(Origin=move_3.Geometry)
xy_plane_4 = XYPlane(Origin=move.Geometry)
deconstruct_4 = Deconstruct(Point=move.Geometry)  # -> XComponent, YComponent, ZComponent
move_7 = Move(Geometry=move_4.Geometry, Motion=unit_y_7)  # -> Geometry, Transform
unit_z = UnitZ(Factor="22")
xy_plane_5 = XYPlane(Origin=move_4.Geometry)
cylinder = Cylinder(Base=xy_plane, Radius="2.5", Length="10")
expression_3 = Expression(x=deconstruct_3.XComponent, Expression="if(x>1,1,0)")
unit_z_2 = UnitZ(Factor="22")
panel_14 = Panel(expression_2)
cylinder_2 = Cylinder(Base=xy_plane_2, Radius="3", Length="-15")
cap_holes = CapHoles(Brep=cylinder)
move_8 = Move(Geometry=move_5.Geometry, Motion=unit_z)  # -> Geometry, Transform
cylinder_3 = Cylinder(Base=xy_plane_3, Radius="3", Length="15")
expression_4 = Expression(x=deconstruct_4.XComponent, Expression="if(x>1,1,0)")
xy_plane_6 = XYPlane(Origin=move.Geometry)
unit_z_3 = UnitZ(Factor="10")
cylinder_4 = Cylinder(Base=xy_plane_5, Radius="3", Length="-15")
panel_15 = Panel(expression_3)
move_9 = Move(Geometry=move_7.Geometry, Motion=unit_z_2)  # -> Geometry, Transform
stream_filter_2 = StreamFilter(Gate=panel_14, Stream1=move_5.Geometry)
cylinder_5 = Cylinder(Base=xy_plane_6, Radius="3.5", Length="-22")
move_10 = Move(Geometry=move_6.Geometry, Motion=unit_z_3)  # -> Geometry, Transform
xy_plane_7 = XYPlane(Origin=move_8.Geometry)
stream_filter_3 = StreamFilter(Gate=panel_15, Stream1=move_6.Geometry)
panel_16 = Panel(expression_4)
cylinder_6 = Cylinder(Base=xy_plane_2, Radius="1.5", Length="20")
cylinder_7 = Cylinder(Base=xy_plane_3, Radius="1.5", Length="-20")
cap_holes_2 = CapHoles(Brep=cylinder_2)
xy_plane_8 = XYPlane(Origin=move_9.Geometry)
cap_holes_3 = CapHoles(Brep=cylinder_3)
cylinder_8 = Cylinder(Base=xy_plane_5, Radius="1.5", Length="20")
cap_holes_4 = CapHoles(Brep=cylinder_5)
cap_holes_5 = CapHoles(Brep=cylinder_4)
xy_plane_9 = XYPlane(Origin=move_10.Geometry)
stream_filter_4 = StreamFilter(Gate=panel_16, Stream1=move.Geometry)
cylinder_9 = Cylinder(Base=xy_plane_7, Radius="4", Length="-32")
cap_holes_6 = CapHoles(Brep=cylinder_6)
deconstruct_brep_5 = DeconstructBrep(Brep=cap_holes_3)  # -> Faces, Edges, Vertices
cap_holes_7 = CapHoles(Brep=cylinder_7)
cylinder_10 = Cylinder(Base=xy_plane_8, Radius="4", Length="-32")
deconstruct_brep_6 = DeconstructBrep(Brep=cap_holes_4)  # -> Faces, Edges, Vertices
cap_holes_8 = CapHoles(Brep=cylinder_8)
solid_union = SolidUnion(Breps=[cap_holes_2, cap_holes_6])
cylinder_11 = Cylinder(Base=xy_plane_9, Radius="4", Length="-32")
cap_holes_9 = CapHoles(Brep=cylinder_9)
solid_union_2 = SolidUnion(Breps=[cap_holes_3, cap_holes_7])
cap_holes_10 = CapHoles(Brep=cylinder_10)
list_item_9 = ListItem(List=deconstruct_brep_5.Faces, Index="2", Wrap=True)
list_item_10 = ListItem(List=deconstruct_brep_6.Faces, Index="4", Wrap=True)
deconstruct_brep_7 = DeconstructBrep(Brep=cap_holes_9)  # -> Faces, Edges, Vertices
deconstruct_brep_8 = DeconstructBrep(Brep=cap_holes_2)  # -> Faces, Edges, Vertices
cap_holes_11 = CapHoles(Brep=cylinder_11)
deconstruct_brep_9 = DeconstructBrep(Brep=cap_holes_6)  # -> Faces, Edges, Vertices
solid_union_3 = SolidUnion(Breps=cap_holes_9)
deconstruct_brep_10 = DeconstructBrep(Brep=cap_holes_10)  # -> Faces, Edges, Vertices
deconstruct_brep_11 = DeconstructBrep(Brep=cap_holes_5)  # -> Faces, Edges, Vertices
area_5 = Area(Geometry=list_item_9)  # -> Area, Centroid
deconstruct_5 = Deconstruct(Point=area_5.Centroid)  # -> XComponent, YComponent, ZComponent
area_6 = Area(Geometry=list_item_10)  # -> Area, Centroid
solid_union_4 = SolidUnion(Breps=cap_holes_10)
solid_union_5 = SolidUnion(Breps=[solid_union_2, cap_holes_11])
unit_z_4 = UnitZ(Factor="-2")
list_item_11 = ListItem(List=deconstruct_brep_7.Faces, Index="1", Wrap=True)
list_item_12 = ListItem(List=deconstruct_brep_8.Faces, Index="1", Wrap=True)
expression_5 = Expression(x=deconstruct_5.XComponent, Expression="if(x>1,1,0)")
list_item_13 = ListItem(List=deconstruct_brep_10.Faces, Index="1", Wrap=True)
list_item_14 = ListItem(List=deconstruct_brep_9.Faces, Index="2", Wrap=True)
deconstruct_brep_12 = DeconstructBrep(Brep=cap_holes_11)  # -> Faces, Edges, Vertices
list_item_15 = ListItem(List=deconstruct_brep_11.Faces, Index="1", Wrap=True)
move_11 = Move(Geometry=area_6.Centroid, Motion=unit_z_4)  # -> Geometry, Transform
mirror = Mirror(Geometry=solid_union_5, Plane=xz_plane_3)  # -> Geometry, Transform
area_7 = Area(Geometry=list_item_11)  # -> Area, Centroid
area_8 = Area(Geometry=list_item_14)  # -> Area, Centroid
area_9 = Area(Geometry=list_item_12)  # -> Area, Centroid
unit_x = UnitX(Factor="-4")
unit_x_2 = UnitX(Factor="-4")
area_10 = Area(Geometry=list_item_13)  # -> Area, Centroid
area_11 = Area(Geometry=list_item_15)  # -> Area, Centroid
panel_17 = Panel(expression_5)
relay = ClusterInput()
relay_2 = ClusterInput()
list_item_16 = ListItem(List=deconstruct_brep_12.Faces, Index="2", Wrap=True)
stream_filter_5 = StreamFilter(Gate=panel_17, Stream1=area_5.Centroid)
move_12 = Move(Geometry=move_11.Geometry, Motion=unit_x_2)  # -> Geometry, Transform
solid_union_6 = SolidUnion(Breps=[mirror.Geometry, solid_union_5])
area_12 = Area(Geometry=list_item_16)  # -> Area, Centroid
deconstruct_6 = Deconstruct(Point=area_9.Centroid)  # -> XComponent, YComponent, ZComponent
move_13 = Move(Geometry=area_8.Centroid, Motion=unit_x)  # -> Geometry, Transform
solid_union_7 = SolidUnion(Breps=[cap_holes_5, cap_holes_8])
yz_plane = YZPlane(Origin=move_12.Geometry)
yz_plane_2 = YZPlane(Origin=move_13.Geometry)
expression_6 = Expression(x=deconstruct_6.XComponent, Expression="if(x>1,1,0)")
cylinder_12 = Cylinder(Base=yz_plane, Radius="7.5", Length="12")
cylinder_13 = Cylinder(Base=yz_plane_2, Radius="6", Length="11.5")
cap_holes_12 = CapHoles(Brep=cylinder_12)
panel_18 = Panel(expression_6)
solid_union_8 = SolidUnion(Breps=[solid_union_7, solid_union_4])
solid_union_9 = SolidUnion(Breps=[cap_holes_12, cap_holes_4, cap_holes])
cap_holes_13 = CapHoles(Brep=cylinder_13)
stream_filter_6 = StreamFilter(Gate=panel_18, Stream1=area_9.Centroid)
deconstruct_brep_13 = DeconstructBrep(Brep=cap_holes_13)  # -> Faces, Edges, Vertices
rotate_3d = Rotate3D(Geometry=solid_union_9, Angle=degrees("180"), Center=xy_plane_6, Axis=Vector(0, 0, 1))  # -> Geometry, Transform
solid_union_10 = SolidUnion(Breps=[cap_holes_13, cap_holes_2, cap_holes_6])
list_item_17 = ListItem(List=deconstruct_brep_13.Faces, Index="1", Wrap=True)
mirror_2 = Mirror(Geometry=solid_union_8, Plane=xz_plane_4)  # -> Geometry, Transform
rotate_3d_2 = Rotate3D(Geometry=solid_union_10, Angle=degrees("180"), Center=move_2.Geometry, Axis=Vector(0, 0, 1))  # -> Geometry, Transform
stream_filter_7 = StreamFilter(GirarMaquinadoPerno=relay_2, Stream0=solid_union_9, Stream1=rotate_3d.Geometry)
area_13 = Area(Geometry=list_item_17)  # -> Area, Centroid
stream_filter_8 = StreamFilter(GirarTuercaPlastica=relay, Stream0=solid_union_10, Stream1=rotate_3d_2.Geometry)
solid_union_11 = SolidUnion(Breps=[mirror_2.Geometry, solid_union_8])
mirror_3 = Mirror(Geometry=stream_filter_7, Plane=xz_plane)  # -> Geometry, Transform
deconstruct_7 = Deconstruct(Point=area_13.Centroid)  # -> XComponent, YComponent, ZComponent
solid_union_12 = SolidUnion(Breps=[stream_filter_7, mirror_3.Geometry])
solid_union_13 = SolidUnion(Breps=[solid_union_3, stream_filter_8])
expression_7 = Expression(x=deconstruct_7.XComponent, Expression="if(x>1,1,0)")
mirror_4 = Mirror(Geometry=solid_union_13, Plane=xz_plane_2)  # -> Geometry, Transform
panel_19 = Panel(expression_7)
solid_union_14 = SolidUnion(Breps=[mirror_4.Geometry, solid_union_13])
stream_filter_9 = StreamFilter(Gate=panel_19, Stream1=area_13.Centroid)
union_superior = ClusterInput()
union_inferior = ClusterInput()
# Aqui se definen cuales son los herrajes superiores e inferiores
stream_filter_10 = StreamFilter(UnionSuperior=union_superior, Stream0=solid_union_6, Stream1=solid_union_12)
stream_filter_11 = StreamFilter(UnionInferior=union_inferior, Stream0=solid_union_14, Stream1=solid_union_11)
s_0 = ClusterOutput(stream_filter_11)
s_1 = ClusterOutput(stream_filter_10)

mesh = Mesh(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)
point = Point(Point(-380.6006041, 587.7908738, 256.8805061))

point_2 = Point(Point(-134.1035289, 107.5129007, 256.9310845))
mesh_2 = Mesh(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)
point_3 = Point(Point(-134.1035289, 107.5129007, 270.9310845))

mesh_3 = Mesh(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)
point_4 = Point(Point(-97.39304191, 111.3185558, 290.5782605))
mesh_4 = Mesh(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)

mesh_5 = Mesh(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)

mesh_6 = Mesh(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)
point_5 = Point(Point(-135.4591294, 432, 101.6471077))

mesh_7 = Mesh(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)
point_6 = Point(Point(-134.1035289, 107.5129007, 256.9310845))

vector_2pt = Vector2Pt(PointA=point_5, PointB=stream_filter_9, Unitize=False)  # -> Vector, Length
vector_2pt_2 = Vector2Pt(PointA=point_6, PointB=stream_filter_2, Unitize=False)  # -> Vector, Length
vector_2pt_3 = Vector2Pt(PointA=point_4, PointB=stream_filter_4, Unitize=False)  # -> Vector, Length
vector_2pt_4 = Vector2Pt(PointA=point, PointB=stream_filter_5, Unitize=False)  # -> Vector, Length
move_14 = Move(Geometry=mesh_7, Motion=vector_2pt_2.Vector)  # -> Geometry, Transform
vector_2pt_5 = Vector2Pt(PointA=point_4, PointB=stream_filter_4, Unitize=False)  # -> Vector, Length
vector_2pt_6 = Vector2Pt(PointA=point_3, PointB=stream_filter_3, Unitize=False)  # -> Vector, Length
vector_2pt_7 = Vector2Pt(PointA=point, PointB=stream_filter_6, Unitize=False)  # -> Vector, Length
move_15 = Move(Geometry=mesh_6, Motion=vector_2pt.Vector)  # -> Geometry, Transform
move_16 = Move(Geometry=mesh_4, Motion=vector_2pt_3.Vector)  # -> Geometry, Transform
move_17 = Move(Geometry=mesh, Motion=vector_2pt_4.Vector)  # -> Geometry, Transform
move_18 = Move(Geometry=mesh_2, Motion=vector_2pt_6.Vector)  # -> Geometry, Transform
move_19 = Move(Geometry=mesh_3, Motion=vector_2pt_5.Vector)  # -> Geometry, Transform
move_20 = Move(Geometry=mesh_5, Motion=vector_2pt_7.Vector)  # -> Geometry, Transform
mirror_5 = Mirror(Geometry=move_14.Geometry, Plane=xz_plane_3)  # -> TarugoInferior, Transform
rotate_3d_3 = Rotate3D(Geometry=move_15.Geometry, Angle=degrees("180"), Center=xy_plane_2, Axis=Vector(0, 0, 1))  # -> Geometry, Transform
mirror_6 = Mirror(Geometry=move_17.Geometry, Plane=xz_plane_3)  # -> Geometry, Transform
rotate_3d_4 = Rotate3D(Geometry=move_19.Geometry, Angle=degrees("180"), Center=xy_plane_4, Axis=Vector(0, 0, 1))  # -> Geometry, Transform
mirror_7 = Mirror(Geometry=move_18.Geometry, Plane=xz_plane_3)  # -> Geometry, Transform
stream_filter_12 = StreamFilter(GirarTuercaPlastica=relay, Stream0=move_15.Geometry, Stream1=rotate_3d_3.Geometry)
mirror_8 = Mirror(Geometry=move_20.Geometry, Plane=xz_plane_3)  # -> DrywallInferior, Transform
stream_filter_13 = StreamFilter(GirarPerno=relay_2, Stream0=move_19.Geometry, Stream1=rotate_3d_4.Geometry)
tarugo_inferior = Relay([move_14.Geometry, mirror_5.TarugoInferior])
herrajes_inferiores = ClusterInput()
mirror_9 = Mirror(Geometry=stream_filter_12, Plane=xz_plane_2)  # -> Geometry, Transform
relay_3 = ClusterInput()
tarugo_inferior_2 = ClusterOutput(tarugo_inferior)
mirror_10 = Mirror(Geometry=move_16.Geometry, Plane=xz_plane)  # -> Geometry, Transform
mirror_11 = Mirror(Geometry=stream_filter_13, Plane=xz_plane)  # -> Geometry, Transform
stream_filter_14 = StreamFilter(HerrajesInferiores=herrajes_inferiores, Stream0=[stream_filter_12, mirror_9.Geometry])
drywall_inferior = Relay([move_20.Geometry, mirror_8.DrywallInferior])
drywall_inferior_2 = ClusterOutput(drywall_inferior)
stream_filter_15 = StreamFilter(Drywall=relay_3, Stream0=[mirror_6.Geometry, move_17.Geometry])
tuerca = ClusterOutput(stream_filter_14)
stream_filter_16 = StreamFilter(Tarugo=relay_3, Stream0=[mirror_7.Geometry, move_18.Geometry])
stream_filter_17 = StreamFilter(Perno=relay_3, Stream1=[mirror_10.Geometry, move_16.Geometry])
stream_filter_18 = StreamFilter(Gate=relay_3, Stream1=[mirror_11.Geometry, stream_filter_13])
perno = ClusterOutput(stream_filter_17)
caja = ClusterOutput(stream_filter_18)
tarugo = ClusterOutput(stream_filter_16)
drywall_superior = ClusterOutput(stream_filter_15)

# ==== cluster Cluster_7
pieza = ClusterInput()
# Maquinado Tarugos + Tornillo Drywall *Superior
deconstruct_brep = DeconstructBrep(Pieza=pieza)  # -> Faces, Edges, Vertices
# Maquinado Minifix + Tornillo Drywall *Superior
deconstruct_brep_2 = DeconstructBrep(Pieza=pieza)  # -> Faces, Edges, Vertices
# Maquinado Tuerca + Tornillo Drywall + Tarugo *Inferior
deconstruct_brep_3 = DeconstructBrep(Pieza=pieza)  # -> Faces, Edges, Vertices
# Maquinado Tornillo Drywall + Tarugo *Inferior
deconstruct_brep_4 = DeconstructBrep(Pieza=pieza)  # -> Faces, Edges, Vertices
list_item = ListItem(List=deconstruct_brep_2.Edges, Index="18", Wrap=True)
list_item_2 = ListItem(List=deconstruct_brep_3.Edges, Index="2", Wrap=True)
list_item_3 = ListItem(List=deconstruct_brep_2.Faces, Index="5", Wrap=True)
list_item_4 = ListItem(List=deconstruct_brep_3.Faces, Index="4", Wrap=True)
list_item_5 = ListItem(List=deconstruct_brep.Edges, Index="18", Wrap=True)
list_item_6 = ListItem(List=deconstruct_brep.Faces, Index="5", Wrap=True)
list_item_7 = ListItem(List=deconstruct_brep_4.Edges, Index="2", Wrap=True)
list_item_8 = ListItem(List=deconstruct_brep_4.Faces, Index="4", Wrap=True)
area = Area(Geometry=list_item_3)  # -> Area, Centroid
area_2 = Area(Geometry=list_item_4)  # -> Area, Centroid
curve_middle = CurveMiddle(Curve=list_item)
curve_middle_2 = CurveMiddle(Curve=list_item_2)
area_3 = Area(Geometry=list_item_6)  # -> Area, Centroid
curve_middle_3 = CurveMiddle(Curve=list_item_5)
area_4 = Area(Geometry=list_item_8)  # -> Area, Centroid
curve_middle_4 = CurveMiddle(Curve=list_item_7)
line = Line(StartPoint=area.Centroid, EndPoint=curve_middle)
line_2 = Line(StartPoint=area_2.Centroid, EndPoint=curve_middle_2)
xz_plane = XZPlane(Origin=area.Centroid)
xz_plane_2 = XZPlane(Origin=area_2.Centroid)
line_3 = Line(StartPoint=area_3.Centroid, EndPoint=curve_middle_3)
xz_plane_3 = XZPlane(Origin=area_3.Centroid)
deconstruct = Deconstruct(Point=area_3.Centroid)  # -> XComponent, YComponent, ZComponent
line_4 = Line(StartPoint=area_4.Centroid, EndPoint=curve_middle_4)
xz_plane_4 = XZPlane(Origin=area_4.Centroid)
length = Length(Curve=line)
length_2 = Length(Curve=line_2)
length_3 = Length(Curve=line_3)
length_4 = Length(Curve=line_4)
expression = Expression(x=deconstruct.XComponent, Expression="if(x>1,1,0)")
panel = Panel(length)
panel_2 = Panel(length_2)
panel_3 = Panel(length_3)
panel_4 = Panel(length_4)
panel_5 = Panel(expression)
distancia_minima_al_borde = Panel("20")
distancia_minima_al_borde_2 = Panel("20")
distancia_minima_al_borde_3 = Panel("20")
distancia_minima_al_borde_4 = Panel("20")
stream_filter = StreamFilter(Gate=panel_5)
paso_maquinas = Panel("32")
paso_maquinas_2 = Panel("32")
subtraction = Subtraction(A=panel, B=distancia_minima_al_borde)
subtraction_2 = Subtraction(A=panel_2, B=distancia_minima_al_borde_2)
paso_maquinas_3 = Panel("32")
subtraction_3 = Subtraction(A=panel_3, B=distancia_minima_al_borde_3)
paso_maquinas_4 = Panel("32")
subtraction_4 = Subtraction(A=panel_4, B=distancia_minima_al_borde_4)
division = Division(A=subtraction, B=paso_maquinas)
division_2 = Division(A=subtraction_2, B=paso_maquinas_2)
division_3 = Division(A=subtraction_3, B=paso_maquinas_3)
division_4 = Division(A=subtraction_4, B=paso_maquinas_4)
panel_6 = Panel(division)
panel_7 = Panel(division_2)
panel_8 = Panel(division_3)
panel_9 = Panel(division_4)
round = Round(Number=panel_6)  # -> Nearest, Floor, Ceiling
round_2 = Round(Number=panel_7)  # -> Nearest, Floor, Ceiling
round_3 = Round(Number=panel_8)  # -> Nearest, Floor, Ceiling
round_4 = Round(Number=panel_9)  # -> Nearest, Floor, Ceiling
panel_10 = Panel(round.Floor)
panel_11 = Panel(round_2.Floor)
panel_12 = Panel(round_3.Floor)
panel_13 = Panel(round_4.Floor)
multiplication = Multiplication(A=panel_10, B=paso_maquinas)
multiplication_2 = Multiplication(A=panel_11, B=paso_maquinas_2)
multiplication_3 = Multiplication(A=panel_12, B=paso_maquinas_3)
multiplication_4 = Multiplication(A=panel_13, B=paso_maquinas_4)
unit_y = UnitY(Factor=multiplication)
unit_y_2 = UnitY(Factor=multiplication_2)
unit_y_3 = UnitY(Factor=multiplication_3)
unit_y_4 = UnitY(Factor=multiplication_4)
negative = Negative(Value=paso_maquinas_2)
negative_2 = Negative(Value=paso_maquinas_3)
move = Move(Geometry=area.Centroid, Motion=unit_y)  # -> Geometry, Transform
negative_3 = Negative(Value=paso_maquinas_4)
move_2 = Move(Geometry=area_2.Centroid, Motion=unit_y_2)  # -> Geometry, Transform
move_3 = Move(Geometry=area_3.Centroid, Motion=unit_y_3)  # -> Geometry, Transform
move_4 = Move(Geometry=area_4.Centroid, Motion=unit_y_4)  # -> Geometry, Transform
unit_y_5 = UnitY(Factor=negative)
unit_y_6 = UnitY(Factor=negative_2)
unit_y_7 = UnitY(Factor=negative_3)
xy_plane = XYPlane(Origin=move.Geometry)
move_5 = Move(Geometry=move_2.Geometry, Motion=unit_y_5)  # -> Geometry, Transform
deconstruct_2 = Deconstruct(Point=move_5.Geometry)  # -> XComponent, YComponent, ZComponent
expression_2 = Expression(x=deconstruct_2.XComponent, Expression="if(x>1,1,0)")
xy_plane_2 = XYPlane(Origin=move_2.Geometry)
move_6 = Move(Geometry=move_3.Geometry, Motion=unit_y_6)  # -> Geometry, Transform
deconstruct_3 = Deconstruct(Point=move_6.Geometry)  # -> XComponent, YComponent, ZComponent
xy_plane_3 = XYPlane(Origin=move_3.Geometry)
xy_plane_4 = XYPlane(Origin=move.Geometry)
deconstruct_4 = Deconstruct(Point=move.Geometry)  # -> XComponent, YComponent, ZComponent
move_7 = Move(Geometry=move_4.Geometry, Motion=unit_y_7)  # -> Geometry, Transform
unit_z = UnitZ(Factor="22")
xy_plane_5 = XYPlane(Origin=move_4.Geometry)
cylinder = Cylinder(Base=xy_plane, Radius="2.5", Length="10")
expression_3 = Expression(x=deconstruct_3.XComponent, Expression="if(x>1,1,0)")
unit_z_2 = UnitZ(Factor="22")
panel_14 = Panel(expression_2)
cylinder_2 = Cylinder(Base=xy_plane_2, Radius="3", Length="-15")
cap_holes = CapHoles(Brep=cylinder)
move_8 = Move(Geometry=move_5.Geometry, Motion=unit_z)  # -> Geometry, Transform
cylinder_3 = Cylinder(Base=xy_plane_3, Radius="3", Length="15")
expression_4 = Expression(x=deconstruct_4.XComponent, Expression="if(x>1,1,0)")
xy_plane_6 = XYPlane(Origin=move.Geometry)
unit_z_3 = UnitZ(Factor="10")
cylinder_4 = Cylinder(Base=xy_plane_5, Radius="3", Length="-15")
panel_15 = Panel(expression_3)
move_9 = Move(Geometry=move_7.Geometry, Motion=unit_z_2)  # -> Geometry, Transform
stream_filter_2 = StreamFilter(Gate=panel_14, Stream1=move_5.Geometry)
cylinder_5 = Cylinder(Base=xy_plane_6, Radius="3.5", Length="-22")
move_10 = Move(Geometry=move_6.Geometry, Motion=unit_z_3)  # -> Geometry, Transform
xy_plane_7 = XYPlane(Origin=move_8.Geometry)
stream_filter_3 = StreamFilter(Gate=panel_15, Stream1=move_6.Geometry)
panel_16 = Panel(expression_4)
cylinder_6 = Cylinder(Base=xy_plane_2, Radius="1.5", Length="20")
cylinder_7 = Cylinder(Base=xy_plane_3, Radius="1.5", Length="-20")
cap_holes_2 = CapHoles(Brep=cylinder_2)
xy_plane_8 = XYPlane(Origin=move_9.Geometry)
cap_holes_3 = CapHoles(Brep=cylinder_3)
cylinder_8 = Cylinder(Base=xy_plane_5, Radius="1.5", Length="20")
cap_holes_4 = CapHoles(Brep=cylinder_5)
cap_holes_5 = CapHoles(Brep=cylinder_4)
xy_plane_9 = XYPlane(Origin=move_10.Geometry)
stream_filter_4 = StreamFilter(Gate=panel_16, Stream1=move.Geometry)
cylinder_9 = Cylinder(Base=xy_plane_7, Radius="4", Length="-32")
cap_holes_6 = CapHoles(Brep=cylinder_6)
deconstruct_brep_5 = DeconstructBrep(Brep=cap_holes_3)  # -> Faces, Edges, Vertices
cap_holes_7 = CapHoles(Brep=cylinder_7)
cylinder_10 = Cylinder(Base=xy_plane_8, Radius="4", Length="-32")
deconstruct_brep_6 = DeconstructBrep(Brep=cap_holes_4)  # -> Faces, Edges, Vertices
cap_holes_8 = CapHoles(Brep=cylinder_8)
solid_union = SolidUnion(Breps=[cap_holes_2, cap_holes_6])
cylinder_11 = Cylinder(Base=xy_plane_9, Radius="4", Length="-32")
cap_holes_9 = CapHoles(Brep=cylinder_9)
solid_union_2 = SolidUnion(Breps=[cap_holes_3, cap_holes_7])
cap_holes_10 = CapHoles(Brep=cylinder_10)
list_item_9 = ListItem(List=deconstruct_brep_5.Faces, Index="2", Wrap=True)
list_item_10 = ListItem(List=deconstruct_brep_6.Faces, Index="4", Wrap=True)
deconstruct_brep_7 = DeconstructBrep(Brep=cap_holes_9)  # -> Faces, Edges, Vertices
deconstruct_brep_8 = DeconstructBrep(Brep=cap_holes_2)  # -> Faces, Edges, Vertices
cap_holes_11 = CapHoles(Brep=cylinder_11)
deconstruct_brep_9 = DeconstructBrep(Brep=cap_holes_6)  # -> Faces, Edges, Vertices
solid_union_3 = SolidUnion(Breps=cap_holes_9)
deconstruct_brep_10 = DeconstructBrep(Brep=cap_holes_10)  # -> Faces, Edges, Vertices
deconstruct_brep_11 = DeconstructBrep(Brep=cap_holes_5)  # -> Faces, Edges, Vertices
area_5 = Area(Geometry=list_item_9)  # -> Area, Centroid
deconstruct_5 = Deconstruct(Point=area_5.Centroid)  # -> XComponent, YComponent, ZComponent
area_6 = Area(Geometry=list_item_10)  # -> Area, Centroid
solid_union_4 = SolidUnion(Breps=cap_holes_10)
solid_union_5 = SolidUnion(Breps=[solid_union_2, cap_holes_11])
unit_z_4 = UnitZ(Factor="-2")
list_item_11 = ListItem(List=deconstruct_brep_7.Faces, Index="1", Wrap=True)
list_item_12 = ListItem(List=deconstruct_brep_8.Faces, Index="1", Wrap=True)
expression_5 = Expression(x=deconstruct_5.XComponent, Expression="if(x>1,1,0)")
list_item_13 = ListItem(List=deconstruct_brep_10.Faces, Index="1", Wrap=True)
list_item_14 = ListItem(List=deconstruct_brep_9.Faces, Index="2", Wrap=True)
deconstruct_brep_12 = DeconstructBrep(Brep=cap_holes_11)  # -> Faces, Edges, Vertices
list_item_15 = ListItem(List=deconstruct_brep_11.Faces, Index="1", Wrap=True)
move_11 = Move(Geometry=area_6.Centroid, Motion=unit_z_4)  # -> Geometry, Transform
mirror = Mirror(Geometry=solid_union_5, Plane=xz_plane_3)  # -> Geometry, Transform
area_7 = Area(Geometry=list_item_11)  # -> Area, Centroid
area_8 = Area(Geometry=list_item_14)  # -> Area, Centroid
area_9 = Area(Geometry=list_item_12)  # -> Area, Centroid
unit_x = UnitX(Factor="-4")
unit_x_2 = UnitX(Factor="-4")
area_10 = Area(Geometry=list_item_13)  # -> Area, Centroid
area_11 = Area(Geometry=list_item_15)  # -> Area, Centroid
panel_17 = Panel(expression_5)
relay = ClusterInput()
relay_2 = ClusterInput()
list_item_16 = ListItem(List=deconstruct_brep_12.Faces, Index="2", Wrap=True)
stream_filter_5 = StreamFilter(Gate=panel_17, Stream1=area_5.Centroid)
move_12 = Move(Geometry=move_11.Geometry, Motion=unit_x_2)  # -> Geometry, Transform
solid_union_6 = SolidUnion(Breps=[mirror.Geometry, solid_union_5])
area_12 = Area(Geometry=list_item_16)  # -> Area, Centroid
deconstruct_6 = Deconstruct(Point=area_9.Centroid)  # -> XComponent, YComponent, ZComponent
move_13 = Move(Geometry=area_8.Centroid, Motion=unit_x)  # -> Geometry, Transform
solid_union_7 = SolidUnion(Breps=[cap_holes_5, cap_holes_8])
yz_plane = YZPlane(Origin=move_12.Geometry)
yz_plane_2 = YZPlane(Origin=move_13.Geometry)
expression_6 = Expression(x=deconstruct_6.XComponent, Expression="if(x>1,1,0)")
cylinder_12 = Cylinder(Base=yz_plane, Radius="7.5", Length="12")
cylinder_13 = Cylinder(Base=yz_plane_2, Radius="6", Length="11.5")
cap_holes_12 = CapHoles(Brep=cylinder_12)
panel_18 = Panel(expression_6)
solid_union_8 = SolidUnion(Breps=[solid_union_7, solid_union_4])
solid_union_9 = SolidUnion(Breps=[cap_holes_12, cap_holes_4, cap_holes])
cap_holes_13 = CapHoles(Brep=cylinder_13)
stream_filter_6 = StreamFilter(Gate=panel_18, Stream1=area_9.Centroid)
deconstruct_brep_13 = DeconstructBrep(Brep=cap_holes_13)  # -> Faces, Edges, Vertices
rotate_3d = Rotate3D(Geometry=solid_union_9, Angle=degrees("180"), Center=xy_plane_6, Axis=Vector(0, 0, 1))  # -> Geometry, Transform
solid_union_10 = SolidUnion(Breps=[cap_holes_13, cap_holes_2, cap_holes_6])
list_item_17 = ListItem(List=deconstruct_brep_13.Faces, Index="1", Wrap=True)
mirror_2 = Mirror(Geometry=solid_union_8, Plane=xz_plane_4)  # -> Geometry, Transform
rotate_3d_2 = Rotate3D(Geometry=solid_union_10, Angle=degrees("180"), Center=move_2.Geometry, Axis=Vector(0, 0, 1))  # -> Geometry, Transform
stream_filter_7 = StreamFilter(GirarMaquinadoPerno=relay_2, Stream0=solid_union_9, Stream1=rotate_3d.Geometry)
area_13 = Area(Geometry=list_item_17)  # -> Area, Centroid
stream_filter_8 = StreamFilter(GirarTuercaPlastica=relay, Stream0=solid_union_10, Stream1=rotate_3d_2.Geometry)
solid_union_11 = SolidUnion(Breps=[mirror_2.Geometry, solid_union_8])
mirror_3 = Mirror(Geometry=stream_filter_7, Plane=xz_plane)  # -> Geometry, Transform
deconstruct_7 = Deconstruct(Point=area_13.Centroid)  # -> XComponent, YComponent, ZComponent
solid_union_12 = SolidUnion(Breps=[stream_filter_7, mirror_3.Geometry])
solid_union_13 = SolidUnion(Breps=[solid_union_3, stream_filter_8])
expression_7 = Expression(x=deconstruct_7.XComponent, Expression="if(x>1,1,0)")
mirror_4 = Mirror(Geometry=solid_union_13, Plane=xz_plane_2)  # -> Geometry, Transform
panel_19 = Panel(expression_7)
solid_union_14 = SolidUnion(Breps=[mirror_4.Geometry, solid_union_13])
stream_filter_9 = StreamFilter(Gate=panel_19, Stream1=area_13.Centroid)
union_superior = ClusterInput()
union_inferior = ClusterInput()
# Aqui se definen cuales son los herrajes superiores e inferiores
stream_filter_10 = StreamFilter(UnionSuperior=union_superior, Stream0=solid_union_6, Stream1=solid_union_12)
stream_filter_11 = StreamFilter(UnionInferior=union_inferior, Stream0=solid_union_14, Stream1=solid_union_11)
s_0 = ClusterOutput(stream_filter_11)
s_1 = ClusterOutput(stream_filter_10)

mesh = Mesh(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)
point = Point(Point(-380.6006041, 587.7908738, 256.8805061))

point_2 = Point(Point(-134.1035289, 107.5129007, 256.9310845))
mesh_2 = Mesh(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)
point_3 = Point(Point(-134.1035289, 107.5129007, 270.9310845))

mesh_3 = Mesh(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)
point_4 = Point(Point(-97.39304191, 111.3185558, 290.5782605))
mesh_4 = Mesh(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)

mesh_5 = Mesh(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)

mesh_6 = Mesh(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)
point_5 = Point(Point(-135.4591294, 432, 101.6471077))

mesh_7 = Mesh(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)
point_6 = Point(Point(-134.1035289, 107.5129007, 256.9310845))

vector_2pt = Vector2Pt(PointA=point_6, PointB=stream_filter_2, Unitize=False)  # -> Vector, Length
vector_2pt_2 = Vector2Pt(PointA=point_4, PointB=stream_filter_4, Unitize=False)  # -> Vector, Length
vector_2pt_3 = Vector2Pt(PointA=point_4, PointB=stream_filter_4, Unitize=False)  # -> Vector, Length
vector_2pt_4 = Vector2Pt(PointA=point, PointB=stream_filter_5, Unitize=False)  # -> Vector, Length
vector_2pt_5 = Vector2Pt(PointA=point_3, PointB=stream_filter_3, Unitize=False)  # -> Vector, Length
vector_2pt_6 = Vector2Pt(PointA=point_5, PointB=stream_filter_9, Unitize=False)  # -> Vector, Length
move_14 = Move(Geometry=mesh_7, Motion=vector_2pt.Vector)  # -> Geometry, Transform
move_15 = Move(Geometry=mesh_3, Motion=vector_2pt_2.Vector)  # -> Geometry, Transform
move_16 = Move(Geometry=mesh_3, Motion=vector_2pt_3.Vector)  # -> Geometry, Transform
move_17 = Move(Geometry=mesh, Motion=vector_2pt_4.Vector)  # -> Geometry, Transform
move_18 = Move(Geometry=mesh_2, Motion=vector_2pt_5.Vector)  # -> Geometry, Transform
move_19 = Move(Geometry=mesh_6, Motion=vector_2pt_6.Vector)  # -> Geometry, Transform
vector_2pt_7 = Vector2Pt(PointA=point, PointB=stream_filter_6, Unitize=False)  # -> Vector, Length
mirror_5 = Mirror(Geometry=move_14.Geometry, Plane=xz_plane_3)  # -> TarugoInferior, Transform
rotate_3d_3 = Rotate3D(Geometry=move_19.Geometry, Angle=degrees("180"), Center=xy_plane_2, Axis=Vector(0, 0, 1))  # -> Geometry, Transform
move_20 = Move(Geometry=mesh_5, Motion=vector_2pt_7.Vector)  # -> Geometry, Transform
mirror_6 = Mirror(Geometry=move_17.Geometry, Plane=xz_plane_3)  # -> Geometry, Transform
rotate_3d_4 = Rotate3D(Geometry=move_15.Geometry, Angle=degrees("180"), Center=xy_plane_4, Axis=Vector(0, 0, 1))  # -> Geometry, Transform
mirror_7 = Mirror(Geometry=move_18.Geometry, Plane=xz_plane_3)  # -> Geometry, Transform
stream_filter_12 = StreamFilter(GirarTuercaPlastica=relay, Stream0=move_19.Geometry, Stream1=rotate_3d_3.Geometry)
stream_filter_13 = StreamFilter(GirarPerno=relay_2, Stream0=move_15.Geometry, Stream1=rotate_3d_4.Geometry)
mirror_8 = Mirror(Geometry=move_20.Geometry, Plane=xz_plane_3)  # -> DrywallInferior, Transform
tarugo_inferior = Relay([move_14.Geometry, mirror_5.TarugoInferior])
mirror_9 = Mirror(Geometry=stream_filter_12, Plane=xz_plane_2)  # -> Geometry, Transform
relay_3 = ClusterInput()
tarugo_inferior_2 = ClusterOutput(tarugo_inferior)
herrajes_inferiores = ClusterInput()
mirror_10 = Mirror(Geometry=move_16.Geometry, Plane=xz_plane)  # -> Geometry, Transform
mirror_11 = Mirror(Geometry=stream_filter_13, Plane=xz_plane)  # -> Geometry, Transform
stream_filter_14 = StreamFilter(HerrajesInferiores=herrajes_inferiores, Stream0=[stream_filter_12, mirror_9.Geometry])
drywall_inferior = Relay([mirror_8.DrywallInferior, move_20.Geometry])
drywall_inferior_2 = ClusterOutput(drywall_inferior)
stream_filter_15 = StreamFilter(Drywall=relay_3, Stream0=[mirror_6.Geometry, move_17.Geometry])
tuerca = ClusterOutput(stream_filter_14)
stream_filter_16 = StreamFilter(Tarugo=relay_3, Stream0=[mirror_7.Geometry, move_18.Geometry])
stream_filter_17 = StreamFilter(Perno=relay_3, Stream1=[mirror_10.Geometry, move_16.Geometry])
stream_filter_18 = StreamFilter(Gate=relay_3, Stream1=[mirror_11.Geometry, stream_filter_13])
perno = ClusterOutput(stream_filter_17)
caja = ClusterOutput(stream_filter_18)
tarugo = ClusterOutput(stream_filter_16)
drywall_superior = ClusterOutput(stream_filter_15)

# ==== cluster Cluster_8
punto_simetria = ClusterInput()
punto_0 = ClusterInput()
mecanizados = ClusterInput()
sujecion_herrajes = ClusterInput()
cambiar_lado = ClusterInput()
simetria = ClusterInput()
xz_plane = XZPlane(PuntoSimetria=punto_simetria)
xy_plane = XYPlane(Punto0=punto_0)
mirror = Mirror(Mecanizados=mecanizados, Plane=xz_plane)  # -> Geometry, Transform

# ----
# Tuerca
mesh = Mesh(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)
point = Point(Point(-407.5, 0, -7.755556303))

# ----
# Tornillo Largo
mesh_2 = Mesh(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)
point_2 = Point(Point(-300, 0, 41.10029089))

mesh_3 = Mesh(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)
point_3 = Point(Point(-205.9999456, 2.770490835e-05, 31.4500147))
# Minifix de Presion
mesh_4 = Mesh(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)
mesh_5 = Mesh(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)

# ----
# Minifix Roscado
mesh_6 = Mesh(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)
mesh_7 = Mesh(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)
point_4 = Point(Point(-605.9999456, 2.770490835e-05, 31.4500147))

# ----
# Tornillo PT
mesh_8 = Mesh(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)
point_5 = Point(Point(-500, 0, 32.94388492))

point_6 = Point(Point(-100, 0, 22))
# Tarugo
mesh_9 = Mesh(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)

vector_2pt = Vector2Pt(PointA=point, PointB=xy_plane, Unitize=False)  # -> Vector, Length
vector_2pt_2 = Vector2Pt(PointA=point_3, PointB=xy_plane, Unitize=False)  # -> Vector, Length
vector_2pt_3 = Vector2Pt(PointA=point_5, PointB=xy_plane, Unitize=False)  # -> Vector, Length
vector_2pt_4 = Vector2Pt(PointA=point_2, PointB=xy_plane, Unitize=False)  # -> Vector, Length
vector_2pt_5 = Vector2Pt(PointA=point_4, PointB=xy_plane, Unitize=False)  # -> Vector, Length
vector_2pt_6 = Vector2Pt(PointA=point_6, PointB=xy_plane, Unitize=False)  # -> Vector, Length
move = Move(Geometry=[mesh_4, mesh_5, mesh_3], Motion=vector_2pt_2.Vector)  # -> Geometry, Transform
move_2 = Move(Geometry=mesh, Motion=vector_2pt.Vector)  # -> Geometry, Transform
move_3 = Move(Geometry=mesh_8, Motion=vector_2pt_3.Vector)  # -> Geometry, Transform
move_4 = Move(Geometry=[mesh_6, mesh_7], Motion=vector_2pt_5.Vector)  # -> Geometry, Transform
move_5 = Move(Geometry=mesh_2, Motion=vector_2pt_4.Vector)  # -> Geometry, Transform
move_6 = Move(Geometry=mesh_9, Motion=vector_2pt_6.Vector)  # -> Geometry, Transform
mirror_2 = Mirror(Geometry=move.Geometry, Plane=xy_plane)  # -> Geometry, Transform
mirror_3 = Mirror(Geometry=move_3.Geometry, Plane=xy_plane)  # -> Geometry, Transform
mirror_4 = Mirror(Geometry=move_4.Geometry, Plane=xy_plane)  # -> Geometry, Transform
stream_filter = StreamFilter(Gate=simetria, Stream0=mecanizados, Stream1=flatten([mirror.Geometry, mecanizados]))
mirror_5 = Mirror(Geometry=move_5.Geometry, Plane=xy_plane)  # -> Geometry, Transform
mirror_6 = Mirror(Geometry=move_6.Geometry, Plane=xy_plane)  # -> Geometry, Transform
unit_z = UnitZ(Factor="-5")
rotate_3d = Rotate3D(Geometry=mirror_2.Geometry, Angle=degrees("180"), Center=xy_plane, Axis=Vector(0, 0, 1))  # -> Geometry, Transform
rotate_3d_2 = Rotate3D(Geometry=mirror_4.Geometry, Angle=degrees("180"), Center=xy_plane, Axis=Vector(0, 0, 1))  # -> Geometry, Transform
negative = Negative(Value=unit_z)
move_7 = Move(Geometry=move_2.Geometry, Motion=negative)  # -> Geometry, Transform
stream_filter_2 = StreamFilter(CambiarLadoMinifixRoscad=cambiar_lado, Stream0=mirror_4.Geometry, Stream1=rotate_3d_2.Geometry)
stream_filter_3 = StreamFilter(Gate=cambiar_lado, Stream0=mirror_2.Geometry, Stream1=rotate_3d.Geometry)
punto_tuerca = ClusterInput()
rotate_3d_3 = Rotate3D(Geometry=move_7.Geometry, Angle=degrees("180"), PuntoTuerca=punto_tuerca, Axis=Vector(0, 0, 1))  # -> Geometry, Transform
dispatch = Dispatch(List=stream_filter_3, DispatchPattern=[True, False])  # -> ListA, ListB
dispatch_2 = Dispatch(List=stream_filter_2, DispatchPattern=[True, False])  # -> ListA, ListB
dispatch_3 = Dispatch(List=dispatch.ListA, DispatchPattern=[True, False])  # -> ListA, ListB
stream_filter_4 = StreamFilter(CambiarLadoTuerca=cambiar_lado, Stream0=move_7.Geometry, Stream1=rotate_3d_3.Geometry)
stream_p_filter = StreamFilter(MinifixDePresion=sujecion_herrajes, Stream1=[dispatch.ListB, dispatch_3.ListA])
stream_filter_5 = StreamFilter(MinifixRoscado=sujecion_herrajes, Stream2=dispatch_2.ListA)
stream_filter_6 = StreamFilter(Tornillo_Largo=sujecion_herrajes, Stream3=mirror_5.Geometry)
stream_filter_7 = StreamFilter(Tornillo_PT=sujecion_herrajes, Stream4=mirror_3.Geometry)
stream_filter_8 = StreamFilter(Tuerca=sujecion_herrajes, Stream5=stream_filter_4)
stream_filter_9 = StreamFilter(Tarugo=sujecion_herrajes, Stream0=mirror_6.Geometry)
panel = Panel(sujecion_herrajes)
stream_filter_10 = StreamFilter(Gate=sujecion_herrajes, Stream1=dispatch_3.ListB, Stream2=dispatch_2.ListB)
mirror_7 = Mirror(Geometry=stream_filter_9, Plane=xz_plane)  # -> Geometry, Transform
mirror_8 = Mirror(Geometry=stream_filter_10, Plane=xz_plane)  # -> Geometry, Transform
mirror_9 = Mirror(Geometry=stream_p_filter, Plane=xz_plane)  # -> Geometry, Transform
mirror_10 = Mirror(Geometry=stream_filter_5, Plane=xz_plane)  # -> Geometry, Transform
mirror_11 = Mirror(Geometry=stream_filter_6, Plane=xz_plane)  # -> Geometry, Transform
mirror_12 = Mirror(Geometry=stream_filter_7, Plane=xz_plane)  # -> Geometry, Transform
mirror_13 = Mirror(Geometry=stream_filter_8, Plane=xz_plane)  # -> Geometry, Transform
stream_filter_11 = StreamFilter(Gate=simetria, Stream0=stream_filter_9, Stream1=[mirror_7.Geometry, stream_filter_9])
stream_filter_12 = StreamFilter(Gate=simetria, Stream0=stream_filter_10, Stream1=[mirror_8.Geometry, stream_filter_10])
stream_filter_13 = StreamFilter(Gate=simetria, Stream0=stream_p_filter, Stream1=[mirror_9.Geometry, stream_p_filter])
stream_filter_14 = StreamFilter(Gate=simetria, Stream0=stream_filter_5, Stream1=[stream_filter_5, mirror_10.Geometry])
stream_filter_15 = StreamFilter(Gate=simetria, Stream0=stream_filter_7, Stream1=[stream_filter_7, mirror_12.Geometry])
stream_filter_16 = StreamFilter(Gate=simetria, Stream0=stream_filter_6, Stream1=[stream_filter_6, mirror_11.Geometry])
stream_filter_17 = StreamFilter(Gate=simetria, Stream0=stream_filter_8, Stream1=[stream_filter_8, mirror_13.Geometry])
mecanizados_2 = ClusterOutput(stream_filter)
tarugo = ClusterOutput(stream_filter_11)
caja_minifix = ClusterOutput(stream_filter_12)
tornillo_pt = ClusterOutput(stream_filter_15)
tornillo_largo = ClusterOutput(stream_filter_16)
tuerca = ClusterOutput(stream_filter_17)
minifix_de_presion = ClusterOutput(stream_filter_13)
minifix_roscado = ClusterOutput(stream_filter_14)

# ==== cluster Cluster_9
sujecion_inferior_herraje = ClusterInput()
cambiar_lado = ClusterInput()
punto_0_internos = ClusterInput()

# ----
# Perforado Minifix
xy_plane = XYPlane(Origin=punto_0_internos)
xy_plane_2 = XYPlane(Origin=punto_0_internos)
cylinder = Cylinder(Base=xy_plane, Radius="3.5", Length="-22")
cylinder_2 = Cylinder(Base=xy_plane_2, Radius="2.5", Length="10")
cap_holes = CapHoles(Brep=cylinder)
cap_holes_2 = CapHoles(Brep=cylinder_2)
deconstruct_brep = DeconstructBrep(Brep=cap_holes)  # -> Faces, Edges, Vertices
list_item = ListItem(List=deconstruct_brep.Faces, Index="4", Wrap=True)
area = Area(Geometry=list_item)  # -> Area, Centroid
unit_z = UnitZ(Factor="-2")
move = Move(Geometry=area.Centroid, Motion=unit_z)  # -> Geometry, Transform
unit_x = UnitX(Factor="-4")
move_2 = Move(Geometry=move.Geometry, Motion=unit_x)  # -> Geometry, Transform
yz_plane = YZPlane(Origin=move_2.Geometry)
cylinder_3 = Cylinder(Base=yz_plane, Radius="7.5", Length="12")
cap_holes_3 = CapHoles(Brep=cylinder_3)
solid_union = SolidUnion(Breps=[cap_holes_3, cap_holes, cap_holes_2])
rotate_3d = Rotate3D(Geometry=solid_union, Angle=degrees("180"), PuntoRotacion=xy_plane, Axis=Vector(0, 0, 1))  # -> Geometry, Transform
stream_filter = StreamFilter(CambiarLado=cambiar_lado, Stream0=solid_union, Stream1=rotate_3d.Geometry)
mirror = Mirror(Geometry=stream_filter, Plane=xy_plane)  # -> Geometry, Transform
solid_union_2 = SolidUnion(Breps=mirror.Geometry)

# ----
# Perforado Tornillo Largo
xy_plane_3 = XYPlane(Origin=punto_0_internos)
cylinder_4 = Cylinder(Base=xy_plane_3, Radius="3", Length="-15")
cylinder_5 = Cylinder(Base=xy_plane_3, Radius="1.5", Length="-20")
cap_holes_4 = CapHoles(Brep=cylinder_4)
cap_holes_5 = CapHoles(Brep=cylinder_5)
mirror_2 = Mirror(Geometry=cap_holes_5, Plane=xy_plane)  # -> Geometry, Transform
solid_union_3 = SolidUnion(Breps=[mirror_2.Geometry, cap_holes_4])

# ----
# Perforado Tuerca
xy_plane_4 = XYPlane(Origin=punto_0_internos)
cylinder_6 = Cylinder(Base=xy_plane_4, Radius="3", Length="15")
cylinder_7 = Cylinder(Base=xy_plane_4, Radius="1.5", Length="-20")
cap_holes_6 = CapHoles(Brep=cylinder_6)
cap_holes_7 = CapHoles(Brep=cylinder_7)
deconstruct_brep_2 = DeconstructBrep(Brep=cap_holes_7)  # -> Faces, Edges, Vertices
list_item_2 = ListItem(List=deconstruct_brep_2.Faces, Index="1", Wrap=True)
area_2 = Area(Geometry=list_item_2)  # -> Area, Centroid
unit_x_2 = UnitX(Factor="-4")
move_3 = Move(Geometry=area_2.Centroid, Motion=unit_x_2)  # -> Geometry, Transform
yz_plane_2 = YZPlane(Origin=move_3.Geometry)
cylinder_8 = Cylinder(Base=yz_plane_2, Radius="6", Length="11.5")
cap_holes_8 = CapHoles(Brep=cylinder_8)
solid_union_4 = SolidUnion(Breps=[cap_holes_8, cap_holes_6, cap_holes_7])
rotate_3d_2 = Rotate3D(Geometry=solid_union_4, Angle=degrees("180"), PuntoRotacion=punto_0_internos, Axis=Vector(0, 0, 1))  # -> Geometry, Transform
stream_filter_2 = StreamFilter(CambiarLado=cambiar_lado, Stream0=solid_union_4, Stream1=rotate_3d_2.Geometry)
mirror_3 = Mirror(Geometry=stream_filter_2, Plane=xy_plane)  # -> Geometry, Transform
solid_union_5 = SolidUnion(Breps=mirror_3.Geometry)

# ----
# Perforado Tarugo
panel = Panel("10")
unit_z_2 = UnitZ(Factor=panel)
move_4 = Move(Geometry=punto_0_internos, Motion=unit_z_2)  # -> Geometry, Transform
xy_plane_5 = XYPlane(Origin=move_4.Geometry)
cylinder_9 = Cylinder(Base=xy_plane_5, Radius="4", Length="-32")
cap_holes_9 = CapHoles(Brep=cylinder_9)
mirror_4 = Mirror(Geometry=cap_holes_9, Plane=xy_plane)  # -> Geometry, Transform
solid_union_6 = SolidUnion(Breps=mirror_4.Geometry)

stream_filter_3 = StreamFilter(
    SujecionInferiorHerraje=sujecion_inferior_herraje,
    Stream0=solid_union_6,
    Stream1=solid_union_2,
    Stream2=solid_union_2,
    Stream3=solid_union_3,
    Stream4=solid_union_3,
    Stream5=solid_union_5)
solid_union_7 = SolidUnion(Breps=stream_filter_3)
punto_0_internos_2 = ClusterOutput(punto_0_internos)
punto_tuerca = ClusterOutput(xy_plane_4)
mecanizados = ClusterOutput(solid_union_7)

# ==== cluster Cluster_10
sujecion_inferior_herraje = ClusterInput()
cambiar_lado = ClusterInput()
punto_0_internos = ClusterInput()

# ----
# Perforado Tornillo Largo
xy_plane = XYPlane(Origin=punto_0_internos)
cylinder = Cylinder(Base=xy_plane, Radius="3", Length="15")
cylinder_2 = Cylinder(Base=xy_plane, Radius="1.5", Length="-20")
cap_holes = CapHoles(Brep=cylinder)
cap_holes_2 = CapHoles(Brep=cylinder_2)
solid_union = SolidUnion(Breps=[cap_holes, cap_holes_2])

# ----
# Perforado Tuerca
xy_plane_2 = XYPlane(Origin=punto_0_internos)
cylinder_3 = Cylinder(Base=xy_plane_2, Radius="3", Length="15")
cylinder_4 = Cylinder(Base=xy_plane_2, Radius="1.5", Length="-20")
cap_holes_3 = CapHoles(Brep=cylinder_3)
cap_holes_4 = CapHoles(Brep=cylinder_4)
deconstruct_brep = DeconstructBrep(Brep=cap_holes_4)  # -> Faces, Edges, Vertices
list_item = ListItem(List=deconstruct_brep.Faces, Index="1", Wrap=True)
area = Area(Geometry=list_item)  # -> Area, Centroid
unit_x = UnitX(Factor="-4")
move = Move(Geometry=area.Centroid, Motion=unit_x)  # -> Geometry, Transform
yz_plane = YZPlane(Origin=move.Geometry)
cylinder_5 = Cylinder(Base=yz_plane, Radius="6", Length="11.5")
cap_holes_5 = CapHoles(Brep=cylinder_5)
solid_union_2 = SolidUnion(Breps=[cap_holes_5, cap_holes_3, cap_holes_4])
rotate_3d = Rotate3D(Geometry=solid_union_2, Angle=degrees("180"), PuntoRotacion=punto_0_internos, Axis=Vector(0, 0, 1))  # -> Geometry, Transform
stream_filter = StreamFilter(CambiarLado=cambiar_lado, Stream0=solid_union_2, Stream1=rotate_3d.Geometry)
solid_union_3 = SolidUnion(Breps=stream_filter)

# ----
# Perforado Minifix
xy_plane_3 = XYPlane(Origin=punto_0_internos)
xy_plane_4 = XYPlane(Origin=punto_0_internos)
cylinder_6 = Cylinder(Base=xy_plane_3, Radius="3.5", Length="-22")
cylinder_7 = Cylinder(Base=xy_plane_4, Radius="2.5", Length="10")
cap_holes_6 = CapHoles(Brep=cylinder_6)
cap_holes_7 = CapHoles(Brep=cylinder_7)
deconstruct_brep_2 = DeconstructBrep(Brep=cap_holes_6)  # -> Faces, Edges, Vertices
list_item_2 = ListItem(List=deconstruct_brep_2.Faces, Index="4", Wrap=True)
area_2 = Area(Geometry=list_item_2)  # -> Area, Centroid
unit_z = UnitZ(Factor="-2")
move_2 = Move(Geometry=area_2.Centroid, Motion=unit_z)  # -> Geometry, Transform
unit_x_2 = UnitX(Factor="-4")
move_3 = Move(Geometry=move_2.Geometry, Motion=unit_x_2)  # -> Geometry, Transform
yz_plane_2 = YZPlane(Origin=move_3.Geometry)
cylinder_8 = Cylinder(Base=yz_plane_2, Radius="7.5", Length="12")
cap_holes_8 = CapHoles(Brep=cylinder_8)
solid_union_4 = SolidUnion(Breps=[cap_holes_8, cap_holes_6, cap_holes_7])
rotate_3d_2 = Rotate3D(Geometry=solid_union_4, Angle=degrees("180"), PuntoRotacion=xy_plane_3, Axis=Vector(0, 0, 1))  # -> Geometry, Transform
stream_filter_2 = StreamFilter(CambiarLado=cambiar_lado, Stream0=solid_union_4, Stream1=rotate_3d_2.Geometry)
solid_union_5 = SolidUnion(Breps=stream_filter_2)

# ----
# Perforado Tarugo
panel = Panel("10")
unit_z_2 = UnitZ(Factor=panel)
move_4 = Move(Geometry=punto_0_internos, Motion=unit_z_2)  # -> Geometry, Transform
xy_plane_5 = XYPlane(Origin=move_4.Geometry)
cylinder_9 = Cylinder(Base=xy_plane_5, Radius="4", Length="-32")
cap_holes_9 = CapHoles(Brep=cylinder_9)
solid_union_6 = SolidUnion(Breps=cap_holes_9)

stream_filter_3 = StreamFilter(
    SujecionInferiorHerraje=sujecion_inferior_herraje,
    Stream0=solid_union_6,
    Stream1=solid_union_5,
    Stream2=solid_union_5,
    Stream3=solid_union,
    Stream4=solid_union,
    Stream5=solid_union_3)
solid_union_7 = SolidUnion(Breps=stream_filter_3)
punto_0_externos = ClusterOutput(punto_0_internos)
punto_tuerca = ClusterOutput(xy_plane_2)
mecanizados = ClusterOutput(solid_union_7)

# ==== cluster Cluster_11
punto_tuerca = ClusterInput()
cambiar_lado = ClusterInput()
punto_simetria = ClusterInput()
punto_0 = ClusterInput()
sujecion_herrajes = ClusterInput()
simetria = ClusterInput()
mecanizados = ClusterInput()
xz_plane = XZPlane(PuntoSimetria=punto_simetria)
xy_plane = XYPlane(Punto0=punto_0)

# ----
# Tuerca
mesh = Mesh(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)
point = Point(Point(-407.5, 0, -7.755556303))

# ----
# Tornillo Largo
mesh_2 = Mesh(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)
point_2 = Point(Point(-300, 0, 41.10029089))

# ----
# Minifix de Presion
mesh_3 = Mesh(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)
mesh_4 = Mesh(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)
point_3 = Point(Point(-205.9999456, 2.770490835e-05, 31.4500147))
mesh_5 = Mesh(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)

# ----
# Minifix Roscado
mesh_6 = Mesh(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)
mesh_7 = Mesh(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)
point_4 = Point(Point(-605.9999456, 2.770490835e-05, 31.4500147))

# ----
# Tornillo PT
mesh_8 = Mesh(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)
point_5 = Point(Point(-500, 0, 32.94388492))

point_6 = Point(Point(-100, 0, 22))
# Tarugo
mesh_9 = Mesh(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)

mirror = Mirror(Mecanizados=mecanizados, Plane=xz_plane)  # -> Geometry, Transform
vector_2pt = Vector2Pt(PointA=point, PointB=xy_plane, Unitize=False)  # -> Vector, Length
unit_z = UnitZ(Factor="35")
vector_2pt_2 = Vector2Pt(PointA=point_3, PointB=xy_plane, Unitize=False)  # -> Vector, Length
vector_2pt_3 = Vector2Pt(PointA=point_5, PointB=xy_plane, Unitize=False)  # -> Vector, Length
vector_2pt_4 = Vector2Pt(PointA=point_2, PointB=xy_plane, Unitize=False)  # -> Vector, Length
vector_2pt_5 = Vector2Pt(PointA=point_4, PointB=xy_plane, Unitize=False)  # -> Vector, Length
vector_2pt_6 = Vector2Pt(PointA=point_6, PointB=xy_plane, Unitize=False)  # -> Vector, Length
move = Move(Geometry=mesh, Motion=vector_2pt.Vector)  # -> Geometry, Transform
move_2 = Move(Geometry=[mesh_3, mesh_5, mesh_4], Motion=vector_2pt_2.Vector)  # -> Geometry, Transform
negative = Negative(Value=unit_z)
move_3 = Move(Geometry=mesh_8, Motion=vector_2pt_3.Vector)  # -> Geometry, Transform
move_4 = Move(Geometry=[mesh_6, mesh_7], Motion=vector_2pt_5.Vector)  # -> Geometry, Transform
move_5 = Move(Geometry=mesh_2, Motion=vector_2pt_4.Vector)  # -> Geometry, Transform
move_6 = Move(Geometry=mesh_9, Motion=vector_2pt_6.Vector)  # -> Geometry, Transform
move_7 = Move(Geometry=move.Geometry, Motion=negative)  # -> Geometry, Transform
stream_filter = StreamFilter(Gate=simetria, Stream0=mecanizados, Stream1=flatten([mecanizados, mirror.Geometry]))
mecanizados_2 = ClusterOutput(stream_filter)
rotate_3d = Rotate3D(Geometry=move_7.Geometry, Angle=degrees("180"), PuntoTuerca=punto_tuerca, Axis=Vector(0, 0, 1))  # -> Geometry, Transform
rotate_3d_2 = Rotate3D(Geometry=move_2.Geometry, Angle=degrees("180"), Center=xy_plane, Axis=Vector(0, 0, 1))  # -> Geometry, Transform
rotate_3d_3 = Rotate3D(Geometry=move_4.Geometry, Angle=degrees("180"), Center=xy_plane, Axis=Vector(0, 0, 1))  # -> Geometry, Transform
stream_filter_2 = StreamFilter(CambiarLadoTuerca=0, Stream0=move_7.Geometry, Stream1=rotate_3d.Geometry)
stream_filter_3 = StreamFilter(CambiarLadoMinifixRoscad=cambiar_lado, Stream0=move_4.Geometry, Stream1=rotate_3d_3.Geometry)
stream_filter_4 = StreamFilter(Gate=cambiar_lado, Stream0=move_2.Geometry, Stream1=rotate_3d_2.Geometry)
dispatch = Dispatch(List=stream_filter_4, DispatchPattern=[True, False])  # -> ListA, ListB
dispatch_2 = Dispatch(List=stream_filter_3, DispatchPattern=[True, False])  # -> ListA, ListB
dispatch_3 = Dispatch(List=dispatch.ListA, DispatchPattern=[True, False])  # -> ListA, ListB
stream_p_filter = StreamFilter(MinifixDePresion=sujecion_herrajes, Stream1=[dispatch.ListB, dispatch_3.ListA])
stream_filter_5 = StreamFilter(MinifixRoscado=sujecion_herrajes, Stream2=dispatch_2.ListA)
stream_filter_6 = StreamFilter(Tornillo_Largo=sujecion_herrajes, Stream3=move_5.Geometry)
stream_filter_7 = StreamFilter(Tornillo_PT=sujecion_herrajes, Stream4=move_3.Geometry)
stream_filter_8 = StreamFilter(Tuerca=sujecion_herrajes, Stream5=stream_filter_2)
stream_filter_9 = StreamFilter(Tarugo=sujecion_herrajes, Stream0=move_6.Geometry)
panel = Panel(sujecion_herrajes)
stream_filter_10 = StreamFilter(Gate=sujecion_herrajes, Stream1=dispatch_3.ListB, Stream2=dispatch_2.ListB)
mirror_2 = Mirror(Geometry=stream_filter_9, Plane=xz_plane)  # -> Geometry, Transform
mirror_3 = Mirror(Geometry=stream_filter_10, Plane=xz_plane)  # -> Geometry, Transform
mirror_4 = Mirror(Geometry=stream_p_filter, Plane=xz_plane)  # -> Geometry, Transform
mirror_5 = Mirror(Geometry=stream_filter_5, Plane=xz_plane)  # -> Geometry, Transform
mirror_6 = Mirror(Geometry=stream_filter_6, Plane=xz_plane)  # -> Geometry, Transform
mirror_7 = Mirror(Geometry=stream_filter_7, Plane=xz_plane)  # -> Geometry, Transform
mirror_8 = Mirror(Geometry=stream_filter_8, Plane=xz_plane)  # -> Geometry, Transform
stream_filter_11 = StreamFilter(Gate=simetria, Stream0=stream_filter_9, Stream1=[mirror_2.Geometry, stream_filter_9])
tarugo = ClusterOutput(stream_filter_11)
stream_filter_12 = StreamFilter(Gate=simetria, Stream0=stream_filter_10, Stream1=[mirror_3.Geometry, stream_filter_10])
caja_minifix = ClusterOutput(stream_filter_12)
stream_filter_13 = StreamFilter(Gate=simetria, Stream0=stream_p_filter, Stream1=[mirror_4.Geometry, stream_p_filter])
minifix_de_presion = ClusterOutput(stream_filter_13)
stream_filter_14 = StreamFilter(Gate=simetria, Stream0=stream_filter_5, Stream1=[stream_filter_5, mirror_5.Geometry])
minifix_roscado = ClusterOutput(stream_filter_14)
stream_filter_15 = StreamFilter(Gate=simetria, Stream0=stream_filter_7, Stream1=[stream_filter_7, mirror_7.Geometry])
tornillo_pt = ClusterOutput(stream_filter_15)
stream_filter_16 = StreamFilter(Gate=simetria, Stream0=stream_filter_6, Stream1=[stream_filter_6, mirror_6.Geometry])
tornillo_largo = ClusterOutput(stream_filter_16)
stream_filter_17 = StreamFilter(Gate=simetria, Stream0=stream_filter_8, Stream1=[stream_filter_8, mirror_8.Geometry])
tuerca = ClusterOutput(stream_filter_17)

# ==== cluster Cluster_12
sujecion_inferior_herraje = ClusterInput()
cambiar_lado = ClusterInput()
punto_0_internos = ClusterInput()

# ----
# Perforado Tornillo Largo
xy_plane = XYPlane(Origin=punto_0_internos)
cylinder = Cylinder(Base=xy_plane, Radius="3", Length="15")
cylinder_2 = Cylinder(Base=xy_plane, Radius="1.5", Length="-20")
cap_holes = CapHoles(Brep=cylinder)
cap_holes_2 = CapHoles(Brep=cylinder_2)
solid_union = SolidUnion(Breps=[cap_holes, cap_holes_2])

# ----
# Perforado Tuerca
xy_plane_2 = XYPlane(Origin=punto_0_internos)
cylinder_3 = Cylinder(Base=xy_plane_2, Radius="3", Length="15")
cylinder_4 = Cylinder(Base=xy_plane_2, Radius="1.5", Length="-20")
cap_holes_3 = CapHoles(Brep=cylinder_3)
cap_holes_4 = CapHoles(Brep=cylinder_4)
deconstruct_brep = DeconstructBrep(Brep=cap_holes_4)  # -> Faces, Edges, Vertices
list_item = ListItem(List=deconstruct_brep.Faces, Index="1", Wrap=True)
area = Area(Geometry=list_item)  # -> Area, Centroid
unit_x = UnitX(Factor="-4")
move = Move(Geometry=area.Centroid, Motion=unit_x)  # -> Geometry, Transform
yz_plane = YZPlane(Origin=move.Geometry)
cylinder_5 = Cylinder(Base=yz_plane, Radius="6", Length="11.5")
cap_holes_5 = CapHoles(Brep=cylinder_5)
solid_union_2 = SolidUnion(Breps=[cap_holes_5, cap_holes_3, cap_holes_4])
rotate_3d = Rotate3D(Geometry=solid_union_2, Angle=degrees("180"), PuntoRotacion=punto_0_internos, Axis=Vector(0, 0, 1))  # -> Geometry, Transform
stream_filter = StreamFilter(CambiarLado=cambiar_lado, Stream0=solid_union_2, Stream1=rotate_3d.Geometry)
solid_union_3 = SolidUnion(Breps=stream_filter)

# ----
# Perforado Minifix
xy_plane_3 = XYPlane(Origin=punto_0_internos)
xy_plane_4 = XYPlane(Origin=punto_0_internos)
cylinder_6 = Cylinder(Base=xy_plane_3, Radius="3.5", Length="-22")
cylinder_7 = Cylinder(Base=xy_plane_4, Radius="2.5", Length="10")
cap_holes_6 = CapHoles(Brep=cylinder_6)
cap_holes_7 = CapHoles(Brep=cylinder_7)
deconstruct_brep_2 = DeconstructBrep(Brep=cap_holes_6)  # -> Faces, Edges, Vertices
list_item_2 = ListItem(List=deconstruct_brep_2.Faces, Index="4", Wrap=True)
area_2 = Area(Geometry=list_item_2)  # -> Area, Centroid
unit_z = UnitZ(Factor="-2")
move_2 = Move(Geometry=area_2.Centroid, Motion=unit_z)  # -> Geometry, Transform
unit_x_2 = UnitX(Factor="-4")
move_3 = Move(Geometry=move_2.Geometry, Motion=unit_x_2)  # -> Geometry, Transform
yz_plane_2 = YZPlane(Origin=move_3.Geometry)
cylinder_8 = Cylinder(Base=yz_plane_2, Radius="7.5", Length="12")
cap_holes_8 = CapHoles(Brep=cylinder_8)
solid_union_4 = SolidUnion(Breps=[cap_holes_8, cap_holes_6, cap_holes_7])
rotate_3d_2 = Rotate3D(Geometry=solid_union_4, Angle=degrees("180"), PuntoRotacion=xy_plane_3, Axis=Vector(0, 0, 1))  # -> Geometry, Transform
stream_filter_2 = StreamFilter(CambiarLado=cambiar_lado, Stream0=solid_union_4, Stream1=rotate_3d_2.Geometry)
solid_union_5 = SolidUnion(Breps=stream_filter_2)

# ----
# Perforado Tarugo
panel = Panel("10")
unit_z_2 = UnitZ(Factor=panel)
move_4 = Move(Geometry=punto_0_internos, Motion=unit_z_2)  # -> Geometry, Transform
xy_plane_5 = XYPlane(Origin=move_4.Geometry)
cylinder_9 = Cylinder(Base=xy_plane_5, Radius="4", Length="-32")
cap_holes_9 = CapHoles(Brep=cylinder_9)
solid_union_6 = SolidUnion(Breps=cap_holes_9)

stream_filter_3 = StreamFilter(
    SujecionInferiorHerraje=sujecion_inferior_herraje,
    Stream0=solid_union_6,
    Stream1=solid_union_5,
    Stream2=solid_union_5,
    Stream3=solid_union,
    Stream4=solid_union,
    Stream5=solid_union_3)
solid_union_7 = SolidUnion(Breps=stream_filter_3)
punto_0_internos_2 = ClusterOutput(punto_0_internos)
punto_tuerca = ClusterOutput(xy_plane_2)
mecanizados = ClusterOutput(solid_union_7)

# ==== cluster Cluster_13
punto_simetria = ClusterInput()
sujecion_herrajes = ClusterInput()
cambiar_lado = ClusterInput()
punto_0 = ClusterInput()
mecanizados = ClusterInput()
simetria = ClusterInput()
xz_plane = XZPlane(PuntoSimetria=punto_simetria)
xy_plane = XYPlane(Punto0=punto_0)

# ----
# Tuerca
mesh = Mesh(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)
point = Point(Point(-407.5, 0, -7.755556303))

# ----
# Tornillo Largo
mesh_2 = Mesh(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)
point_2 = Point(Point(-300, 0, 41.10029089))

# ----
# Minifix de Presion
mesh_3 = Mesh(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)
mesh_4 = Mesh(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)
point_3 = Point(Point(-205.9999456, 2.770490835e-05, 31.4500147))
mesh_5 = Mesh(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)

# ----
# Minifix Roscado
mesh_6 = Mesh(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)
mesh_7 = Mesh(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)
point_4 = Point(Point(-605.9999456, 2.770490835e-05, 31.4500147))

# ----
# Tornillo PT
mesh_8 = Mesh(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)
point_5 = Point(Point(-500, 0, 32.94388492))

point_6 = Point(Point(-100, 0, 22))
# Tarugo
mesh_9 = Mesh(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)

mirror = Mirror(Mecanizados=mecanizados, Plane=xz_plane)  # -> Geometry, Transform
vector_2pt = Vector2Pt(PointA=point, PointB=xy_plane, Unitize=False)  # -> Vector, Length
unit_z = UnitZ(Factor="35")
vector_2pt_2 = Vector2Pt(PointA=point_3, PointB=xy_plane, Unitize=False)  # -> Vector, Length
vector_2pt_3 = Vector2Pt(PointA=point_5, PointB=xy_plane, Unitize=False)  # -> Vector, Length
vector_2pt_4 = Vector2Pt(PointA=point_2, PointB=xy_plane, Unitize=False)  # -> Vector, Length
vector_2pt_5 = Vector2Pt(PointA=point_4, PointB=xy_plane, Unitize=False)  # -> Vector, Length
vector_2pt_6 = Vector2Pt(PointA=point_6, PointB=xy_plane, Unitize=False)  # -> Vector, Length
move = Move(Geometry=mesh, Motion=vector_2pt.Vector)  # -> Geometry, Transform
move_2 = Move(Geometry=[mesh_3, mesh_5, mesh_4], Motion=vector_2pt_2.Vector)  # -> Geometry, Transform
negative = Negative(Value=unit_z)
move_3 = Move(Geometry=mesh_8, Motion=vector_2pt_3.Vector)  # -> Geometry, Transform
move_4 = Move(Geometry=[mesh_6, mesh_7], Motion=vector_2pt_5.Vector)  # -> Geometry, Transform
move_5 = Move(Geometry=mesh_2, Motion=vector_2pt_4.Vector)  # -> Geometry, Transform
move_6 = Move(Geometry=mesh_9, Motion=vector_2pt_6.Vector)  # -> Geometry, Transform
move_7 = Move(Geometry=move.Geometry, Motion=negative)  # -> Geometry, Transform
stream_filter = StreamFilter(Gate=simetria, Stream0=mecanizados, Stream1=flatten([mecanizados, mirror.Geometry]))
punto_tuerca = ClusterInput()
rotate_3d = Rotate3D(Geometry=move_7.Geometry, Angle=degrees("180"), PuntoTuerca=punto_tuerca, Axis=Vector(0, 0, 1))  # -> Geometry, Transform
rotate_3d_2 = Rotate3D(Geometry=move_2.Geometry, Angle=degrees("180"), Center=xy_plane, Axis=Vector(0, 0, 1))  # -> Geometry, Transform
rotate_3d_3 = Rotate3D(Geometry=move_4.Geometry, Angle=degrees("180"), Center=xy_plane, Axis=Vector(0, 0, 1))  # -> Geometry, Transform
stream_filter_2 = StreamFilter(CambiarLadoTuerca=0, Stream0=move_7.Geometry, Stream1=rotate_3d.Geometry)
stream_filter_3 = StreamFilter(CambiarLadoMinifixRoscad=cambiar_lado, Stream0=move_4.Geometry, Stream1=rotate_3d_3.Geometry)
stream_filter_4 = StreamFilter(Gate=cambiar_lado, Stream0=move_2.Geometry, Stream1=rotate_3d_2.Geometry)
dispatch = Dispatch(List=stream_filter_4, DispatchPattern=[True, False])  # -> ListA, ListB
dispatch_2 = Dispatch(List=stream_filter_3, DispatchPattern=[True, False])  # -> ListA, ListB
dispatch_3 = Dispatch(List=dispatch.ListA, DispatchPattern=[True, False])  # -> ListA, ListB
stream_p_filter = StreamFilter(MinifixDePresion=sujecion_herrajes, Stream1=[dispatch.ListB, dispatch_3.ListA])
stream_filter_5 = StreamFilter(MinifixRoscado=sujecion_herrajes, Stream2=dispatch_2.ListA)
stream_filter_6 = StreamFilter(Tornillo_Largo=sujecion_herrajes, Stream3=move_5.Geometry)
stream_filter_7 = StreamFilter(Tornillo_PT=sujecion_herrajes, Stream4=move_3.Geometry)
stream_filter_8 = StreamFilter(Tuerca=sujecion_herrajes, Stream5=stream_filter_2)
stream_filter_9 = StreamFilter(Tarugo=sujecion_herrajes, Stream0=move_6.Geometry)
panel = Panel(sujecion_herrajes)
stream_filter_10 = StreamFilter(Gate=sujecion_herrajes, Stream1=dispatch_3.ListB, Stream2=dispatch_2.ListB)
mirror_2 = Mirror(Geometry=stream_filter_9, Plane=xz_plane)  # -> Geometry, Transform
mirror_3 = Mirror(Geometry=stream_filter_10, Plane=xz_plane)  # -> Geometry, Transform
mirror_4 = Mirror(Geometry=stream_p_filter, Plane=xz_plane)  # -> Geometry, Transform
mirror_5 = Mirror(Geometry=stream_filter_5, Plane=xz_plane)  # -> Geometry, Transform
mirror_6 = Mirror(Geometry=stream_filter_6, Plane=xz_plane)  # -> Geometry, Transform
mirror_7 = Mirror(Geometry=stream_filter_7, Plane=xz_plane)  # -> Geometry, Transform
mirror_8 = Mirror(Geometry=stream_filter_8, Plane=xz_plane)  # -> Geometry, Transform
stream_filter_11 = StreamFilter(Gate=simetria, Stream0=stream_filter_9, Stream1=[mirror_2.Geometry, stream_filter_9])
stream_filter_12 = StreamFilter(Gate=simetria, Stream0=stream_filter_10, Stream1=[mirror_3.Geometry, stream_filter_10])
stream_filter_13 = StreamFilter(Gate=simetria, Stream0=stream_p_filter, Stream1=[mirror_4.Geometry, stream_p_filter])
stream_filter_14 = StreamFilter(Gate=simetria, Stream0=stream_filter_5, Stream1=[stream_filter_5, mirror_5.Geometry])
stream_filter_15 = StreamFilter(Gate=simetria, Stream0=stream_filter_7, Stream1=[stream_filter_7, mirror_7.Geometry])
stream_filter_16 = StreamFilter(Gate=simetria, Stream0=stream_filter_6, Stream1=[stream_filter_6, mirror_6.Geometry])
stream_filter_17 = StreamFilter(Gate=simetria, Stream0=stream_filter_8, Stream1=[stream_filter_8, mirror_8.Geometry])
mecanizados_2 = ClusterOutput(stream_filter)
tarugo = ClusterOutput(stream_filter_11)
caja_minifix = ClusterOutput(stream_filter_12)
tornillo_pt = ClusterOutput(stream_filter_15)
tornillo_largo = ClusterOutput(stream_filter_16)
tuerca = ClusterOutput(stream_filter_17)
minifix_de_presion = ClusterOutput(stream_filter_13)
minifix_roscado = ClusterOutput(stream_filter_14)
